# Grasshopper definition LIBRARY_2D_Arabesk.gh (Grasshopper 1.0.7)

number_slider = Slider(24, range=0..100)
number_slider_2 = Slider(6, range=0..100)
number_slider_3 = Slider(24, range=0..100)
number_slider_4 = Slider(0.25, range=0..1)
number_slider_5 = Slider(6, range=0..100)
number_slider_6 = Slider(24, range=0..100)
number_slider_7 = Slider(0.5, range=0..1)
number_slider_8 = Slider(6, range=0..100)
number_slider_9 = Slider(0.75, range=0..1)
pt = Point(Point(0, 0, 0))
pt_2 = Point(Point(0, 0, 0))
pt_3 = Point(Point(0, 0, 0))
square_grid_generator = SquareGridGenerator(origin_point=pt, cell_scale=Slider(2, range=0..10), x_axis_extent=number_slider, y_axis_extent=number_slider)  # -> flatten(grid_cell_curves_2), flatten(grid_area_centroids)
square_grid_generator_2 = SquareGridGenerator(origin_point=pt_2, cell_scale=Slider(2, range=0..10), x_axis_extent=number_slider_3, y_axis_extent=number_slider_3)  # -> flatten(grid_cell_curves_2), flatten(grid_area_centroids)
square_grid_generator_3 = SquareGridGenerator(origin_point=pt_3, cell_scale=Slider(2, range=0..10), x_axis_extent=number_slider_6, y_axis_extent=number_slider_6)  # -> flatten(grid_cell_curves_2), flatten(grid_area_centroids)
crv = Curve(square_grid_generator.grid_cell_curves_2)
crv_2 = Curve(square_grid_generator_2.grid_cell_curves_2)
crv_3 = Curve(square_grid_generator_3.grid_cell_curves_2)
pt_4 = Point(square_grid_generator.grid_area_centroids)
pt_5 = Point(square_grid_generator_2.grid_area_centroids)
pt_6 = Point(square_grid_generator_3.grid_area_centroids)
disc = Discontinuity(Curve=crv, Level=1)  # -> flatten(Points), Parameters
disc_2 = Discontinuity(Curve=crv_2, Level=1)  # -> flatten(Points), Parameters
disc_3 = Discontinuity(Curve=crv_3, Level=1)  # -> flatten(Points), Parameters
cir = Circle(Plane=pt_4, Radius=Slider(1, range=0..10))
cir_2 = Circle(Plane=pt_5, Radius=Slider(1, range=0..10))
cir_3 = Circle(Plane=pt_6, Radius=Slider(1, range=0..10))
division = Division(A=number_slider_4, B=Slider(2, range=0..10))
division_2 = Division(A=number_slider_7, B=Slider(2, range=0..10))
division_3 = Division(A=number_slider_9, B=Slider(2, range=0..10))
scale = Scale(Geometry=cir, Center=pt_4, Factor=number_slider_4)  # -> Geometry, Transform
cir_4 = Circle(Plane=disc.Points, Radius=division)
scale_2 = Scale(Geometry=cir_2, Center=pt_5, Factor=number_slider_7)  # -> Geometry, Transform
cir_5 = Circle(Plane=disc_2.Points, Radius=division_2)
scale_3 = Scale(Geometry=cir_3, Center=pt_6, Factor=number_slider_9)  # -> Geometry, Transform
cir_6 = Circle(Plane=disc_3.Points, Radius=division_3)
scale_4 = Scale(Geometry=cir_4, Center=disc.Points, Factor=number_slider_4)  # -> Geometry, Transform
scale_5 = Scale(Geometry=cir_5, Center=disc_2.Points, Factor=number_slider_7)  # -> Geometry, Transform
scale_6 = Scale(Geometry=cir_6, Center=disc_3.Points, Factor=number_slider_9)  # -> Geometry, Transform
divide = DivideCurve(Curve=cir_4, Count=number_slider_2, Kinks=False)  # -> Points, Tangents, Parameters
divide_2 = DivideCurve(Curve=cir_5, Count=number_slider_5, Kinks=False)  # -> Points, Tangents, Parameters
divide_3 = DivideCurve(Curve=cir_6, Count=number_slider_8, Kinks=False)  # -> Points, Tangents, Parameters
divide_4 = DivideCurve(Curve=scale.Geometry, Count=number_slider_2, Kinks=False)  # -> Points, Tangents, Parameters
divide_5 = DivideCurve(Curve=scale_2.Geometry, Count=number_slider_5, Kinks=False)  # -> Points, Tangents, Parameters
divide_6 = DivideCurve(Curve=cir, Count=number_slider_2, Kinks=False)  # -> Points, Tangents, Parameters
divide_7 = DivideCurve(Curve=scale_3.Geometry, Count=number_slider_8, Kinks=False)  # -> Points, Tangents, Parameters
divide_8 = DivideCurve(Curve=cir_2, Count=number_slider_5, Kinks=False)  # -> Points, Tangents, Parameters
divide_9 = DivideCurve(Curve=cir_3, Count=number_slider_8, Kinks=False)  # -> Points, Tangents, Parameters
divide_10 = DivideCurve(Curve=scale_4.Geometry, Count=number_slider_2, Kinks=False)  # -> Points, Tangents, Parameters
divide_11 = DivideCurve(Curve=scale_5.Geometry, Count=number_slider_5, Kinks=False)  # -> Points, Tangents, Parameters
divide_12 = DivideCurve(Curve=scale_6.Geometry, Count=number_slider_8, Kinks=False)  # -> Points, Tangents, Parameters
dispatch = Dispatch(List=divide.Points, DispatchPattern=[True, False])  # -> ListA, ListB
dispatch_2 = Dispatch(List=divide_2.Points, DispatchPattern=[True, False])  # -> ListA, ListB
dispatch_3 = Dispatch(List=divide_3.Points, DispatchPattern=[True, False])  # -> ListA, ListB
dispatch_4 = Dispatch(List=divide_6.Points, DispatchPattern=[True, False])  # -> ListA, ListB
dispatch_5 = Dispatch(List=divide_4.Points, DispatchPattern=[True, False])  # -> ListA, ListB
dispatch_6 = Dispatch(List=divide_8.Points, DispatchPattern=[True, False])  # -> ListA, ListB
dispatch_7 = Dispatch(List=divide_5.Points, DispatchPattern=[True, False])  # -> ListA, ListB
dispatch_8 = Dispatch(List=divide_9.Points, DispatchPattern=[True, False])  # -> ListA, ListB
dispatch_9 = Dispatch(List=divide_10.Points, DispatchPattern=[True, False])  # -> ListA, ListB
dispatch_10 = Dispatch(List=divide_7.Points, DispatchPattern=[True, False])  # -> ListA, ListB
dispatch_11 = Dispatch(List=divide_11.Points, DispatchPattern=[True, False])  # -> ListA, ListB
dispatch_12 = Dispatch(List=divide_12.Points, DispatchPattern=[True, False])  # -> ListA, ListB
pt_7 = Point(dispatch.ListA)
pt_8 = Point(dispatch_2.ListA)
pt_9 = Point(dispatch_3.ListA)
pt_10 = Point(dispatch_5.ListA)
pt_11 = Point(dispatch_7.ListA)
pt_12 = Point(dispatch_4.ListB)
pt_13 = Point(dispatch_10.ListA)
pt_14 = Point(dispatch_6.ListB)
pt_15 = Point(dispatch_9.ListA)
pt_16 = Point(dispatch_8.ListB)
pt_17 = Point(dispatch_11.ListA)
pt_18 = Point(dispatch_12.ListA)
shift = ShiftList(List=pt_10, Shift=1, Wrap=True)
shift_2 = ShiftList(List=pt_11, Shift=1, Wrap=True)
shift_3 = ShiftList(List=pt_13, Shift=1, Wrap=True)
shift_4 = ShiftList(List=pt_15, Shift=1, Wrap=True)
shift_5 = ShiftList(List=pt_17, Shift=1, Wrap=True)
shift_6 = ShiftList(List=pt_18, Shift=1, Wrap=True)
weave = Weave(Pattern=[0, 1], Stream0=pt_7, Stream1=shift_4, NullGaps=False)
weave_2 = Weave(Pattern=[0, 1], Stream0=pt_8, Stream1=shift_5, NullGaps=False)
weave_3 = Weave(Pattern=[0, 1], Stream0=pt_12, Stream1=shift, NullGaps=False)
weave_4 = Weave(Pattern=[0, 1], Stream0=pt_9, Stream1=shift_6, NullGaps=False)
weave_5 = Weave(Pattern=[0, 1], Stream0=pt_14, Stream1=shift_2, NullGaps=False)
weave_6 = Weave(Pattern=[0, 1], Stream0=pt_16, Stream1=shift_3, NullGaps=False)
pline = PolyLine(Vertices=weave_3, Closed=True)
pline_2 = PolyLine(Vertices=weave_5, Closed=True)
pline_3 = PolyLine(Vertices=weave_6, Closed=True)
pline_4 = PolyLine(Vertices=weave, Closed=True)
pline_5 = PolyLine(Vertices=weave_2, Closed=True)
pline_6 = PolyLine(Vertices=weave_4, Closed=True)
crv_4 = Curve(crv)
crv_5 = Curve([pline, pline_4])
crv_6 = Curve([scale.Geometry, cir, cir_4, scale_4.Geometry])
crv_7 = Curve(crv_2)
crv_8 = Curve([scale_2.Geometry, cir_2, cir_5, scale_5.Geometry])
crv_9 = Curve([pline_2, pline_5])
crv_10 = Curve(crv_3)
crv_11 = Curve([pline_3, pline_6])
crv_12 = Curve([scale_3.Geometry, cir_3, cir_6, scale_6.Geometry])
number_slider_10 = Slider(24, range=0..100)
number_slider_11 = Slider(8, range=0..100)
number_slider_12 = Slider(24, range=0..100)
number_slider_13 = Slider(0.25, range=0..1)
number_slider_14 = Slider(8, range=0..100)
number_slider_15 = Slider(24, range=0..100)
number_slider_16 = Slider(0.5, range=0..1)
number_slider_17 = Slider(8, range=0..100)
number_slider_18 = Slider(0.75, range=0..1)
pt_19 = Point(Point(0, 0, 0))
pt_20 = Point(Point(0, 0, 0))
pt_21 = Point(Point(0, 0, 0))
square_grid_generator_4 = SquareGridGenerator(origin_point=pt_19, cell_scale=Slider(2, range=0..10), x_axis_extent=number_slider_10, y_axis_extent=number_slider_10)  # -> flatten(grid_cell_curves_2), flatten(grid_area_centroids)
square_grid_generator_5 = SquareGridGenerator(origin_point=pt_20, cell_scale=Slider(2, range=0..10), x_axis_extent=number_slider_12, y_axis_extent=number_slider_12)  # -> flatten(grid_cell_curves_2), flatten(grid_area_centroids)
square_grid_generator_6 = SquareGridGenerator(origin_point=pt_21, cell_scale=Slider(2, range=0..10), x_axis_extent=number_slider_15, y_axis_extent=number_slider_15)  # -> flatten(grid_cell_curves_2), flatten(grid_area_centroids)
crv_13 = Curve(square_grid_generator_4.grid_cell_curves_2)
crv_14 = Curve(square_grid_generator_5.grid_cell_curves_2)
crv_15 = Curve(square_grid_generator_6.grid_cell_curves_2)
pt_22 = Point(square_grid_generator_4.grid_area_centroids)
pt_23 = Point(square_grid_generator_5.grid_area_centroids)
pt_24 = Point(square_grid_generator_6.grid_area_centroids)
disc_4 = Discontinuity(Curve=crv_13, Level=1)  # -> flatten(Points), Parameters
disc_5 = Discontinuity(Curve=crv_14, Level=1)  # -> flatten(Points), Parameters
disc_6 = Discontinuity(Curve=crv_15, Level=1)  # -> flatten(Points), Parameters
cir_7 = Circle(Plane=pt_22, Radius=Slider(1, range=0..10))
cir_8 = Circle(Plane=pt_23, Radius=Slider(1, range=0..10))
cir_9 = Circle(Plane=pt_24, Radius=Slider(1, range=0..10))
division_4 = Division(A=number_slider_13, B=Slider(2, range=0..10))
division_5 = Division(A=number_slider_16, B=Slider(2, range=0..10))
division_6 = Division(A=number_slider_18, B=Slider(2, range=0..10))
scale_7 = Scale(Geometry=cir_7, Center=pt_22, Factor=number_slider_13)  # -> Geometry, Transform
cir_10 = Circle(Plane=disc_4.Points, Radius=division_4)
scale_8 = Scale(Geometry=cir_8, Center=pt_23, Factor=number_slider_16)  # -> Geometry, Transform
cir_11 = Circle(Plane=disc_5.Points, Radius=division_5)
scale_9 = Scale(Geometry=cir_9, Center=pt_24, Factor=number_slider_18)  # -> Geometry, Transform
cir_12 = Circle(Plane=disc_6.Points, Radius=division_6)
scale_10 = Scale(Geometry=cir_10, Center=disc_4.Points, Factor=number_slider_13)  # -> Geometry, Transform
scale_11 = Scale(Geometry=cir_11, Center=disc_5.Points, Factor=number_slider_16)  # -> Geometry, Transform
scale_12 = Scale(Geometry=cir_12, Center=disc_6.Points, Factor=number_slider_18)  # -> Geometry, Transform
divide_13 = DivideCurve(Curve=cir_10, Count=number_slider_11, Kinks=False)  # -> Points, Tangents, Parameters
divide_14 = DivideCurve(Curve=cir_11, Count=number_slider_14, Kinks=False)  # -> Points, Tangents, Parameters
divide_15 = DivideCurve(Curve=cir_12, Count=number_slider_17, Kinks=False)  # -> Points, Tangents, Parameters
divide_16 = DivideCurve(Curve=scale_7.Geometry, Count=number_slider_11, Kinks=False)  # -> Points, Tangents, Parameters
divide_17 = DivideCurve(Curve=scale_8.Geometry, Count=number_slider_14, Kinks=False)  # -> Points, Tangents, Parameters
divide_18 = DivideCurve(Curve=cir_7, Count=number_slider_11, Kinks=False)  # -> Points, Tangents, Parameters
divide_19 = DivideCurve(Curve=scale_9.Geometry, Count=number_slider_17, Kinks=False)  # -> Points, Tangents, Parameters
divide_20 = DivideCurve(Curve=cir_8, Count=number_slider_14, Kinks=False)  # -> Points, Tangents, Parameters
divide_21 = DivideCurve(Curve=cir_9, Count=number_slider_17, Kinks=False)  # -> Points, Tangents, Parameters
divide_22 = DivideCurve(Curve=scale_10.Geometry, Count=number_slider_11, Kinks=False)  # -> Points, Tangents, Parameters
divide_23 = DivideCurve(Curve=scale_11.Geometry, Count=number_slider_14, Kinks=False)  # -> Points, Tangents, Parameters
divide_24 = DivideCurve(Curve=scale_12.Geometry, Count=number_slider_17, Kinks=False)  # -> Points, Tangents, Parameters
dispatch_13 = Dispatch(List=divide_13.Points, DispatchPattern=[True, False])  # -> ListA, ListB
dispatch_14 = Dispatch(List=divide_14.Points, DispatchPattern=[True, False])  # -> ListA, ListB
dispatch_15 = Dispatch(List=divide_15.Points, DispatchPattern=[True, False])  # -> ListA, ListB
dispatch_16 = Dispatch(List=divide_18.Points, DispatchPattern=[True, False])  # -> ListA, ListB
dispatch_17 = Dispatch(List=divide_16.Points, DispatchPattern=[True, False])  # -> ListA, ListB
dispatch_18 = Dispatch(List=divide_20.Points, DispatchPattern=[True, False])  # -> ListA, ListB
dispatch_19 = Dispatch(List=divide_17.Points, DispatchPattern=[True, False])  # -> ListA, ListB
dispatch_20 = Dispatch(List=divide_21.Points, DispatchPattern=[True, False])  # -> ListA, ListB
dispatch_21 = Dispatch(List=divide_22.Points, DispatchPattern=[True, False])  # -> ListA, ListB
dispatch_22 = Dispatch(List=divide_19.Points, DispatchPattern=[True, False])  # -> ListA, ListB
dispatch_23 = Dispatch(List=divide_23.Points, DispatchPattern=[True, False])  # -> ListA, ListB
dispatch_24 = Dispatch(List=divide_24.Points, DispatchPattern=[True, False])  # -> ListA, ListB
pt_25 = Point(dispatch_13.ListA)
pt_26 = Point(dispatch_14.ListA)
pt_27 = Point(dispatch_15.ListA)
pt_28 = Point(dispatch_17.ListA)
pt_29 = Point(dispatch_19.ListA)
pt_30 = Point(dispatch_16.ListB)
pt_31 = Point(dispatch_22.ListA)
pt_32 = Point(dispatch_18.ListB)
pt_33 = Point(dispatch_21.ListA)
pt_34 = Point(dispatch_20.ListB)
pt_35 = Point(dispatch_23.ListA)
pt_36 = Point(dispatch_24.ListA)
shift_7 = ShiftList(List=pt_28, Shift=1, Wrap=True)
shift_8 = ShiftList(List=pt_29, Shift=1, Wrap=True)
shift_9 = ShiftList(List=pt_31, Shift=1, Wrap=True)
shift_10 = ShiftList(List=pt_33, Shift=1, Wrap=True)
shift_11 = ShiftList(List=pt_35, Shift=1, Wrap=True)
shift_12 = ShiftList(List=pt_36, Shift=1, Wrap=True)
weave_7 = Weave(Pattern=[0, 1], Stream0=pt_25, Stream1=shift_10, NullGaps=False)
weave_8 = Weave(Pattern=[0, 1], Stream0=pt_26, Stream1=shift_11, NullGaps=False)
weave_9 = Weave(Pattern=[0, 1], Stream0=pt_30, Stream1=shift_7, NullGaps=False)
weave_10 = Weave(Pattern=[0, 1], Stream0=pt_27, Stream1=shift_12, NullGaps=False)
weave_11 = Weave(Pattern=[0, 1], Stream0=pt_32, Stream1=shift_8, NullGaps=False)
weave_12 = Weave(Pattern=[0, 1], Stream0=pt_34, Stream1=shift_9, NullGaps=False)
pline_7 = PolyLine(Vertices=weave_9, Closed=True)
pline_8 = PolyLine(Vertices=weave_11, Closed=True)
pline_9 = PolyLine(Vertices=weave_12, Closed=True)
pline_10 = PolyLine(Vertices=weave_7, Closed=True)
pline_11 = PolyLine(Vertices=weave_8, Closed=True)
pline_12 = PolyLine(Vertices=weave_10, Closed=True)
crv_16 = Curve(crv_13)
crv_17 = Curve([pline_7, pline_10])
crv_18 = Curve([scale_7.Geometry, cir_7, cir_10, scale_10.Geometry])
crv_19 = Curve(crv_14)
crv_20 = Curve([pline_8, pline_11])
crv_21 = Curve([scale_8.Geometry, cir_8, cir_11, scale_11.Geometry])
crv_22 = Curve(crv_15)
crv_23 = Curve([pline_9, pline_12])
crv_24 = Curve([scale_9.Geometry, cir_9, cir_12, scale_12.Geometry])
number_slider_19 = Slider(24, range=0..100)
number_slider_20 = Slider(12, range=0..100)
number_slider_21 = Slider(24, range=0..100)
number_slider_22 = Slider(0.25, range=0..1)
number_slider_23 = Slider(12, range=0..100)
number_slider_24 = Slider(24, range=0..100)
number_slider_25 = Slider(0.5, range=0..1)
number_slider_26 = Slider(12, range=0..100)
number_slider_27 = Slider(0.75, range=0..1)
pt_37 = Point(Point(0, 0, 0))
pt_38 = Point(Point(0, 0, 0))
pt_39 = Point(Point(0, 0, 0))
square_grid_generator_7 = SquareGridGenerator(origin_point=pt_37, cell_scale=Slider(2, range=0..10), x_axis_extent=number_slider_19, y_axis_extent=number_slider_19)  # -> flatten(grid_cell_curves_2), flatten(grid_area_centroids)
square_grid_generator_8 = SquareGridGenerator(origin_point=pt_38, cell_scale=Slider(2, range=0..10), x_axis_extent=number_slider_21, y_axis_extent=number_slider_21)  # -> flatten(grid_cell_curves_2), flatten(grid_area_centroids)
square_grid_generator_9 = SquareGridGenerator(origin_point=pt_39, cell_scale=Slider(2, range=0..10), x_axis_extent=number_slider_24, y_axis_extent=number_slider_24)  # -> flatten(grid_cell_curves_2), flatten(grid_area_centroids)
crv_25 = Curve(square_grid_generator_7.grid_cell_curves_2)
crv_26 = Curve(square_grid_generator_8.grid_cell_curves_2)
crv_27 = Curve(square_grid_generator_9.grid_cell_curves_2)
pt_40 = Point(square_grid_generator_7.grid_area_centroids)
pt_41 = Point(square_grid_generator_8.grid_area_centroids)
pt_42 = Point(square_grid_generator_9.grid_area_centroids)
disc_7 = Discontinuity(Curve=crv_25, Level=1)  # -> flatten(Points), Parameters
disc_8 = Discontinuity(Curve=crv_26, Level=1)  # -> flatten(Points), Parameters
disc_9 = Discontinuity(Curve=crv_27, Level=1)  # -> flatten(Points), Parameters
cir_13 = Circle(Plane=pt_40, Radius=Slider(0.9, range=0..10))
cir_14 = Circle(Plane=pt_41, Radius=Slider(0.9, range=0..10))
cir_15 = Circle(Plane=pt_42, Radius=Slider(0.9, range=0..10))
division_7 = Division(A=number_slider_22, B=Slider(2, range=0..10))
division_8 = Division(A=number_slider_25, B=Slider(2, range=0..10))
division_9 = Division(A=number_slider_27, B=Slider(2, range=0..10))
scale_13 = Scale(Geometry=cir_13, Center=pt_40, Factor=number_slider_22)  # -> Geometry, Transform
cir_16 = Circle(Plane=disc_7.Points, Radius=division_7)
scale_14 = Scale(Geometry=cir_14, Center=pt_41, Factor=number_slider_25)  # -> Geometry, Transform
cir_17 = Circle(Plane=disc_8.Points, Radius=division_8)
scale_15 = Scale(Geometry=cir_15, Center=pt_42, Factor=number_slider_27)  # -> Geometry, Transform
cir_18 = Circle(Plane=disc_9.Points, Radius=division_9)
scale_16 = Scale(Geometry=cir_16, Center=disc_7.Points, Factor=number_slider_22)  # -> Geometry, Transform
scale_17 = Scale(Geometry=cir_17, Center=disc_8.Points, Factor=number_slider_25)  # -> Geometry, Transform
scale_18 = Scale(Geometry=cir_18, Center=disc_9.Points, Factor=number_slider_27)  # -> Geometry, Transform
divide_25 = DivideCurve(Curve=cir_16, Count=number_slider_20, Kinks=False)  # -> Points, Tangents, Parameters
divide_26 = DivideCurve(Curve=cir_17, Count=number_slider_23, Kinks=False)  # -> Points, Tangents, Parameters
divide_27 = DivideCurve(Curve=cir_18, Count=number_slider_26, Kinks=False)  # -> Points, Tangents, Parameters
divide_28 = DivideCurve(Curve=scale_13.Geometry, Count=number_slider_20, Kinks=False)  # -> Points, Tangents, Parameters
divide_29 = DivideCurve(Curve=scale_14.Geometry, Count=number_slider_23, Kinks=False)  # -> Points, Tangents, Parameters
divide_30 = DivideCurve(Curve=cir_13, Count=number_slider_20, Kinks=False)  # -> Points, Tangents, Parameters
divide_31 = DivideCurve(Curve=scale_15.Geometry, Count=number_slider_26, Kinks=False)  # -> Points, Tangents, Parameters
divide_32 = DivideCurve(Curve=cir_14, Count=number_slider_23, Kinks=False)  # -> Points, Tangents, Parameters
divide_33 = DivideCurve(Curve=cir_15, Count=number_slider_26, Kinks=False)  # -> Points, Tangents, Parameters
divide_34 = DivideCurve(Curve=scale_16.Geometry, Count=number_slider_20, Kinks=False)  # -> Points, Tangents, Parameters
divide_35 = DivideCurve(Curve=scale_17.Geometry, Count=number_slider_23, Kinks=False)  # -> Points, Tangents, Parameters
divide_36 = DivideCurve(Curve=scale_18.Geometry, Count=number_slider_26, Kinks=False)  # -> Points, Tangents, Parameters
dispatch_25 = Dispatch(List=divide_25.Points, DispatchPattern=[True, False])  # -> ListA, ListB
dispatch_26 = Dispatch(List=divide_26.Points, DispatchPattern=[True, False])  # -> ListA, ListB
dispatch_27 = Dispatch(List=divide_27.Points, DispatchPattern=[True, False])  # -> ListA, ListB
dispatch_28 = Dispatch(List=divide_30.Points, DispatchPattern=[True, False])  # -> ListA, ListB
dispatch_29 = Dispatch(List=divide_28.Points, DispatchPattern=[True, False])  # -> ListA, ListB
dispatch_30 = Dispatch(List=divide_32.Points, DispatchPattern=[True, False])  # -> ListA, ListB
dispatch_31 = Dispatch(List=divide_29.Points, DispatchPattern=[True, False])  # -> ListA, ListB
dispatch_32 = Dispatch(List=divide_33.Points, DispatchPattern=[True, False])  # -> ListA, ListB
dispatch_33 = Dispatch(List=divide_34.Points, DispatchPattern=[True, False])  # -> ListA, ListB
dispatch_34 = Dispatch(List=divide_31.Points, DispatchPattern=[True, False])  # -> ListA, ListB
dispatch_35 = Dispatch(List=divide_35.Points, DispatchPattern=[True, False])  # -> ListA, ListB
dispatch_36 = Dispatch(List=divide_36.Points, DispatchPattern=[True, False])  # -> ListA, ListB
pt_43 = Point(dispatch_25.ListA)
pt_44 = Point(dispatch_26.ListA)
pt_45 = Point(dispatch_27.ListA)
pt_46 = Point(dispatch_29.ListA)
pt_47 = Point(dispatch_31.ListA)
pt_48 = Point(dispatch_28.ListB)
pt_49 = Point(dispatch_34.ListA)
pt_50 = Point(dispatch_30.ListB)
pt_51 = Point(dispatch_33.ListA)
pt_52 = Point(dispatch_32.ListB)
pt_53 = Point(dispatch_35.ListA)
pt_54 = Point(dispatch_36.ListA)
shift_13 = ShiftList(List=pt_46, Shift=1, Wrap=True)
shift_14 = ShiftList(List=pt_47, Shift=1, Wrap=True)
shift_15 = ShiftList(List=pt_49, Shift=1, Wrap=True)
shift_16 = ShiftList(List=pt_51, Shift=1, Wrap=True)
shift_17 = ShiftList(List=pt_53, Shift=1, Wrap=True)
shift_18 = ShiftList(List=pt_54, Shift=1, Wrap=True)
weave_13 = Weave(Pattern=[0, 1], Stream0=pt_43, Stream1=shift_16, NullGaps=False)
weave_14 = Weave(Pattern=[0, 1], Stream0=pt_44, Stream1=shift_17, NullGaps=False)
weave_15 = Weave(Pattern=[0, 1], Stream0=pt_48, Stream1=shift_13, NullGaps=False)
weave_16 = Weave(Pattern=[0, 1], Stream0=pt_45, Stream1=shift_18, NullGaps=False)
weave_17 = Weave(Pattern=[0, 1], Stream0=pt_50, Stream1=shift_14, NullGaps=False)
weave_18 = Weave(Pattern=[0, 1], Stream0=pt_52, Stream1=shift_15, NullGaps=False)
pline_13 = PolyLine(Vertices=weave_15, Closed=True)
pline_14 = PolyLine(Vertices=weave_17, Closed=True)
pline_15 = PolyLine(Vertices=weave_18, Closed=True)
pline_16 = PolyLine(Vertices=weave_13, Closed=True)
pline_17 = PolyLine(Vertices=weave_14, Closed=True)
pline_18 = PolyLine(Vertices=weave_16, Closed=True)
crv_28 = Curve(crv_25)
crv_29 = Curve([pline_13, pline_16])
crv_30 = Curve([scale_13.Geometry, cir_13, cir_16, scale_16.Geometry])
crv_31 = Curve(crv_26)
crv_32 = Curve([pline_14, pline_17])
crv_33 = Curve([scale_14.Geometry, cir_14, cir_17, scale_17.Geometry])
crv_34 = Curve(crv_27)
crv_35 = Curve([pline_15, pline_18])
crv_36 = Curve([scale_15.Geometry, cir_15, cir_18, scale_18.Geometry])

# ==== cluster SquareGridGenerator: Grid Gen
y_axis_extent = ClusterInput()
x_axis_extent = ClusterInput()
in = ClusterInput()  # "---------------------"
origin_point = ClusterInput()
cell_scale = ClusterInput()
y_axis_extent_2 = Number(y_axis_extent)
x_axis_extent_2 = Number(x_axis_extent)
cell_scale_2 = Number(cell_scale)
origin_point_2 = Point(origin_point)
division = Division(XAxisExtent=x_axis_extent_2, B=cell_scale_2)
division_2 = Division(YAxisExtent=y_axis_extent_2, B=cell_scale_2)
sqgrid = Square(Plane=origin_point_2, Size=cell_scale_2, ExtentX=division, ExtentY=division_2)  # -> Cells, Points
grid_cell_curves = Curve(sqgrid.Cells)
area = Area(Geometry=grid_cell_curves)  # -> Area, GridAreaCentroids
grid_area_centroids = ClusterOutput(area.GridAreaCentroids)
grid_cell_curves_2 = ClusterOutput(grid_cell_curves)
