# Grasshopper definition LIBRARY_2D_Branch-Variable-Thickness.gh (Grasshopper 1.0.7)
# plug-ins: ClipperComponents

# ---- group: Variables
num_of_lines = Slider(50, range=1..1000)
number_slider = Slider(2, range=0..20)
number_slider_2 = Slider(5, range=0..20)

# ----
number_slider_3 = Slider(25, range=0..100)
number_slider_4 = Slider(25, range=0..100)
number_slider_5 = Slider(25, range=0..100)
pt = Point(Point(0, 0, 0))

# ---- group: Set Boundary Crv
crv = Curve(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)

# ----
pt_2 = Point(Point(0, 0, 0))
pt_3 = Point(Point(0, 0, 0))
random = Random(Range=Domain(0, 1), Number=num_of_lines, Seed=number_slider)
random_2 = Random(Range=Domain(0, 1), Number=num_of_lines, Seed=number_slider_2)
rectangle = Rectangle(Plane=pt, XSize=Slider(24, range=0..100), YSize=Slider(24, range=0..100), Radius=0)  # -> Rectangle, Length
rectangle_2 = Rectangle(Plane=pt_2, XSize=Slider(24, range=0..100), YSize=Slider(24, range=0..100), Radius=0)  # -> Rectangle, Length
rectangle_3 = Rectangle(Plane=pt_3, XSize=Slider(24, range=0..100), YSize=Slider(24, range=0..100), Radius=0)  # -> Rectangle, Length

# ---- group: Use GraphMappers to Adjust Line Density
graph = GraphMapper(
    random,
    x0=0,
    x1=1,
    y0=0,
    y1=1,
    container_name="Bezier",
    cpx=[0, 0.4934780896, 0.6585507393, 1],
    cpy=[0.9782608747, 0.6136231422, 0.9166666865, 0.5027536154])
graph_2 = GraphMapper(
    random_2,
    x0=0,
    x1=1,
    y0=0,
    y1=1,
    container_name="Bezier",
    cpx=[0, 0.318159461, 0.6260074973, 1],
    cpy=[0.5558109283, 0.2907896042, 0.49183321, 0.2216809988])

# ----
explode = Explode(Curve=rectangle.Rectangle, Recursive=True)  # -> Segments, Vertices
explode_2 = Explode(Curve=rectangle_2.Rectangle, Recursive=True)  # -> Segments, Vertices
explode_3 = Explode(Curve=rectangle_3.Rectangle, Recursive=True)  # -> Segments, Vertices
item = ListItem(List=explode.Segments, Index=0, Wrap=True)  # -> Item, Item1, Item2, Item3
random_3 = Random(Range=Domain(0, 1), Number=number_slider_3, Seed=Slider(2, range=0..10))
random_4 = Random(Range=Domain(0, 1), Number=number_slider_3, Seed=Slider(3, range=0..10))
random_5 = Random(Range=Domain(0, 1), Number=number_slider_3, Seed=Slider(4, range=0..10))
random_6 = Random(Range=Domain(0, 1), Number=number_slider_3, Seed=Slider(1, range=0..10))
item_2 = ListItem(List=explode_2.Segments, Index=0, Wrap=True)  # -> Item, Item1, Item2, Item3
item_3 = ListItem(List=explode_3.Segments, Index=0, Wrap=True)  # -> Item, Item1, Item2, Item3
random_7 = Random(Range=Domain(0, 1), Number=number_slider_4, Seed=Slider(2, range=0..10))
random_8 = Random(Range=Domain(0, 1), Number=number_slider_4, Seed=Slider(3, range=0..10))
random_9 = Random(Range=Domain(0, 1), Number=number_slider_4, Seed=Slider(4, range=0..10))
random_10 = Random(Range=Domain(0, 1), Number=number_slider_4, Seed=Slider(1, range=0..10))
random_11 = Random(Range=Domain(0, 1), Number=number_slider_5, Seed=Slider(2, range=0..10))
random_12 = Random(Range=Domain(0, 1), Number=number_slider_5, Seed=Slider(3, range=0..10))
random_13 = Random(Range=Domain(0, 1), Number=number_slider_5, Seed=Slider(4, range=0..10))
random_14 = Random(Range=Domain(0, 1), Number=number_slider_5, Seed=Slider(1, range=0..10))
eval = EvaluateCurve(Curve=reparameterize(crv), Parameter=graph)  # -> Point, Tangent, Angle
eval_2 = EvaluateCurve(Curve=reparameterize(crv), Parameter=graph_2)  # -> Point, Tangent, Angle
ln = Line(StartPoint=eval.Point, EndPoint=eval_2.Point)
eval_3 = EvaluateCurve(Curve=reparameterize(item.Item), Parameter=random_3)  # -> Point, Tangent, Angle
eval_4 = EvaluateCurve(Curve=reparameterize(item.Item1), Parameter=random_4)  # -> Point, Tangent, Angle
eval_5 = EvaluateCurve(Curve=reparameterize(item.Item2), Parameter=random_5)  # -> Point, Tangent, Angle
eval_6 = EvaluateCurve(Curve=reparameterize(item.Item3), Parameter=random_6)  # -> Point, Tangent, Angle
eval_7 = EvaluateCurve(Curve=reparameterize(item_2.Item), Parameter=random_7)  # -> Point, Tangent, Angle
eval_8 = EvaluateCurve(Curve=reparameterize(item_2.Item1), Parameter=random_8)  # -> Point, Tangent, Angle
eval_9 = EvaluateCurve(Curve=reparameterize(item_2.Item2), Parameter=random_9)  # -> Point, Tangent, Angle
eval_10 = EvaluateCurve(Curve=reparameterize(item_2.Item3), Parameter=random_10)  # -> Point, Tangent, Angle
eval_11 = EvaluateCurve(Curve=reparameterize(item_3.Item), Parameter=random_11)  # -> Point, Tangent, Angle
eval_12 = EvaluateCurve(Curve=reparameterize(item_3.Item1), Parameter=random_12)  # -> Point, Tangent, Angle
eval_13 = EvaluateCurve(Curve=reparameterize(item_3.Item2), Parameter=random_13)  # -> Point, Tangent, Angle
eval_14 = EvaluateCurve(Curve=reparameterize(item_3.Item3), Parameter=random_14)  # -> Point, Tangent, Angle
merge = Merge(Data1=crv, Data2=ln)  # -> flatten(Result)
ln_2 = Line(StartPoint=eval_3.Point, EndPoint=eval_4.Point)
line_offset_width_2x = Slider(0.436, range=0..1)
ln_3 = Line(StartPoint=eval_3.Point, EndPoint=eval_5.Point)
ln_4 = Line(StartPoint=eval_7.Point, EndPoint=eval_8.Point)
ln_5 = Line(StartPoint=eval_11.Point, EndPoint=eval_12.Point)
ln_6 = Line(StartPoint=eval_3.Point, EndPoint=eval_6.Point)
ln_7 = Line(StartPoint=eval_7.Point, EndPoint=eval_9.Point)
ln_8 = Line(StartPoint=eval_11.Point, EndPoint=eval_13.Point)
ln_9 = Line(StartPoint=eval_7.Point, EndPoint=eval_10.Point)
ln_10 = Line(StartPoint=eval_11.Point, EndPoint=eval_14.Point)
xy = XYPlane(Origin=Point(0, 0, 0))
line = Line([ln_2, ln_3, ln_6])
line_2 = Line([ln_4, ln_7, ln_9])
line_3 = Line([ln_5, ln_8, ln_10])
polyoffset = PolylineOffset(Polylines=merge, Distance=line_offset_width_2x, Plane=xy, Tolerance=0.01, ClosedFillet=2, OpenFillet=0, Miter=2)  # -> Contour, Holes
merge_2 = Merge(Data1=rectangle.Rectangle, Data2=line)  # -> flatten(Result)
merge_3 = Merge(Data1=rectangle_2.Rectangle, Data2=line_2)  # -> flatten(Result)
merge_4 = Merge(Data1=rectangle_3.Rectangle, Data2=line_3)  # -> flatten(Result)
line_offset_width_2x_2 = Slider(0.041, range=0..1)
line_offset_width_2x_3 = Slider(0.119, range=0..1)
line_offset_width_2x_4 = Slider(0.289, range=0..1)

# ---- group: External Closed Curve (Boundary)
crv_2 = Curve(polyoffset.Contour)

# ---- group: Internal Closed Curves
crv_3 = Curve(polyoffset.Holes)

# ----
xy_2 = XYPlane(Origin=Point(0, 0, 0))
xy_3 = XYPlane(Origin=Point(0, 0, 0))
xy_4 = XYPlane(Origin=Point(0, 0, 0))
polyoffset_2 = PolylineOffset(Polylines=merge_2, Distance=line_offset_width_2x_2, Plane=xy_2, Tolerance=0.01, ClosedFillet=2, OpenFillet=0, Miter=2)  # -> Contour, Holes
polyoffset_3 = PolylineOffset(Polylines=merge_3, Distance=line_offset_width_2x_3, Plane=xy_3, Tolerance=0.01, ClosedFillet=2, OpenFillet=0, Miter=2)  # -> Contour, Holes
polyoffset_4 = PolylineOffset(Polylines=merge_4, Distance=line_offset_width_2x_4, Plane=xy_4, Tolerance=0.01, ClosedFillet=2, OpenFillet=0, Miter=2)  # -> Contour, Holes
crv_4 = Curve(polyoffset_2.Contour)
crv_5 = Curve(polyoffset_2.Holes)
crv_6 = Curve(polyoffset_3.Contour)
crv_7 = Curve(polyoffset_3.Holes)
crv_8 = Curve(polyoffset_4.Contour)
crv_9 = Curve(polyoffset_4.Holes)
number_slider_6 = Slider(25, range=0..100)
number_slider_7 = Slider(25, range=0..100)
number_slider_8 = Slider(25, range=0..100)
pt_4 = Point(Point(0, 0, 0))
pt_5 = Point(Point(0, 0, 0))
pt_6 = Point(Point(0, 0, 0))
rectangle_4 = Rectangle(Plane=pt_4, XSize=Slider(24, range=0..100), YSize=Slider(24, range=0..100), Radius=0)  # -> Rectangle, Length
rectangle_5 = Rectangle(Plane=pt_5, XSize=Slider(24, range=0..100), YSize=Slider(24, range=0..100), Radius=0)  # -> Rectangle, Length
rectangle_6 = Rectangle(Plane=pt_6, XSize=Slider(24, range=0..100), YSize=Slider(24, range=0..100), Radius=0)  # -> Rectangle, Length
explode_4 = Explode(Curve=rectangle_4.Rectangle, Recursive=True)  # -> Segments, Vertices
explode_5 = Explode(Curve=rectangle_5.Rectangle, Recursive=True)  # -> Segments, Vertices
explode_6 = Explode(Curve=rectangle_6.Rectangle, Recursive=True)  # -> Segments, Vertices
item_4 = ListItem(List=explode_4.Segments, Index=0, Wrap=True)  # -> Item, Item1, Item2, Item3
random_15 = Random(Range=Domain(0, 1), Number=number_slider_6, Seed=Slider(4, range=0..10))
random_16 = Random(Range=Domain(0, 1), Number=number_slider_6, Seed=Slider(3, range=0..10))
random_17 = Random(Range=Domain(0, 1), Number=number_slider_6, Seed=Slider(7, range=0..10))
random_18 = Random(Range=Domain(0, 1), Number=number_slider_6, Seed=Slider(0, range=0..10))
item_5 = ListItem(List=explode_5.Segments, Index=0, Wrap=True)  # -> Item, Item1, Item2, Item3
random_19 = Random(Range=Domain(0, 1), Number=number_slider_7, Seed=Slider(4, range=0..10))
random_20 = Random(Range=Domain(0, 1), Number=number_slider_7, Seed=Slider(3, range=0..10))
random_21 = Random(Range=Domain(0, 1), Number=number_slider_7, Seed=Slider(7, range=0..10))
random_22 = Random(Range=Domain(0, 1), Number=number_slider_7, Seed=Slider(0, range=0..10))
item_6 = ListItem(List=explode_6.Segments, Index=0, Wrap=True)  # -> Item, Item1, Item2, Item3
random_23 = Random(Range=Domain(0, 1), Number=number_slider_8, Seed=Slider(4, range=0..10))
random_24 = Random(Range=Domain(0, 1), Number=number_slider_8, Seed=Slider(3, range=0..10))
random_25 = Random(Range=Domain(0, 1), Number=number_slider_8, Seed=Slider(7, range=0..10))
random_26 = Random(Range=Domain(0, 1), Number=number_slider_8, Seed=Slider(0, range=0..10))
eval_15 = EvaluateCurve(Curve=reparameterize(item_4.Item), Parameter=random_15)  # -> Point, Tangent, Angle
eval_16 = EvaluateCurve(Curve=reparameterize(item_4.Item1), Parameter=random_16)  # -> Point, Tangent, Angle
eval_17 = EvaluateCurve(Curve=reparameterize(item_4.Item2), Parameter=random_17)  # -> Point, Tangent, Angle
eval_18 = EvaluateCurve(Curve=reparameterize(item_4.Item3), Parameter=random_18)  # -> Point, Tangent, Angle
eval_19 = EvaluateCurve(Curve=reparameterize(item_5.Item), Parameter=random_19)  # -> Point, Tangent, Angle
eval_20 = EvaluateCurve(Curve=reparameterize(item_5.Item1), Parameter=random_20)  # -> Point, Tangent, Angle
eval_21 = EvaluateCurve(Curve=reparameterize(item_5.Item2), Parameter=random_21)  # -> Point, Tangent, Angle
eval_22 = EvaluateCurve(Curve=reparameterize(item_5.Item3), Parameter=random_22)  # -> Point, Tangent, Angle
eval_23 = EvaluateCurve(Curve=reparameterize(item_6.Item), Parameter=random_23)  # -> Point, Tangent, Angle
eval_24 = EvaluateCurve(Curve=reparameterize(item_6.Item1), Parameter=random_24)  # -> Point, Tangent, Angle
eval_25 = EvaluateCurve(Curve=reparameterize(item_6.Item2), Parameter=random_25)  # -> Point, Tangent, Angle
eval_26 = EvaluateCurve(Curve=reparameterize(item_6.Item3), Parameter=random_26)  # -> Point, Tangent, Angle
ln_11 = Line(StartPoint=eval_15.Point, EndPoint=eval_16.Point)
ln_12 = Line(StartPoint=eval_16.Point, EndPoint=eval_17.Point)
ln_13 = Line(StartPoint=eval_19.Point, EndPoint=eval_20.Point)
ln_14 = Line(StartPoint=eval_15.Point, EndPoint=eval_18.Point)
ln_15 = Line(StartPoint=eval_17.Point, EndPoint=eval_18.Point)
ln_16 = Line(StartPoint=eval_20.Point, EndPoint=eval_21.Point)
ln_17 = Line(StartPoint=eval_23.Point, EndPoint=eval_24.Point)
ln_18 = Line(StartPoint=eval_19.Point, EndPoint=eval_22.Point)
ln_19 = Line(StartPoint=eval_21.Point, EndPoint=eval_22.Point)
ln_20 = Line(StartPoint=eval_24.Point, EndPoint=eval_25.Point)
ln_21 = Line(StartPoint=eval_23.Point, EndPoint=eval_26.Point)
ln_22 = Line(StartPoint=eval_25.Point, EndPoint=eval_26.Point)
line_4 = Line([ln_11, ln_12, ln_14, ln_15])
line_5 = Line([ln_13, ln_16, ln_18, ln_19])
line_6 = Line([ln_17, ln_20, ln_21, ln_22])
merge_5 = Merge(Data1=rectangle_4.Rectangle, Data2=line_4)  # -> flatten(Result)
merge_6 = Merge(Data1=rectangle_5.Rectangle, Data2=line_5)  # -> flatten(Result)
merge_7 = Merge(Data1=rectangle_6.Rectangle, Data2=line_6)  # -> flatten(Result)
line_offset_width_2x_5 = Slider(0.041, range=0..1)
line_offset_width_2x_6 = Slider(0.119, range=0..1)
line_offset_width_2x_7 = Slider(0.289, range=0..1)
xy_5 = XYPlane(Origin=Point(0, 0, 0))
polyoffset_5 = PolylineOffset(Polylines=merge_5, Distance=line_offset_width_2x_5, Plane=xy_5, Tolerance=0.01, ClosedFillet=2, OpenFillet=0, Miter=2)  # -> Contour, Holes
xy_6 = XYPlane(Origin=Point(0, 0, 0))
xy_7 = XYPlane(Origin=Point(0, 0, 0))
polyoffset_6 = PolylineOffset(Polylines=merge_6, Distance=line_offset_width_2x_6, Plane=xy_6, Tolerance=0.01, ClosedFillet=2, OpenFillet=0, Miter=2)  # -> Contour, Holes
polyoffset_7 = PolylineOffset(Polylines=merge_7, Distance=line_offset_width_2x_7, Plane=xy_7, Tolerance=0.01, ClosedFillet=2, OpenFillet=0, Miter=2)  # -> Contour, Holes
crv_10 = Curve(polyoffset_5.Contour)
crv_11 = Curve(polyoffset_5.Holes)
crv_12 = Curve(polyoffset_6.Contour)
crv_13 = Curve(polyoffset_6.Holes)
crv_14 = Curve(polyoffset_7.Contour)
crv_15 = Curve(polyoffset_7.Holes)
number_slider_9 = Slider(20, range=0..100)
number_slider_10 = Slider(13, range=0..100)
number_slider_11 = Slider(10, range=0..100)
number_slider_12 = Slider(5, range=0..100)
pt_7 = Point(Point(0, 0, 0))
pt_8 = Point(Point(0, 0, 0))
pt_9 = Point(Point(0, 0, 0))
pt_10 = Point(Point(0, 0, 0))
crv_16 = Curve(<curve referenced from the Rhino model>)
rectangle_7 = Rectangle(Plane=pt_8, XSize=Slider(24, range=0..100), YSize=Slider(24, range=0..100), Radius=0)  # -> Rectangle, Length
rectangle_8 = Rectangle(Plane=pt_7, XSize=Slider(24, range=0..100), YSize=Slider(24, range=0..100), Radius=0)  # -> Rectangle, Length
crv_17 = Curve(<curve referenced from the Rhino model>)
rectangle_9 = Rectangle(Plane=pt_9, XSize=Slider(24, range=0..100), YSize=Slider(24, range=0..100), Radius=0)  # -> Rectangle, Length
rectangle_10 = Rectangle(Plane=pt_10, XSize=Slider(24, range=0..100), YSize=Slider(24, range=0..100), Radius=0)  # -> Rectangle, Length
explode_7 = Explode(Curve=rectangle_8.Rectangle, Recursive=True)  # -> Segments, Vertices
explode_8 = Explode(Curve=rectangle_9.Rectangle, Recursive=True)  # -> Segments, Vertices
explode_9 = Explode(Curve=rectangle_10.Rectangle, Recursive=True)  # -> Segments, Vertices
explode_10 = Explode(Curve=rectangle_7.Rectangle, Recursive=True)  # -> Segments, Vertices
srfsplit = SurfaceSplit(Surface=crv_17, Curves=crv_16)
item_7 = ListItem(List=explode_7.Segments, Index=0, Wrap=True)  # -> Item, Item1, Item2, Item3
random_27 = Random(Range=Domain(0, 1), Number=number_slider_9, Seed=Slider(2, range=0..10))
random_28 = Random(Range=Domain(0, 1), Number=number_slider_9, Seed=Slider(3, range=0..10))
random_29 = Random(Range=Domain(0, 1), Number=number_slider_9, Seed=Slider(4, range=0..10))
random_30 = Random(Range=Domain(0, 1), Number=number_slider_9, Seed=Slider(1, range=0..10))
item_8 = ListItem(List=explode_8.Segments, Index=0, Wrap=True)  # -> Item, Item1, Item2, Item3
random_31 = Random(Range=Domain(0, 1), Number=number_slider_10, Seed=Slider(5, range=0..10))
random_32 = Random(Range=Domain(0, 1), Number=number_slider_10, Seed=Slider(5, range=0..10))
random_33 = Random(Range=Domain(0, 1), Number=number_slider_10, Seed=Slider(2, range=0..10))
random_34 = Random(Range=Domain(0, 1), Number=number_slider_10, Seed=Slider(4, range=0..10))
random_35 = Random(Range=Domain(0, 1), Number=number_slider_11, Seed=Slider(3, range=0..10))
random_36 = Random(Range=Domain(0, 1), Number=number_slider_11, Seed=Slider(1, range=0..10))
random_37 = Random(Range=Domain(0, 1), Number=number_slider_11, Seed=Slider(6, range=0..10))
random_38 = Random(Range=Domain(0, 1), Number=number_slider_11, Seed=Slider(2, range=0..10))
item_9 = ListItem(List=explode_9.Segments, Index=0, Wrap=True)  # -> Item, Item1, Item2, Item3
item_10 = ListItem(List=explode_10.Segments, Index=0, Wrap=True)  # -> Item, Item1, Item2, Item3
random_39 = Random(Range=Domain(0, 1), Number=number_slider_12, Seed=Slider(1, range=0..10))
random_40 = Random(Range=Domain(0, 1), Number=number_slider_12, Seed=Slider(7, range=0..10))
random_41 = Random(Range=Domain(0, 1), Number=number_slider_12, Seed=Slider(2, range=0..10))
random_42 = Random(Range=Domain(0, 1), Number=number_slider_12, Seed=Slider(5, range=0..10))
crv_18 = Curve(srfsplit)
number_slider_13 = Slider(12, range=0..100)
eval_27 = EvaluateCurve(Curve=reparameterize(item_7.Item), Parameter=random_27)  # -> Point, Tangent, Angle
eval_28 = EvaluateCurve(Curve=reparameterize(item_7.Item1), Parameter=random_28)  # -> Point, Tangent, Angle
eval_29 = EvaluateCurve(Curve=reparameterize(item_7.Item2), Parameter=random_29)  # -> Point, Tangent, Angle
eval_30 = EvaluateCurve(Curve=reparameterize(item_7.Item3), Parameter=random_30)  # -> Point, Tangent, Angle
eval_31 = EvaluateCurve(Curve=reparameterize(item_8.Item), Parameter=random_35)  # -> Point, Tangent, Angle
eval_32 = EvaluateCurve(Curve=reparameterize(item_8.Item1), Parameter=random_36)  # -> Point, Tangent, Angle
eval_33 = EvaluateCurve(Curve=reparameterize(item_8.Item2), Parameter=random_37)  # -> Point, Tangent, Angle
eval_34 = EvaluateCurve(Curve=reparameterize(item_8.Item3), Parameter=random_38)  # -> Point, Tangent, Angle
eval_35 = EvaluateCurve(Curve=reparameterize(item_10.Item), Parameter=random_31)  # -> Point, Tangent, Angle
eval_36 = EvaluateCurve(Curve=reparameterize(item_10.Item1), Parameter=random_32)  # -> Point, Tangent, Angle
eval_37 = EvaluateCurve(Curve=reparameterize(item_10.Item2), Parameter=random_33)  # -> Point, Tangent, Angle
eval_38 = EvaluateCurve(Curve=reparameterize(item_10.Item3), Parameter=random_34)  # -> Point, Tangent, Angle
eval_39 = EvaluateCurve(Curve=reparameterize(item_9.Item), Parameter=random_39)  # -> Point, Tangent, Angle
eval_40 = EvaluateCurve(Curve=reparameterize(item_9.Item1), Parameter=random_40)  # -> Point, Tangent, Angle
eval_41 = EvaluateCurve(Curve=reparameterize(item_9.Item2), Parameter=random_41)  # -> Point, Tangent, Angle
eval_42 = EvaluateCurve(Curve=reparameterize(item_9.Item3), Parameter=random_42)  # -> Point, Tangent, Angle
arrrec = RectangularArray(Geometry=crv_18, Cell=crv_17, XCount=number_slider_13, YCount=number_slider_13)  # -> flatten(Geometry), Transform
ln_23 = Line(StartPoint=eval_27.Point, EndPoint=eval_29.Point)
ln_24 = Line(StartPoint=eval_28.Point, EndPoint=eval_30.Point)
ln_25 = Line(StartPoint=eval_29.Point, EndPoint=eval_30.Point)
ln_26 = Line(StartPoint=eval_27.Point, EndPoint=eval_28.Point)
ln_27 = Line(StartPoint=eval_27.Point, EndPoint=eval_30.Point)
ln_28 = Line(StartPoint=eval_28.Point, EndPoint=eval_29.Point)
ln_29 = Line(StartPoint=eval_35.Point, EndPoint=eval_37.Point)
ln_30 = Line(StartPoint=eval_36.Point, EndPoint=eval_38.Point)
ln_31 = Line(StartPoint=eval_37.Point, EndPoint=eval_38.Point)
ln_32 = Line(StartPoint=eval_31.Point, EndPoint=eval_32.Point)
ln_33 = Line(StartPoint=eval_31.Point, EndPoint=eval_33.Point)
ln_34 = Line(StartPoint=eval_31.Point, EndPoint=eval_34.Point)
ln_35 = Line(StartPoint=eval_32.Point, EndPoint=eval_33.Point)
ln_36 = Line(StartPoint=eval_32.Point, EndPoint=eval_34.Point)
ln_37 = Line(StartPoint=eval_33.Point, EndPoint=eval_34.Point)
ln_38 = Line(StartPoint=eval_35.Point, EndPoint=eval_36.Point)
ln_39 = Line(StartPoint=eval_35.Point, EndPoint=eval_38.Point)
ln_40 = Line(StartPoint=eval_36.Point, EndPoint=eval_37.Point)
ln_41 = Line(StartPoint=eval_39.Point, EndPoint=eval_40.Point)
ln_42 = Line(StartPoint=eval_39.Point, EndPoint=eval_41.Point)
ln_43 = Line(StartPoint=eval_39.Point, EndPoint=eval_42.Point)
ln_44 = Line(StartPoint=eval_40.Point, EndPoint=eval_41.Point)
ln_45 = Line(StartPoint=eval_40.Point, EndPoint=eval_42.Point)
ln_46 = Line(StartPoint=eval_41.Point, EndPoint=eval_42.Point)
area = Area(Geometry=arrrec.Geometry)  # -> Area, Centroid
line_7 = Line([ln_26, ln_27, ln_28, ln_25])
line_8 = Line([ln_38, ln_39, ln_40, ln_31, ln_29, ln_30])
line_9 = Line([ln_36, ln_33])
cset = CreateSet(List=area.Area)  # -> Set, Map
line_10 = Line([ln_41, ln_42, ln_43])
sift = SiftPattern(List=arrrec.Geometry, SiftPattern=cset.Map)  # -> Output0, Output1
merge_8 = Merge(Data1=rectangle_8.Rectangle, Data2=line_7)  # -> flatten(Result)
merge_9 = Merge(Data1=rectangle_7.Rectangle, Data2=line_8)  # -> flatten(Result)
merge_10 = Merge(Data1=rectangle_9.Rectangle, Data2=line_9)  # -> flatten(Result)
merge_11 = Merge(Data1=rectangle_10.Rectangle, Data2=line_10)  # -> flatten(Result)
crv_19 = Curve(sift.Output0)
line_offset_width_2x_8 = Slider(0.15, range=0..1)
line_offset_width_2x_9 = Slider(0.15, range=0..1)
line_offset_width_2x_10 = Slider(0.3, range=0..1)
crv_20 = Curve(sift.Output1)
line_offset_width_2x_11 = Slider(0.6, range=0..1)
runion = RegionUnion(Curves=crv_20)
area_2 = Area(Geometry=crv_19)  # -> Area, Centroid
area_3 = Area(Geometry=runion)  # -> Area, Centroid
xy_8 = XYPlane(Origin=Point(0, 0, 0))
xy_9 = XYPlane(Origin=Point(0, 0, 0))
xy_10 = XYPlane(Origin=Point(0, 0, 0))
xy_11 = XYPlane(Origin=Point(0, 0, 0))
polyoffset_8 = PolylineOffset(Polylines=merge_8, Distance=line_offset_width_2x_8, Plane=xy_8, Tolerance=0.01, ClosedFillet=2, OpenFillet=0, Miter=2)  # -> Contour, Holes
polyoffset_9 = PolylineOffset(Polylines=merge_9, Distance=line_offset_width_2x_9, Plane=xy_9, Tolerance=0.01, ClosedFillet=2, OpenFillet=0, Miter=2)  # -> Contour, Holes
polyoffset_10 = PolylineOffset(Polylines=merge_10, Distance=line_offset_width_2x_10, Plane=xy_10, Tolerance=0.01, ClosedFillet=2, OpenFillet=0, Miter=2)  # -> Contour, Holes
polyoffset_11 = PolylineOffset(Polylines=merge_11, Distance=line_offset_width_2x_11, Plane=xy_11, Tolerance=0.01, ClosedFillet=2, OpenFillet=0, Miter=2)  # -> Contour, Holes
pattern_2_3_4 = Pattern234(
    grid_cell_curves=runion,
    grid_cell_area_centroids=area_3.Centroid,
    interior_cell_scale_a=Slider(0.7, range=0..1),
    interior_cell_scale_b=Slider(0.5, range=0..1))  # -> pattern_curves_2, pattern_area_centroids_2, grid_cell_area_centroids_4
pattern_2_3_4_2 = Pattern234(
    grid_cell_curves=crv_19,
    grid_cell_area_centroids=area_2.Centroid,
    interior_cell_scale_a=Slider(0.2, range=0..1),
    interior_cell_scale_b=Slider(0.5, range=0..1))  # -> pattern_curves_2, pattern_area_centroids_2, grid_cell_area_centroids_4
crv_21 = Curve(polyoffset_8.Contour)
crv_22 = Curve(polyoffset_8.Holes)
crv_23 = Curve(polyoffset_9.Contour)
crv_24 = Curve(polyoffset_10.Contour)
crv_25 = Curve(polyoffset_9.Holes)
crv_26 = Curve(polyoffset_10.Holes)
crv_27 = Curve(polyoffset_11.Contour)
crv_28 = Curve(polyoffset_11.Holes)
crv_29 = Curve(pattern_2_3_4.pattern_curves_2)
crv_30 = Curve(pattern_2_3_4_2.pattern_curves_2)

# ==== cluster Pattern234: Pattern Component
grid_cell_curves = ClusterInput()
grid_cell_area_centroids = ClusterInput()
grid_cell_curves_2 = Curve(grid_cell_curves)
item = ListItem(List=flatten(grid_cell_curves_2), Index=0, Wrap=True)
area = Area(Geometry=item)  # -> Area, Centroid
grid_eval_tool = GridEvalTool(grid_cell_curves=item, grid_cell_area_centroids=area.Centroid, grid_cell_scale=Slider(1, range=0..1))  # -> grid_cell_curves_5, grid_cell_vertices_2, grid_cell_midpoints_2, grid_cell_area_centroids_3
grid_cell_area_centroids_2 = Point(flatten(grid_cell_area_centroids))
pt = Point(grid_eval_tool.grid_cell_midpoints_2)
pt_2 = Point(grid_eval_tool.grid_cell_vertices_2)
interior_cell_scale_a = ClusterInput()
interior_cell_scale_b = ClusterInput()
avr = Average(Input=pt_2)
interior_cell_scale_a_2 = Number(interior_cell_scale_a)
interior_cell_scale_b_2 = Number(interior_cell_scale_b)
ln = Line(StartPoint=avr, EndPoint=pt_2)
ln_2 = Line(StartPoint=avr, EndPoint=pt)
pattern_area_centroid = Point(avr)
eval = EvaluateCurve(Curve=reparameterize(ln), Parameter=interior_cell_scale_b_2)  # -> Point, Tangent, Angle
eval_2 = EvaluateCurve(Curve=reparameterize(ln_2), Parameter=interior_cell_scale_a_2)  # -> Point, Tangent, Angle
voronoi = Voronoi(Points=flatten([eval_2.Point, eval.Point, pt_2]), BruteForceOverride=False)
bbx = BrepBrep(BrepA=item, BrepB=voronoi)  # -> flatten(Curves), Points
ln_3 = Line(StartPoint=pattern_area_centroid, EndPoint=grid_cell_area_centroids_2)
move = Move(Geometry=bbx.Curves, Motion=graft(ln_3))  # -> Geometry, Transform
area_2 = Area(Geometry=move.Geometry)  # -> Area, Centroid
pattern_curves = Curve(move.Geometry)
pattern_area_centroids = Point(area_2.Centroid)
avr_2 = Average(Input=area_2.Centroid)
pattern_curves_2 = ClusterOutput(pattern_curves)
pattern_area_centroids_2 = ClusterOutput(pattern_area_centroids)
grid_cell_area_centroids_3 = Point(avr_2)
grid_cell_area_centroids_4 = ClusterOutput(grid_cell_area_centroids_3)

# ==== cluster GridEvalTool: Grid Gen
grid_cell_area_centroids = ClusterInput()
grid_cell_curves = ClusterInput()
grid_cell_scale = ClusterInput()
grid_cell_area_centroids_2 = Point(grid_cell_area_centroids)
grid_cell_curves_2 = Curve(grid_cell_curves)
grid_cell_scale_2 = Number(grid_cell_scale)
scale = Scale(Geometry=grid_cell_curves_2, Center=grid_cell_area_centroids_2, Factor=grid_cell_scale_2)  # -> Geometry, Transform
grid_cell_curves_3 = Curve(scale.Geometry)
grid_cell_curves_4 = Curve(scale.Geometry)
disc = Discontinuity(Curve=grid_cell_curves_3, Level=1)  # -> Points, Parameters
explode = Explode(Curve=grid_cell_curves_3, Recursive=True)  # -> Segments, Vertices
grid_cell_vertices = Point(disc.Points)
midpt = CurveMiddle(Curve=explode.Segments)
grid_cell_midpoints = Point(midpt)
grid_cell_curves_5 = ClusterOutput(grid_cell_curves_4)
grid_cell_vertices_2 = ClusterOutput(grid_cell_vertices)
grid_cell_area_centroids_3 = ClusterOutput(grid_cell_area_centroids_2)
grid_cell_midpoints_2 = ClusterOutput(grid_cell_midpoints)
