# Grasshopper definition LIBRARY_2D_Shatter-Pattern.gh (Grasshopper 1.0.7)

number_slider = Slider(24, range=0..100)
construct_rectangle = ConstructRectangle(x_axis_extent=number_slider, y_axis_extent=number_slider)
number_slider_2 = Slider(24, range=0..100)
construct_rectangle_2 = ConstructRectangle(x_axis_extent=number_slider_2, y_axis_extent=number_slider_2)
number_slider_3 = Slider(100, range=0..100)
populate_rectangle_with_points = PopulateRectangleWithPoints(constructed_rectangle=construct_rectangle, number_of_points=Slider(70, range=0..1000))  # -> populated_points, constructed_rectangle_2
populate_rectangle_with_points_2 = PopulateRectangleWithPoints(constructed_rectangle=construct_rectangle_2, number_of_points=Slider(132, range=0..1000))  # -> flatten(populated_points), constructed_rectangle_2
dispatch = Dispatch(List=populate_rectangle_with_points.populated_points, DispatchPattern=[True, False])  # -> ListA, ListB
pt = Point(Point(16.32290323, 16.7657727, 0))
pt_2 = Point(Point(0, 0, 0))
trigrid = Triangular(Plane=pt_2, Size=Slider(2, range=0..10), ExtentX=number_slider, ExtentY=number_slider)  # -> flatten(Cells), Points
vec2pt = Vector2Pt(PointA=populate_rectangle_with_points_2.populated_points, PointB=pt, Unitize=False)  # -> Vector, Length
bnd = Bounds(Numbers=vec2pt.Length)
lng = ListLength(List=trigrid.Cells)
division = Division(A=lng, B=Slider(2, range=0..10))
cir = Circle(Plane=pt, Radius=Slider(1.21, range=0..100))
number_slider_4 = Slider(14, range=0..100)
number_slider_5 = Slider(1.67, range=0..10)
dom = ConstructDomain(DomainStart=Slider(1.14, range=0..10), DomainEnd=Slider(5.73, range=0..10))
reduce = RandomReduce(List=trigrid.Cells, Reduction=division, Seed=1)
area = Area(Geometry=reduce)  # -> Area, Centroid
vorgroup = VoronoiGroups(Boundary=construct_rectangle, Generation1=dispatch.ListA, Generation2=area.Centroid)  # -> Diagram1, Diagram2
crv = Curve(vorgroup.Diagram1)
crv_2 = Curve(vorgroup.Diagram2)
remap = RemapNumbers(Value=vec2pt.Length, Source=bnd, Target=dom)  # -> Mapped, Clipped
multiplication = Multiplication(A=vec2pt.Vector, B=remap.Mapped)
crv_3 = Curve([crv, crv_2])
divide = DivideCurve(Curve=cir, Count=number_slider_4, Kinks=False)  # -> Points, Tangents, Parameters
neg = Negative(Value=number_slider_5)
dom_2 = ConstructDomain(DomainStart=number_slider_5, DomainEnd=neg)
move = Move(Geometry=populate_rectangle_with_points_2.populated_points, Motion=multiplication)  # -> Geometry, Transform
random = Random(Range=dom_2, Number=number_slider_4, Seed=Slider(8, range=0..10))
random_2 = Random(Range=dom_2, Number=number_slider_4, Seed=Slider(2, range=0..10))
construct_point = ConstructPoint(x_axis_point=random_2, y_axis_point=random)
move_2 = Move(Geometry=divide.Points, Motion=construct_point)  # -> Geometry, Transform
vorgroup_2 = VoronoiGroups(
    Boundary=populate_rectangle_with_points_2.constructed_rectangle_2,
    Generation1=move_2.Geometry,
    Generation2=move.Geometry)  # -> Diagram1, Diagram2
crv_4 = Curve(vorgroup_2.Diagram1)
crv_5 = Curve(vorgroup_2.Diagram2)
crv_6 = Curve([crv_4, crv_5])

# ==== cluster ConstructRectangle: Constructed Base
origin_point = OriginPoint(Point(0, 0, 0))
y_axis_extent = ClusterInput()
x_axis_extent = ClusterInput()
rectangle = Rectangle(OriginPoint=origin_point, XAxisExtent=x_axis_extent, YAxisExtent=y_axis_extent, Radius=Slider(0, range=0..100))  # -> Rectangle, Length
R = ClusterOutput(rectangle.Rectangle)

# ==== cluster PopulateRectangleWithPoints: Constructed Base
number_of_points = ClusterInput()
constructed_rectangle = ClusterInput()
pop2d = Populate2D(ConstructedRectangle=constructed_rectangle, NumberOfPoints=number_of_points, Seed=1)
constructed_rectangle_2 = ClusterOutput(constructed_rectangle)
populated_points = ClusterOutput(pop2d)

# ==== cluster ConstructPoint: Constructed Base
y_axis_point = ClusterInput()
x_axis_point = ClusterInput()
pt = ConstructPoint(XCoordinate=x_axis_point, YCoordinate=y_axis_point, ZCoordinate=Slider(0, range=0..100))
constructed_point = ClusterOutput(pt)
