# Grasshopper definition LIBRARY_2D_Skewed-Diamond-Pattern.gh (Grasshopper 1.0.7)

number_slider = Slider(24, range=0..100)
pt = Point(Point(0, 0, 0))
square_grid_generator = SquareGridGenerator(origin_point=pt, cell_scale=Slider(4, range=0..10), x_axis_extent=number_slider, y_axis_extent=number_slider)  # -> grid_cell_curves_2, grid_area_centroids
pt_2 = Point(flatten(square_grid_generator.grid_area_centroids))
crv = Curve(flatten(square_grid_generator.grid_cell_curves_2))
scale = Scale(Geometry=crv, Center=pt_2, Factor=Slider(0.5, range=0.1..0.9))  # -> Geometry, Transform
rotate = Rotate(Geometry=scale.Geometry, Angle=degrees(Slider(0, range=0..100)), Plane=pt_2)  # -> Geometry, Transform
explode = Explode(Curve=crv, Recursive=True)  # -> Segments, Vertices
explode_2 = Explode(Curve=rotate.Geometry, Recursive=True)  # -> Segments, Vertices
eval = EvaluateCurve(Curve=reparameterize(explode_2.Segments), Parameter=Slider(0.1, range=0..1))  # -> Point, Tangent, Angle
ln = Line(StartPoint=eval.Point, EndPoint=graft(pt_2))  # -> flatten(Line)
ln_2 = Line(StartPoint=explode.Vertices, EndPoint=eval.Point)  # -> flatten(Line)
crv_2 = Curve([ln, ln_2])
bbox = BoundingBox(Content=crv, Plane=PlaneXY(0, 0, 0), UnionBox=True)  # -> Box, Box_2
srfsplit = SurfaceSplit(Surface=bbox.Box, Curves=crv_2)
crv_3 = Curve(srfsplit)
neg = Negative(Value=Slider(0.125, range=0..1))
offset_l = OffsetCurveLoose(Curve=crv_3, Distance=neg)
pt_3 = Point(Point(0, 0, 0))
number_slider_2 = Slider(24, range=0..100)
pt_4 = Point(Point(0, 0, 0))
number_slider_3 = Slider(24, range=0..100)
pt_5 = Point(Point(0, 0, 0))
number_slider_4 = Slider(24, range=0..100)
pt_6 = Point(Point(0, 0, 0))
number_slider_5 = Slider(24, range=0..100)
pt_7 = Point(Point(0, 0, 0))
number_slider_6 = Slider(24, range=0..100)
square_grid_generator_2 = SquareGridGenerator(origin_point=pt_3, cell_scale=Slider(4, range=0..10), x_axis_extent=number_slider_2, y_axis_extent=number_slider_2)  # -> grid_cell_curves_2, grid_area_centroids
square_grid_generator_3 = SquareGridGenerator(origin_point=pt_4, cell_scale=Slider(4, range=0..10), x_axis_extent=number_slider_3, y_axis_extent=number_slider_3)  # -> grid_cell_curves_2, grid_area_centroids
square_grid_generator_4 = SquareGridGenerator(origin_point=pt_5, cell_scale=Slider(4, range=0..10), x_axis_extent=number_slider_4, y_axis_extent=number_slider_4)  # -> grid_cell_curves_2, grid_area_centroids
square_grid_generator_5 = SquareGridGenerator(origin_point=pt_6, cell_scale=Slider(4, range=0..10), x_axis_extent=number_slider_5, y_axis_extent=number_slider_5)  # -> grid_cell_curves_2, grid_area_centroids
square_grid_generator_6 = SquareGridGenerator(origin_point=pt_7, cell_scale=Slider(4, range=0..10), x_axis_extent=number_slider_6, y_axis_extent=number_slider_6)  # -> grid_cell_curves_2, grid_area_centroids
pt_8 = Point(flatten(square_grid_generator_2.grid_area_centroids))
crv_4 = Curve(flatten(square_grid_generator_2.grid_cell_curves_2))
pt_9 = Point(flatten(square_grid_generator_3.grid_area_centroids))
pt_10 = Point(flatten(square_grid_generator_4.grid_area_centroids))
crv_5 = Curve(flatten(square_grid_generator_3.grid_cell_curves_2))
pt_11 = Point(flatten(square_grid_generator_5.grid_area_centroids))
crv_6 = Curve(flatten(square_grid_generator_4.grid_cell_curves_2))
pt_12 = Point(flatten(square_grid_generator_6.grid_area_centroids))
crv_7 = Curve(flatten(square_grid_generator_5.grid_cell_curves_2))
crv_8 = Curve(flatten(square_grid_generator_6.grid_cell_curves_2))
scale_2 = Scale(Geometry=crv_4, Center=pt_8, Factor=Slider(0.9, range=0.1..0.9))  # -> Geometry, Transform
scale_3 = Scale(Geometry=crv_5, Center=pt_9, Factor=Slider(0.9, range=0.1..0.9))  # -> Geometry, Transform
scale_4 = Scale(Geometry=crv_6, Center=pt_10, Factor=Slider(0.1, range=0.1..0.9))  # -> Geometry, Transform
scale_5 = Scale(Geometry=crv_7, Center=pt_11, Factor=Slider(0.9, range=0.1..0.9))  # -> Geometry, Transform
scale_6 = Scale(Geometry=crv_8, Center=pt_12, Factor=Slider(0.5, range=0.1..0.9))  # -> Geometry, Transform
rotate_2 = Rotate(Geometry=scale_2.Geometry, Angle=degrees(Slider(0, range=0..100)), Plane=pt_8)  # -> Geometry, Transform
rotate_3 = Rotate(Geometry=scale_3.Geometry, Angle=degrees(Slider(0, range=0..100)), Plane=pt_9)  # -> Geometry, Transform
rotate_4 = Rotate(Geometry=scale_4.Geometry, Angle=degrees(Slider(0, range=0..100)), Plane=pt_10)  # -> Geometry, Transform
rotate_5 = Rotate(Geometry=scale_5.Geometry, Angle=degrees(Slider(0, range=0..100)), Plane=pt_11)  # -> Geometry, Transform
rotate_6 = Rotate(Geometry=scale_6.Geometry, Angle=degrees(Slider(0, range=0..100)), Plane=pt_12)  # -> Geometry, Transform
explode_3 = Explode(Curve=crv_4, Recursive=True)  # -> Segments, Vertices
explode_4 = Explode(Curve=crv_5, Recursive=True)  # -> Segments, Vertices
explode_5 = Explode(Curve=crv_6, Recursive=True)  # -> Segments, Vertices
explode_6 = Explode(Curve=rotate_2.Geometry, Recursive=True)  # -> Segments, Vertices
explode_7 = Explode(Curve=crv_7, Recursive=True)  # -> Segments, Vertices
explode_8 = Explode(Curve=crv_8, Recursive=True)  # -> Segments, Vertices
explode_9 = Explode(Curve=rotate_3.Geometry, Recursive=True)  # -> Segments, Vertices
explode_10 = Explode(Curve=rotate_4.Geometry, Recursive=True)  # -> Segments, Vertices
explode_11 = Explode(Curve=rotate_5.Geometry, Recursive=True)  # -> Segments, Vertices
explode_12 = Explode(Curve=rotate_6.Geometry, Recursive=True)  # -> Segments, Vertices
eval_2 = EvaluateCurve(Curve=reparameterize(explode_6.Segments), Parameter=Slider(0.5, range=0..1))  # -> Point, Tangent, Angle
eval_3 = EvaluateCurve(Curve=reparameterize(explode_9.Segments), Parameter=Slider(0.75, range=0..1))  # -> Point, Tangent, Angle
eval_4 = EvaluateCurve(Curve=reparameterize(explode_10.Segments), Parameter=Slider(0.5, range=0..1))  # -> Point, Tangent, Angle
eval_5 = EvaluateCurve(Curve=reparameterize(explode_11.Segments), Parameter=Slider(0.9, range=0..1))  # -> Point, Tangent, Angle
eval_6 = EvaluateCurve(Curve=reparameterize(explode_12.Segments), Parameter=Slider(0.75, range=0..1))  # -> Point, Tangent, Angle
ln_3 = Line(StartPoint=eval_2.Point, EndPoint=graft(pt_8))  # -> flatten(Line)
ln_4 = Line(StartPoint=eval_3.Point, EndPoint=graft(pt_9))  # -> flatten(Line)
ln_5 = Line(StartPoint=eval_4.Point, EndPoint=graft(pt_10))  # -> flatten(Line)
ln_6 = Line(StartPoint=explode_3.Vertices, EndPoint=eval_2.Point)  # -> flatten(Line)
ln_7 = Line(StartPoint=eval_5.Point, EndPoint=graft(pt_11))  # -> flatten(Line)
ln_8 = Line(StartPoint=eval_6.Point, EndPoint=graft(pt_12))  # -> flatten(Line)
ln_9 = Line(StartPoint=explode_4.Vertices, EndPoint=eval_3.Point)  # -> flatten(Line)
ln_10 = Line(StartPoint=explode_5.Vertices, EndPoint=eval_4.Point)  # -> flatten(Line)
ln_11 = Line(StartPoint=explode_7.Vertices, EndPoint=eval_5.Point)  # -> flatten(Line)
ln_12 = Line(StartPoint=explode_8.Vertices, EndPoint=eval_6.Point)  # -> flatten(Line)
crv_9 = Curve([ln_3, ln_6])
crv_10 = Curve([ln_4, ln_9])
crv_11 = Curve([ln_5, ln_10])
crv_12 = Curve([ln_7, ln_11])
crv_13 = Curve([ln_8, ln_12])
bbox_2 = BoundingBox(Content=crv_4, Plane=PlaneXY(0, 0, 0), UnionBox=True)  # -> Box, Box_2
bbox_3 = BoundingBox(Content=crv_5, Plane=PlaneXY(0, 0, 0), UnionBox=True)  # -> Box, Box_2
bbox_4 = BoundingBox(Content=crv_6, Plane=PlaneXY(0, 0, 0), UnionBox=True)  # -> Box, Box_2
bbox_5 = BoundingBox(Content=crv_7, Plane=PlaneXY(0, 0, 0), UnionBox=True)  # -> Box, Box_2
bbox_6 = BoundingBox(Content=crv_8, Plane=PlaneXY(0, 0, 0), UnionBox=True)  # -> Box, Box_2
srfsplit_2 = SurfaceSplit(Surface=bbox_2.Box, Curves=crv_9)
srfsplit_3 = SurfaceSplit(Surface=bbox_3.Box, Curves=crv_10)
srfsplit_4 = SurfaceSplit(Surface=bbox_4.Box, Curves=crv_11)
srfsplit_5 = SurfaceSplit(Surface=bbox_5.Box, Curves=crv_12)
srfsplit_6 = SurfaceSplit(Surface=bbox_6.Box, Curves=crv_13)
crv_14 = Curve(srfsplit_2)
crv_15 = Curve(srfsplit_3)
crv_16 = Curve(srfsplit_4)
crv_17 = Curve(srfsplit_5)
crv_18 = Curve(srfsplit_6)
neg_2 = Negative(Value=Slider(0.125, range=0..1))
neg_3 = Negative(Value=Slider(0.125, range=0..1))
neg_4 = Negative(Value=Slider(0.125, range=0..1))
neg_5 = Negative(Value=Slider(0.125, range=0..1))
neg_6 = Negative(Value=Slider(0.125, range=0..1))
offset_l_2 = OffsetCurveLoose(Curve=crv_14, Distance=neg_2)
offset_l_3 = OffsetCurveLoose(Curve=crv_15, Distance=neg_3)
offset_l_4 = OffsetCurveLoose(Curve=crv_16, Distance=neg_4)
offset_l_5 = OffsetCurveLoose(Curve=crv_17, Distance=neg_5)
offset_l_6 = OffsetCurveLoose(Curve=crv_18, Distance=neg_6)
number_slider_7 = Slider(24, range=0..100)
pt_13 = Point(Point(0, 0, 0))
number_slider_8 = Slider(24, range=0..100)
pt_14 = Point(Point(0, 0, 0))
number_slider_9 = Slider(24, range=0..100)
pt_15 = Point(Point(0, 0, 0))
number_slider_10 = Slider(24, range=0..100)
pt_16 = Point(Point(0, 0, 0))
square_grid_generator_7 = SquareGridGenerator(origin_point=pt_13, cell_scale=Slider(4, range=0..10), x_axis_extent=number_slider_7, y_axis_extent=number_slider_7)  # -> grid_cell_curves_2, grid_area_centroids
square_grid_generator_8 = SquareGridGenerator(origin_point=pt_14, cell_scale=Slider(4, range=0..10), x_axis_extent=number_slider_8, y_axis_extent=number_slider_8)  # -> grid_cell_curves_2, grid_area_centroids
square_grid_generator_9 = SquareGridGenerator(origin_point=pt_15, cell_scale=Slider(4, range=0..10), x_axis_extent=number_slider_9, y_axis_extent=number_slider_9)  # -> grid_cell_curves_2, grid_area_centroids
square_grid_generator_10 = SquareGridGenerator(origin_point=pt_16, cell_scale=Slider(4, range=0..10), x_axis_extent=number_slider_10, y_axis_extent=number_slider_10)  # -> grid_cell_curves_2, grid_area_centroids
pt_17 = Point(flatten(square_grid_generator_7.grid_area_centroids))
pt_18 = Point(flatten(square_grid_generator_8.grid_area_centroids))
crv_19 = Curve(flatten(square_grid_generator_7.grid_cell_curves_2))
pt_19 = Point(flatten(square_grid_generator_9.grid_area_centroids))
crv_20 = Curve(flatten(square_grid_generator_8.grid_cell_curves_2))
pt_20 = Point(flatten(square_grid_generator_10.grid_area_centroids))
crv_21 = Curve(flatten(square_grid_generator_9.grid_cell_curves_2))
crv_22 = Curve(flatten(square_grid_generator_10.grid_cell_curves_2))
scale_7 = Scale(Geometry=crv_19, Center=pt_17, Factor=Slider(0.8, range=0.1..0.9))  # -> Geometry, Transform
scale_8 = Scale(Geometry=crv_20, Center=pt_18, Factor=Slider(0.7, range=0.1..0.9))  # -> Geometry, Transform
scale_9 = Scale(Geometry=crv_21, Center=pt_19, Factor=Slider(0.6, range=0.1..0.9))  # -> Geometry, Transform
scale_10 = Scale(Geometry=crv_22, Center=pt_20, Factor=Slider(0.5, range=0.1..0.9))  # -> Geometry, Transform
rotate_7 = Rotate(Geometry=scale_7.Geometry, Angle=degrees(Slider(0, range=0..100)), Plane=pt_17)  # -> Geometry, Transform
rotate_8 = Rotate(Geometry=scale_8.Geometry, Angle=degrees(Slider(0, range=0..100)), Plane=pt_18)  # -> Geometry, Transform
rotate_9 = Rotate(Geometry=scale_9.Geometry, Angle=degrees(Slider(0, range=0..100)), Plane=pt_19)  # -> Geometry, Transform
rotate_10 = Rotate(Geometry=scale_10.Geometry, Angle=degrees(Slider(0, range=0..100)), Plane=pt_20)  # -> Geometry, Transform
explode_13 = Explode(Curve=crv_19, Recursive=True)  # -> Segments, Vertices
explode_14 = Explode(Curve=crv_20, Recursive=True)  # -> Segments, Vertices
explode_15 = Explode(Curve=rotate_7.Geometry, Recursive=True)  # -> Segments, Vertices
explode_16 = Explode(Curve=crv_21, Recursive=True)  # -> Segments, Vertices
explode_17 = Explode(Curve=rotate_8.Geometry, Recursive=True)  # -> Segments, Vertices
explode_18 = Explode(Curve=crv_22, Recursive=True)  # -> Segments, Vertices
explode_19 = Explode(Curve=rotate_9.Geometry, Recursive=True)  # -> Segments, Vertices
explode_20 = Explode(Curve=rotate_10.Geometry, Recursive=True)  # -> Segments, Vertices
eval_7 = EvaluateCurve(Curve=reparameterize(explode_15.Segments), Parameter=Slider(0.2, range=0..1))  # -> Point, Tangent, Angle
eval_8 = EvaluateCurve(Curve=reparameterize(explode_17.Segments), Parameter=Slider(0.3, range=0..1))  # -> Point, Tangent, Angle
eval_9 = EvaluateCurve(Curve=reparameterize(explode_19.Segments), Parameter=Slider(0.4, range=0..1))  # -> Point, Tangent, Angle
eval_10 = EvaluateCurve(Curve=reparameterize(explode_20.Segments), Parameter=Slider(0.5, range=0..1))  # -> Point, Tangent, Angle
ln_13 = Line(StartPoint=eval_7.Point, EndPoint=graft(pt_17))  # -> flatten(Line)
ln_14 = Line(StartPoint=eval_8.Point, EndPoint=graft(pt_18))  # -> flatten(Line)
ln_15 = Line(StartPoint=explode_13.Vertices, EndPoint=eval_7.Point)  # -> flatten(Line)
ln_16 = Line(StartPoint=eval_9.Point, EndPoint=graft(pt_19))  # -> flatten(Line)
ln_17 = Line(StartPoint=explode_14.Vertices, EndPoint=eval_8.Point)  # -> flatten(Line)
ln_18 = Line(StartPoint=eval_10.Point, EndPoint=graft(pt_20))  # -> flatten(Line)
ln_19 = Line(StartPoint=explode_16.Vertices, EndPoint=eval_9.Point)  # -> flatten(Line)
ln_20 = Line(StartPoint=explode_18.Vertices, EndPoint=eval_10.Point)  # -> flatten(Line)
crv_23 = Curve([ln_13, ln_15])
crv_24 = Curve([ln_14, ln_17])
crv_25 = Curve([ln_16, ln_19])
crv_26 = Curve([ln_18, ln_20])
bbox_7 = BoundingBox(Content=crv_19, Plane=PlaneXY(0, 0, 0), UnionBox=True)  # -> Box, Box_2
bbox_8 = BoundingBox(Content=crv_20, Plane=PlaneXY(0, 0, 0), UnionBox=True)  # -> Box, Box_2
bbox_9 = BoundingBox(Content=crv_21, Plane=PlaneXY(0, 0, 0), UnionBox=True)  # -> Box, Box_2
bbox_10 = BoundingBox(Content=crv_22, Plane=PlaneXY(0, 0, 0), UnionBox=True)  # -> Box, Box_2
srfsplit_7 = SurfaceSplit(Surface=bbox_7.Box, Curves=crv_23)
srfsplit_8 = SurfaceSplit(Surface=bbox_8.Box, Curves=crv_24)
srfsplit_9 = SurfaceSplit(Surface=bbox_9.Box, Curves=crv_25)
srfsplit_10 = SurfaceSplit(Surface=bbox_10.Box, Curves=crv_26)
crv_27 = Curve(srfsplit_7)
crv_28 = Curve(srfsplit_8)
crv_29 = Curve(srfsplit_9)
crv_30 = Curve(srfsplit_10)
neg_7 = Negative(Value=Slider(0.125, range=0..1))
neg_8 = Negative(Value=Slider(0.125, range=0..1))
neg_9 = Negative(Value=Slider(0.125, range=0..1))
neg_10 = Negative(Value=Slider(0.125, range=0..1))
offset_l_7 = OffsetCurveLoose(Curve=crv_27, Distance=neg_7)
offset_l_8 = OffsetCurveLoose(Curve=crv_28, Distance=neg_8)
offset_l_9 = OffsetCurveLoose(Curve=crv_29, Distance=neg_9)
offset_l_10 = OffsetCurveLoose(Curve=crv_30, Distance=neg_10)

# ==== cluster SquareGridGenerator: Grid Gen
y_axis_extent = ClusterInput()
x_axis_extent = ClusterInput()
in = ClusterInput()  # "---------------------"
origin_point = ClusterInput()
cell_scale = ClusterInput()
y_axis_extent_2 = Number(y_axis_extent)
x_axis_extent_2 = Number(x_axis_extent)
cell_scale_2 = Number(cell_scale)
origin_point_2 = Point(origin_point)
division = Division(XAxisExtent=x_axis_extent_2, B=cell_scale_2)
division_2 = Division(YAxisExtent=y_axis_extent_2, B=cell_scale_2)
sqgrid = Square(Plane=origin_point_2, Size=cell_scale_2, ExtentX=division, ExtentY=division_2)  # -> Cells, Points
grid_cell_curves = Curve(sqgrid.Cells)
area = Area(Geometry=grid_cell_curves)  # -> Area, GridAreaCentroids
grid_area_centroids = ClusterOutput(area.GridAreaCentroids)
grid_cell_curves_2 = ClusterOutput(grid_cell_curves)
