# Grasshopper definition LIBRARY_2D_Split-Hexagon-Linework.gh (Grasshopper 1.0.7)

pt = Point(Point(0, 0, 0))
number_slider = Slider(24, range=0..100)
number_slider_2 = Slider(0.25, range=0..1)
tri_grid_generator_special = TriGridGeneratorSpecial(origin_point=pt, cell_scale=Slider(2, range=0..10), x_axis_extent=number_slider, y_axis_extent=number_slider)  # -> grid_cell_curves_a_2, grid_cell_curves_b_2, grid_cell_area_centroids_a_2, grid_cell_area_centroids_b_2
explode = Explode(Curve=tri_grid_generator_special.grid_cell_curves_a_2, Recursive=True)  # -> Segments, Vertices
pattern_1_3 = Pattern13(
    grid_cell_curves=tri_grid_generator_special.grid_cell_curves_a_2,
    grid_cell_area_centroids=tri_grid_generator_special.grid_cell_area_centroids_a_2,
    interior_cell_scale=number_slider_2)  # -> flatten(pattern_curves_2), pattern_area_centroids_2, grid_cell_area_centroids_4
explode_2 = Explode(Curve=tri_grid_generator_special.grid_cell_curves_b_2, Recursive=True)  # -> Segments, Vertices
pattern_1_3_2 = Pattern13(
    grid_cell_curves=tri_grid_generator_special.grid_cell_curves_b_2,
    grid_cell_area_centroids=tri_grid_generator_special.grid_cell_area_centroids_b_2,
    interior_cell_scale=number_slider_2)  # -> flatten(pattern_curves_2), pattern_area_centroids_2, grid_cell_area_centroids_4
area = Area(Geometry=pattern_1_3.pattern_curves_2)  # -> Area, Centroid
end = EndPoints(Curve=explode.Segments)  # -> flatten(Start), End
area_2 = Area(Geometry=pattern_1_3_2.pattern_curves_2)  # -> Area, Centroid
end_2 = EndPoints(Curve=explode_2.Segments)  # -> flatten(Start), End
number_slider_3 = Slider(0.125, range=0..1)
number_slider_4 = Slider(0.125, range=0..1)
cset = CreateSet(List=area.Area)  # -> Set, Map
cset_2 = CreateSet(List=area_2.Area)  # -> Set, Map
sift = SiftPattern(List=pattern_1_3.pattern_curves_2, SiftPattern=cset.Map)  # -> Output0, Output1
sift_2 = SiftPattern(List=pattern_1_3_2.pattern_curves_2, SiftPattern=cset_2.Map)  # -> Output0, Output1
crv = Curve(sift.Output1)
crv_2 = Curve(sift_2.Output1)
runion = RegionUnion(Curves=crv)
null = NullItem(Item=sift.Output0)  # -> NullFlags, InvalidFlags, Description
runion_2 = RegionUnion(Curves=crv_2)
null_2 = NullItem(Item=sift_2.Output0)  # -> NullFlags, InvalidFlags, Description
area_3 = Area(Geometry=runion)  # -> Area, Centroid
area_4 = Area(Geometry=runion_2)  # -> Area, Centroid
cull = CullPattern(List=sift.Output0, CullPattern=invert(null.NullFlags))
cull_2 = CullPattern(List=sift_2.Output0, CullPattern=invert(null_2.NullFlags))
number_slider_5 = Slider(0.56, range=0..1)
number_slider_6 = Slider(0.5, range=0..1)
scale = Scale(Geometry=runion, Center=area_3.Centroid, Factor=Slider(0.25, range=0..1))  # -> Geometry, Transform
scale_2 = Scale(Geometry=runion_2, Center=area_4.Centroid, Factor=Slider(0.25, range=0..1))  # -> Geometry, Transform
scale_3 = Scale(Geometry=cull, Center=end.Start, Factor=number_slider_5)  # -> Geometry, Transform
scale_4 = Scale(Geometry=cull_2, Center=end_2.Start, Factor=number_slider_5)  # -> Geometry, Transform
area_5 = Area(Geometry=[scale_3.Geometry, scale_4.Geometry])  # -> Area, Centroid
scale_5 = Scale(Geometry=[scale_3.Geometry, scale_4.Geometry], Center=area_5.Centroid, Factor=Slider(0.7, range=0..1))  # -> Geometry, Transform

# ==== cluster Pattern13: Pattern Component
grid_cell_curves = ClusterInput()
grid_cell_area_centroids = ClusterInput()
grid_cell_curves_2 = Curve(grid_cell_curves)
item = ListItem(List=flatten(grid_cell_curves_2), Index=0, Wrap=True)
area = Area(Geometry=item)  # -> Area, Centroid
grid_eval_tool = GridEvalTool(grid_cell_curves=item, grid_cell_area_centroids=area.Centroid, grid_cell_scale=Slider(1, range=0..1))  # -> grid_cell_curves_5, grid_cell_vertices_2, grid_cell_midpoints_2, grid_cell_area_centroids_3
grid_cell_area_centroids_2 = Point(flatten(grid_cell_area_centroids))
pt = Point(grid_eval_tool.grid_cell_midpoints_2)
avr = Average(Input=pt)
interior_cell_scale = ClusterInput()
ln = Line(StartPoint=avr, EndPoint=pt)
pattern_area_centroid = Point(avr)
interior_cell_scale_2 = Number(interior_cell_scale)
eval = EvaluateCurve(Curve=reparameterize(ln), Parameter=interior_cell_scale_2)  # -> Point, Tangent, Angle
voronoi = Voronoi(Points=flatten([pt, eval.Point]), BruteForceOverride=False)
bbx = BrepBrep(BrepA=item, BrepB=voronoi)  # -> flatten(Curves), Points
ln_2 = Line(StartPoint=pattern_area_centroid, EndPoint=grid_cell_area_centroids_2)
move = Move(Geometry=bbx.Curves, Motion=graft(ln_2))  # -> Geometry, Transform
area_2 = Area(Geometry=move.Geometry)  # -> Area, Centroid
pattern_curves = Curve(move.Geometry)
pattern_area_centroids = Point(area_2.Centroid)
avr_2 = Average(Input=area_2.Centroid)
pattern_curves_2 = ClusterOutput(pattern_curves)
pattern_area_centroids_2 = ClusterOutput(pattern_area_centroids)
grid_cell_area_centroids_3 = Point(avr_2)
grid_cell_area_centroids_4 = ClusterOutput(grid_cell_area_centroids_3)

# ==== cluster TriGridGeneratorSpecial: Grid Gen
cell_scale = ClusterInput()
origin_point = ClusterInput()
x_axis_extent = ClusterInput()
y_axis_extent = ClusterInput()
tri_grid_generator = TriGridGenerator(origin_point=origin_point, cell_scale=cell_scale, x_axis_extent=x_axis_extent, y_axis_extent=y_axis_extent)  # -> grid_cell_curves_2, grid_cell_area_centroids
dispatch = Dispatch(List=tri_grid_generator.grid_cell_area_centroids, DispatchPattern=[True, False])  # -> ListA, ListB
dispatch_2 = Dispatch(List=tri_grid_generator.grid_cell_curves_2, DispatchPattern=[True, False])  # -> ListA, ListB
flip = FlipMatrix(Data=dispatch.ListB)
flip_2 = FlipMatrix(Data=dispatch.ListA)
flip_3 = FlipMatrix(Data=dispatch_2.ListB)
flip_4 = FlipMatrix(Data=dispatch_2.ListA)
dispatch_3 = Dispatch(List=flatten(flip), DispatchPattern=[True, False])  # -> ListA, ListB
dispatch_4 = Dispatch(List=flatten(flip_2), DispatchPattern=[True, False])  # -> ListA, ListB
dispatch_5 = Dispatch(List=flatten(flip_3), DispatchPattern=[True, False])  # -> ListA, ListB
dispatch_6 = Dispatch(List=flatten(flip_4), DispatchPattern=[True, False])  # -> ListA, ListB
weave = Weave(Pattern=[0, 1], Stream0=dispatch_4.ListB, Stream1=dispatch_3.ListA, NullGaps=False)
weave_2 = Weave(Pattern=[0, 1], Stream0=dispatch_4.ListA, Stream1=dispatch_3.ListB, NullGaps=False)
weave_3 = Weave(Pattern=[0, 1], Stream0=dispatch_6.ListB, Stream1=dispatch_5.ListA, NullGaps=False)
weave_4 = Weave(Pattern=[0, 1], Stream0=dispatch_6.ListA, Stream1=dispatch_5.ListB, NullGaps=False)
grid_cell_area_centroids_b = Point(weave)
grid_cell_area_centroids_a = Point(weave_2)
grid_cell_curves_a = Curve(weave_4)
grid_cell_curves_b = Curve(weave_3)
grid_cell_curves_b_2 = ClusterOutput(grid_cell_curves_b)
grid_cell_area_centroids_b_2 = ClusterOutput(grid_cell_area_centroids_b)
grid_cell_area_centroids_a_2 = ClusterOutput(grid_cell_area_centroids_a)
grid_cell_curves_a_2 = ClusterOutput(grid_cell_curves_a)

# ==== cluster GridEvalTool: Grid Gen
grid_cell_area_centroids = ClusterInput()
grid_cell_curves = ClusterInput()
grid_cell_scale = ClusterInput()
grid_cell_area_centroids_2 = Point(grid_cell_area_centroids)
grid_cell_curves_2 = Curve(grid_cell_curves)
grid_cell_scale_2 = Number(grid_cell_scale)
scale = Scale(Geometry=grid_cell_curves_2, Center=grid_cell_area_centroids_2, Factor=grid_cell_scale_2)  # -> Geometry, Transform
grid_cell_curves_3 = Curve(scale.Geometry)
grid_cell_curves_4 = Curve(scale.Geometry)
disc = Discontinuity(Curve=grid_cell_curves_3, Level=1)  # -> Points, Parameters
explode = Explode(Curve=grid_cell_curves_3, Recursive=True)  # -> Segments, Vertices
grid_cell_vertices = Point(disc.Points)
midpt = CurveMiddle(Curve=explode.Segments)
grid_cell_midpoints = Point(midpt)
grid_cell_curves_5 = ClusterOutput(grid_cell_curves_4)
grid_cell_vertices_2 = ClusterOutput(grid_cell_vertices)
grid_cell_area_centroids_3 = ClusterOutput(grid_cell_area_centroids_2)
grid_cell_midpoints_2 = ClusterOutput(grid_cell_midpoints)

# ==== cluster TriGridGenerator: Grid Gen
y_axis_extent = ClusterInput()
x_axis_extent = ClusterInput()
in = ClusterInput()  # "---------------------"
origin_point = ClusterInput()
cell_scale = ClusterInput()
y_axis_extent_2 = Number(y_axis_extent)
x_axis_extent_2 = Number(x_axis_extent)
cell_scale_2 = Number(cell_scale)
origin_point_2 = Point(origin_point)
division = Division(XAxisExtent=x_axis_extent_2, B=cell_scale_2)
division_2 = Division(YAxisExtent=y_axis_extent_2, B=cell_scale_2)
trigrid = Triangular(Plane=origin_point_2, Size=cell_scale_2, ExtentX=division, ExtentY=division_2)  # -> Cells, Points
grid_cell_curves = Curve(trigrid.Cells)
area = Area(Geometry=grid_cell_curves)  # -> Area, GridCellAreaCentroids
grid_cell_area_centroids = ClusterOutput(area.GridCellAreaCentroids)
grid_cell_curves_2 = ClusterOutput(grid_cell_curves)
