# Grasshopper definition LIBRARY_2D_Stripes-Random-Segments.gh (Grasshopper 1.0.7)

number_slider = Slider(24, range=0..100)
number_slider_2 = Slider(24, range=0..100)
number_slider_3 = Slider(24, range=0..100)
number_slider_4 = Slider(24, range=0..100)
number_slider_5 = Slider(24, range=0..100)
number_slider_6 = Slider(24, range=0..100)
construct_point = ConstructPoint(x_axis_point=number_slider, y_axis_point=Slider(0, range=0..100))
construct_point_2 = ConstructPoint(x_axis_point=Slider(0, range=0..100), y_axis_point=number_slider_3)
construct_point_3 = ConstructPoint(x_axis_point=Slider(0, range=0..100), y_axis_point=number_slider_4)
pt = Point(Point(0, 0, 0))
pt_2 = Point(Point(0, 0, 0))
ln = Line(StartPoint=pt, EndPoint=construct_point)
pt_3 = Point(Point(0, 0, 0))
ln_2 = Line(StartPoint=pt_2, EndPoint=construct_point_2)
divide = DivideCurve(Curve=ln, Count=number_slider_2, Kinks=False)  # -> Points, Tangents, Parameters
ln_3 = Line(StartPoint=pt_3, EndPoint=construct_point_3)
divide_2 = DivideCurve(Curve=ln_2, Count=number_slider_5, Kinks=False)  # -> Points, Tangents, Parameters
divide_3 = DivideCurve(Curve=ln_3, Count=number_slider_6, Kinks=False)  # -> Points, Tangents, Parameters
Y = UnitY(Factor=1)
line = LineSDL(Start=divide.Points, Direction=Y, Length=Slider(24, range=0..100))
X = UnitX(Factor=1)
X_2 = UnitX(Factor=1)
line_2 = LineSDL(Start=divide_2.Points, Direction=X, Length=Slider(24, range=0..100))
line_3 = LineSDL(Start=divide_3.Points, Direction=X_2, Length=Slider(24, range=0..100))
lng = ListLength(List=line_2)
lng_2 = ListLength(List=line_3)
lng_3 = ListLength(List=line)
series = Series(Start=Slider(0, range=0..100), Step=Slider(1, range=0..1), Count=lng)
series_2 = Series(Start=Slider(0, range=0..100), Step=Slider(1, range=0..1), Count=lng_2)
series_3 = Series(Start=Slider(0, range=0..100), Step=Slider(1, range=0..1), Count=lng_3)
random = Random(Range=Domain(0, 1), Number=Slider(53, range=0..100), Seed=series)
random_2 = Random(Range=Domain(0, 1), Number=Slider(53, range=0..100), Seed=series_2)
random_3 = Random(Range=Domain(0, 1), Number=Slider(53, range=0..100), Seed=series_3)
shatter = Shatter(Curve=reparameterize(graft(line)), Parameters=random_3)
division = Division(A=number_slider, B=number_slider_2)
number_slider_7 = Slider(2, range=0..10)
shatter_2 = Shatter(Curve=reparameterize(graft(line_2)), Parameters=random)
shatter_3 = Shatter(Curve=reparameterize(graft(line_3)), Parameters=random_2)
division_2 = Division(A=number_slider_3, B=number_slider_5)
division_3 = Division(A=division, B=Slider(4, range=0..10))
division_4 = Division(A=number_slider_4, B=number_slider_6)
len = Length(Curve=shatter)
division_5 = Division(A=division_2, B=Slider(4, range=0..10))
avr = Average(Input=len)
division_6 = Division(A=division_4, B=Slider(1.5, range=0..10))
len_2 = Length(Curve=shatter_2)
len_3 = Length(Curve=shatter_3)
avr_2 = Average(Input=len_2)
avr_3 = Average(Input=len_3)
smaller = SmallerThan(FirstNumber=avr, SecondNumber=shatter)  # -> SmallerThan, OrEqualTo
cull = CullPattern(List=shatter, CullPattern=smaller.SmallerThan)
smaller_2 = SmallerThan(FirstNumber=avr_2, SecondNumber=shatter_2)  # -> SmallerThan, OrEqualTo
smaller_3 = SmallerThan(FirstNumber=avr_3, SecondNumber=shatter_3)  # -> SmallerThan, OrEqualTo
end = EndPoints(Curve=cull)  # -> Start, End
len_4 = Length(Curve=cull)
cull_2 = CullPattern(List=shatter_2, CullPattern=smaller_2.SmallerThan)
cull_3 = CullPattern(List=shatter_3, CullPattern=smaller_3.SmallerThan)
end_2 = EndPoints(Curve=cull_2)  # -> Start, End
end_3 = EndPoints(Curve=cull_3)  # -> Start, End
len_5 = Length(Curve=cull_2)
len_6 = Length(Curve=cull_3)
rectangle = Rectangle(Plane=end.Start, XSize=division_3, YSize=len_4, Radius=0)  # -> Rectangle, Length
area = Area(Geometry=rectangle.Rectangle)  # -> Area, Centroid
rectangle_2 = Rectangle(Plane=end_2.Start, XSize=len_5, YSize=division_5, Radius=0)  # -> Rectangle, Length
rectangle_3 = Rectangle(Plane=end_3.Start, XSize=len_6, YSize=division_6, Radius=0)  # -> Rectangle, Length
area_2 = Area(Geometry=rectangle_2.Rectangle)  # -> Area, Centroid
area_3 = Area(Geometry=rectangle_3.Rectangle)  # -> Area, Centroid
scale_nu = ScaleNU(
    Geometry=rectangle.Rectangle,
    Plane=area.Centroid,
    ScaleX=Slider(1, range=0..1),
    ScaleY=Slider(0.875, range=0..1),
    ScaleZ=1)  # -> Geometry, Transform
scale_nu_2 = ScaleNU(
    Geometry=rectangle_2.Rectangle,
    Plane=area_2.Centroid,
    ScaleX=Slider(0.875, range=0..1),
    ScaleY=Slider(1, range=0..1),
    ScaleZ=1)  # -> Geometry, Transform
scale_nu_3 = ScaleNU(
    Geometry=rectangle_3.Rectangle,
    Plane=area_3.Centroid,
    ScaleX=Slider(0.875, range=0..1),
    ScaleY=Slider(1, range=0..1),
    ScaleZ=1)  # -> Geometry, Transform
crv = Curve(scale_nu.Geometry)
crv_2 = Curve(scale_nu_2.Geometry)
crv_3 = Curve(scale_nu_3.Geometry)
crv_4 = Curve(crv_3)
fillet = Fillet(Curve=crv, Radius=Slider(0.159, range=0..1))
fillet_2 = Fillet(Curve=crv_4, Radius=Slider(0.305, range=0..1))

# ==== cluster ConstructPoint: Constructed Base
y_axis_point = ClusterInput()
x_axis_point = ClusterInput()
pt = ConstructPoint(XCoordinate=x_axis_point, YCoordinate=y_axis_point, ZCoordinate=Slider(0, range=0..100))
constructed_point = ClusterOutput(pt)
