# Grasshopper definition LIBRARY_2D_Transitioning-Geometries.gh (Grasshopper 1.0.7)

number_slider = Slider(30, range=1..100)
hexagon = Curve(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)
square = Curve(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)
circle = Curve(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)
number_slider_2 = Slider(24, range=0..100)
triangle = Curve(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)
divide = DivideCurve(Curve=triangle, Count=number_slider_2, Kinks=False)  # -> Points, Tangents, Parameters
divide_2 = DivideCurve(Curve=hexagon, Count=number_slider_2, Kinks=False)  # -> Points, Tangents, Parameters
hexgrid = Hexagonal(Plane=PlaneXY(0, 0, 0), Size=Slider(1.5, range=1..100), ExtentX=Slider(40, range=1..100), ExtentY=number_slider)  # -> Cells, Points
shift = ShiftList(List=divide_2.Points, Shift=Slider(13, range=0..100), Wrap=True)
pt = Point(hexgrid.Points)
ln = Line(StartPoint=divide.Points, EndPoint=shift)
divide_3 = DivideCurve(Curve=ln, Count=expr("x-1", number_slider), Kinks=False)  # -> Points, Tangents, Parameters
flip = FlipMatrix(Data=divide_3.Points)
pline = PolyLine(Vertices=flip, Closed=True)
area = Area(Geometry=pline)  # -> Area, Centroid
orient = Orient(Geometry=flatten(pline), Source=flatten(area.Centroid), Target=pt)  # -> Geometry, Transform
crv = Curve(orient.Geometry)
crv_2 = Curve(<curve referenced from the Rhino model>)
crv_3 = Curve(<curve referenced from the Rhino model>)
crv_4 = Curve(<curve referenced from the Rhino model>)
pt_2 = Point(Point(0, 0, 0))
pt_3 = Point(Point(0, 0, 0))
pt_4 = Point(Point(0, 0, 0))
crv_5 = Curve(<curve referenced from the Rhino model>)
crv_6 = Curve(<curve referenced from the Rhino model>)
crv_7 = Curve(crv_2)
crv_8 = Curve(<curve referenced from the Rhino model>)
polygon = Polygon(Plane=pt_2, Radius=Slider(0.85, range=0..10), Segments=Slider(4, range=0..10), FilletRadius=0)  # -> Polygon, Length
polygon_2 = Polygon(Plane=pt_3, Radius=Slider(0.85, range=0..10), Segments=Slider(6, range=0..10), FilletRadius=0)  # -> Polygon, Length
polygon_3 = Polygon(Plane=pt_4, Radius=Slider(0.85, range=0..10), Segments=Slider(4, range=0..10), FilletRadius=0)  # -> Polygon, Length
rec = Rectangle({Plane=PlaneXY(0.5, 0.5, 0), Size=Domain2(u=-0.5..0.5, v=-0.5..0.5)})
rec_2 = Rectangle({Plane=PlaneXY(0.5, 0.5, 0), Size=Domain2(u=-0.5..0.5, v=-0.5..0.5)})
rec_3 = Rectangle({Plane=PlaneXY(0.5, 0.5, 0), Size=Domain2(u=-0.5..0.5, v=-0.5..0.5)})
number_slider_3 = Slider(24, range=0..100)
number_slider_4 = Slider(24, range=0..100)
number_slider_5 = Slider(24, range=0..100)
number_slider_6 = Slider(24, range=0..100)
number_slider_7 = Slider(24, range=0..100)
area_2 = Area(Geometry=crv_5)  # -> Area, Centroid
crv_9 = Curve(polygon.Polygon)
area_3 = Area(Geometry=crv_6)  # -> Area, Centroid
crv_10 = Curve(polygon_2.Polygon)
area_4 = Area(Geometry=crv_7)  # -> Area, Centroid
crv_11 = Curve(polygon_3.Polygon)
area_5 = Area(Geometry=crv_8)  # -> Area, Centroid
num = Number(Slider(0.24, range=0..1))
num_2 = Number(number_slider_3)
num_3 = Number(Slider(1, range=0..1))
num_4 = Number(number_slider_3)
num_5 = Number(number_slider_4)
num_6 = Number(Slider(1, range=0..1))
num_7 = Number(number_slider_4)
num_8 = Number(Slider(0.1, range=0..1))
num_9 = Number(number_slider_5)
num_10 = Number(Slider(1, range=0..1))
num_11 = Number(number_slider_5)
num_12 = Number(Slider(0.86, range=0..1))
num_13 = Number(number_slider_6)
num_14 = Number(Slider(1, range=0..1))
num_15 = Number(number_slider_6)
scale = Scale(Geometry=crv_9, Center=Point(0, 0, 0), Factor=num_3)  # -> Geometry, Transform
num_16 = Number(number_slider_7)
num_17 = Number(Slider(1, range=0..1))
num_18 = Number(number_slider_7)
scale_2 = Scale(Geometry=crv_10, Center=Point(0, 0, 0), Factor=num_10)  # -> Geometry, Transform
scale_3 = Scale(Geometry=crv_11, Center=Point(0, 0, 0), Factor=num_14)  # -> Geometry, Transform
scale_4 = Scale(Geometry=crv_7, Center=area_4.Centroid, Factor=num_6)  # -> Geometry, Transform
scale_5 = Scale(Geometry=crv_5, Center=area_2.Centroid, Factor=num_6)  # -> Geometry, Transform
crv_12 = Curve(scale.Geometry)
scale_6 = Scale(Geometry=crv_8, Center=area_5.Centroid, Factor=num_17)  # -> Geometry, Transform
scale_7 = Scale(Geometry=crv_6, Center=area_3.Centroid, Factor=num_17)  # -> Geometry, Transform
crv_13 = Curve(scale_2.Geometry)
crv_14 = Curve(scale_3.Geometry)
area_6 = Area(Geometry=crv_12)  # -> Area, Centroid
area_7 = Area(Geometry=crv_13)  # -> Area, Centroid
area_8 = Area(Geometry=crv_14)  # -> Area, Centroid
scale_8 = Scale(Geometry=crv_12, Center=area_6.Centroid, Factor=num)  # -> Geometry, Transform
scale_9 = Scale(Geometry=crv_13, Center=area_7.Centroid, Factor=num_8)  # -> Geometry, Transform
scale_10 = Scale(Geometry=crv_14, Center=area_8.Centroid, Factor=num_12)  # -> Geometry, Transform
explode = Explode(Curve=scale_8.Geometry, Recursive=True)  # -> Segments, Vertices
explode_2 = Explode(Curve=scale_9.Geometry, Recursive=True)  # -> Segments, Vertices
explode_3 = Explode(Curve=scale_10.Geometry, Recursive=True)  # -> Segments, Vertices
number_slider_8 = Slider(20, range=0..100)
number_slider_9 = Slider(20, range=0..100)
explode_4 = Explode(Curve=crv_12, Recursive=True)  # -> Segments, Vertices
explode_5 = Explode(Curve=crv_13, Recursive=True)  # -> Segments, Vertices
end = EndPoints(Curve=explode.Segments)  # -> Start, End
explode_6 = Explode(Curve=crv_14, Recursive=True)  # -> Segments, Vertices
end_2 = EndPoints(Curve=explode_2.Segments)  # -> Start, End
end_3 = EndPoints(Curve=explode_3.Segments)  # -> Start, End
division = Division(A=num_5, B=num_6)
division_2 = Division(A=num_7, B=num_6)
division_3 = Division(A=num_16, B=num_17)
division_4 = Division(A=num_18, B=num_17)
midpt = CurveMiddle(Curve=explode_4.Segments)
midpt_2 = CurveMiddle(Curve=explode_5.Segments)
midpt_3 = CurveMiddle(Curve=explode_6.Segments)
divide_4 = DivideCurve(Curve=scale_5.Geometry, Count=number_slider_8, Kinks=False)  # -> Points, Tangents, Parameters
divide_5 = DivideCurve(Curve=scale_4.Geometry, Count=number_slider_8, Kinks=False)  # -> Points, Tangents, Parameters
divide_6 = DivideCurve(Curve=scale_7.Geometry, Count=number_slider_9, Kinks=False)  # -> Points, Tangents, Parameters
divide_7 = DivideCurve(Curve=scale_6.Geometry, Count=number_slider_9, Kinks=False)  # -> Points, Tangents, Parameters
hexgrid_2 = Hexagonal(Plane=PlaneXY(0, 0, 0), Size=num_6, ExtentX=division_2, ExtentY=division)  # -> Cells, Points
ln_2 = Line(StartPoint=midpt, EndPoint=end.End)
ln_3 = Line(StartPoint=midpt_2, EndPoint=end_2.End)
ln_4 = Line(StartPoint=midpt, EndPoint=end.Start)
hexgrid_3 = Hexagonal(Plane=PlaneXY(0, 0, 0), Size=num_17, ExtentX=division_4, ExtentY=division_3)  # -> Cells, Points
ln_5 = Line(StartPoint=midpt_3, EndPoint=end_3.End)
ln_6 = Line(StartPoint=midpt_2, EndPoint=end_2.Start)
ln_7 = Line(StartPoint=midpt_3, EndPoint=end_3.Start)
shift_2 = ShiftList(List=divide_5.Points, Shift=Slider(26, range=0..100), Wrap=True)
shift_3 = ShiftList(List=divide_7.Points, Shift=Slider(26, range=0..100), Wrap=True)
merge = Merge(Data1=ln_4, Data2=ln_2)
pt_5 = Point(hexgrid_2.Points)
merge_2 = Merge(Data1=ln_6, Data2=ln_3)
merge_3 = Merge(Data1=ln_7, Data2=ln_5)
pt_6 = Point(hexgrid_3.Points)
ln_8 = Line(StartPoint=divide_4.Points, EndPoint=shift_2)
ln_9 = Line(StartPoint=divide_6.Points, EndPoint=shift_3)
join = JoinCurves(Curves=merge, Preserve=False)
join_2 = JoinCurves(Curves=merge_2, Preserve=False)
join_3 = JoinCurves(Curves=merge_3, Preserve=False)
divide_8 = DivideCurve(Curve=ln_8, Count=expr("x-1", division), Kinks=False)  # -> Points, Tangents, Parameters
divide_9 = DivideCurve(Curve=ln_9, Count=expr("x-1", division_3), Kinks=False)  # -> Points, Tangents, Parameters
flip_2 = FlipMatrix(Data=divide_8.Points)
flip_3 = FlipMatrix(Data=divide_9.Points)
pline_2 = PolyLine(Vertices=flip_2, Closed=Slider(1, range=0..1))
pline_3 = PolyLine(Vertices=flip_3, Closed=Slider(1, range=0..1))
number_slider_10 = Slider(24, range=0..100)
number_slider_11 = Slider(24, range=0..100)
number_slider_12 = Slider(24, range=0..100)
area_9 = Area(Geometry=pline_2)  # -> Area, Centroid
area_10 = Area(Geometry=pline_3)  # -> Area, Centroid
division_5 = Division(A=num_2, B=num_3)
division_6 = Division(A=num_9, B=num_10)
division_7 = Division(A=num_4, B=num_3)
division_8 = Division(A=num_13, B=num_14)
division_9 = Division(A=num_11, B=num_10)
division_10 = Division(A=num_15, B=num_14)
divide_10 = DivideCurve(Curve=crv_12, Count=number_slider_10, Kinks=False)  # -> Points, Tangents, Parameters
divide_11 = DivideCurve(Curve=join, Count=number_slider_10, Kinks=False)  # -> Points, Tangents, Parameters
divide_12 = DivideCurve(Curve=crv_13, Count=number_slider_11, Kinks=False)  # -> Points, Tangents, Parameters
divide_13 = DivideCurve(Curve=join_2, Count=number_slider_11, Kinks=False)  # -> Points, Tangents, Parameters
divide_14 = DivideCurve(Curve=crv_14, Count=number_slider_12, Kinks=False)  # -> Points, Tangents, Parameters
divide_15 = DivideCurve(Curve=join_3, Count=number_slider_12, Kinks=False)  # -> Points, Tangents, Parameters
hexgrid_4 = Hexagonal(Plane=PlaneXY(0, 0, 0), Size=num_3, ExtentX=division_7, ExtentY=division_5)  # -> Cells, Points
hexgrid_5 = Hexagonal(Plane=PlaneXY(0, 0, 0), Size=num_10, ExtentX=division_9, ExtentY=division_6)  # -> Cells, Points
hexgrid_6 = Hexagonal(Plane=PlaneXY(0, 0, 0), Size=num_14, ExtentX=division_10, ExtentY=division_8)  # -> Cells, Points
orient_2 = Orient(Geometry=flatten(pline_2), Source=flatten(area_9.Centroid), Target=pt_5)  # -> Geometry, Transform
orient_3 = Orient(Geometry=flatten(pline_3), Source=flatten(area_10.Centroid), Target=pt_6)  # -> Geometry, Transform
shift_4 = ShiftList(List=divide_11.Points, Shift=Slider(47, range=0..100), Wrap=True)
shift_5 = ShiftList(List=divide_13.Points, Shift=Slider(27, range=0..100), Wrap=True)
shift_6 = ShiftList(List=divide_15.Points, Shift=Slider(38, range=0..100), Wrap=True)
pt_7 = Point(hexgrid_4.Points)
pt_8 = Point(hexgrid_5.Points)
pt_9 = Point(hexgrid_6.Points)
ln_10 = Line(StartPoint=divide_10.Points, EndPoint=shift_4)
ln_11 = Line(StartPoint=divide_12.Points, EndPoint=shift_5)
ln_12 = Line(StartPoint=divide_14.Points, EndPoint=shift_6)
crv_15 = Curve(orient_2.Geometry)
crv_16 = Curve(orient_3.Geometry)
divide_16 = DivideCurve(Curve=ln_10, Count=expr("x-1", division_5), Kinks=False)  # -> Points, Tangents, Parameters
divide_17 = DivideCurve(Curve=ln_11, Count=expr("x-1", division_6), Kinks=False)  # -> Points, Tangents, Parameters
divide_18 = DivideCurve(Curve=ln_12, Count=expr("x-1", division_8), Kinks=False)  # -> Points, Tangents, Parameters
crv_17 = Curve(flatten(orient_2.Geometry))
flip_4 = FlipMatrix(Data=divide_16.Points)
flip_5 = FlipMatrix(Data=divide_17.Points)
flip_6 = FlipMatrix(Data=divide_18.Points)
lng = ListLength(List=crv_17)
crv_18 = Curve(flatten(orient_3.Geometry))
lng_2 = ListLength(List=crv_18)
pline_4 = PolyLine(Vertices=flip_4, Closed=Slider(1, range=0..1))
pline_5 = PolyLine(Vertices=flip_5, Closed=Slider(1, range=0..1))
division_11 = Division(A=lng, B=Slider(2, range=0..10))
pline_6 = PolyLine(Vertices=flip_6, Closed=Slider(1, range=0..1))
division_12 = Division(A=lng_2, B=Slider(2, range=0..10))
area_11 = Area(Geometry=pline_4)  # -> Area, Centroid
area_12 = Area(Geometry=pline_5)  # -> Area, Centroid
area_13 = Area(Geometry=pline_6)  # -> Area, Centroid
reduce = RandomReduce(List=crv_17, Reduction=division_11, Seed=Slider(4, range=0..10))
reduce_2 = RandomReduce(List=crv_18, Reduction=division_12, Seed=Slider(4, range=0..10))
orient_4 = Orient(Geometry=flatten(pline_4), Source=flatten(area_11.Centroid), Target=pt_7)  # -> Geometry, Transform
orient_5 = Orient(Geometry=flatten(pline_5), Source=flatten(area_12.Centroid), Target=pt_8)  # -> Geometry, Transform
orient_6 = Orient(Geometry=flatten(pline_6), Source=flatten(area_13.Centroid), Target=pt_9)  # -> Geometry, Transform
crv_19 = Curve(flatten(orient_4.Geometry))
crv_20 = Curve(orient_5.Geometry)
crv_21 = Curve(orient_6.Geometry)
lng_3 = ListLength(List=crv_19)
crv_22 = Curve(flatten(orient_6.Geometry))
division_13 = Division(A=lng_3, B=Slider(2, range=0..10))
crv_23 = Curve(flatten(orient_5.Geometry))
lng_4 = ListLength(List=crv_22)
lng_5 = ListLength(List=crv_23)
division_14 = Division(A=lng_4, B=Slider(2, range=0..10))
reduce_3 = RandomReduce(List=crv_19, Reduction=division_13, Seed=Slider(4, range=0..10))
division_15 = Division(A=lng_5, B=Slider(2, range=0..10))
reduce_4 = RandomReduce(List=crv_22, Reduction=division_14, Seed=Slider(4, range=0..10))
reduce_5 = RandomReduce(List=crv_23, Reduction=division_15, Seed=Slider(4, range=0..10))
