# Grasshopper definition LIBRARY_2D_Truchet-Pattern.gh (Grasshopper 1.0.7)

number_slider = Slider(2, range=0..10)
number_slider_2 = Slider(24, range=0..100)
pt = Point(Point(0, 0, 0))
square_grid_generator = SquareGridGenerator(origin_point=pt, cell_scale=number_slider, x_axis_extent=number_slider_2, y_axis_extent=number_slider_2)  # -> flatten(grid_cell_curves_2), flatten(grid_area_centroids)
item = ListItem(List=square_grid_generator.grid_area_centroids, Index=0, Wrap=True)
item_2 = ListItem(List=square_grid_generator.grid_cell_curves_2, Index=0, Wrap=True)
division = Division(A=number_slider, B=Slider(2, range=0..10))
explode = Explode(Curve=item_2, Recursive=True)  # -> Segments, Vertices
item_3 = ListItem(List=explode.Vertices, Index=0, Wrap=True)
rad = Radians(Degrees=Slider(90, range=0..100))
merge = Merge(
    Data1=Slider(0, range=0..100),
    Data2=Slider(90, range=0..100),
    Data3=Slider(180, range=0..1000),
    Data4=Slider(270, range=0..1000))
arc = Arc(Plane=item_3, Radius=division, Angle=rad)  # -> Arc, Length
lng = ListLength(List=square_grid_generator.grid_area_centroids)
arrpolar = PolarArray(Geometry=arc.Arc, Plane=item, Count=Slider(2, range=0..10), Angle=6.283185307)  # -> Geometry, Transform
repeat = RepeatData(Data=merge, Length=lng)
jitter = Jitter(List=repeat, Jitter=1, Seed=Slider(4, range=0..10))  # -> Values, Indices
group = Group(Objects=flatten(arrpolar.Geometry))
rotate = Rotate(Geometry=group, Angle=degrees(jitter.Values), Plane=item)  # -> Geometry, Transform
number_slider_3 = Slider(0.176, range=0..1)
move = Move(Geometry=rotate.Geometry, Motion=square_grid_generator.grid_area_centroids)  # -> Geometry, Transform
neg = Negative(Value=number_slider_3)
ungroup = Ungroup(Group=move.Geometry)
merge_2 = Merge(Data1=number_slider_3, Data2=neg)
offset = OffsetCurve(Curve=flatten(ungroup), Distance=graft(merge_2), Plane=PlaneXY(0, 0, 0), Corners=1)  # -> flatten(Curve)

# ==== cluster SquareGridGenerator: Grid Gen
y_axis_extent = ClusterInput()
x_axis_extent = ClusterInput()
in = ClusterInput()  # "---------------------"
origin_point = ClusterInput()
cell_scale = ClusterInput()
y_axis_extent_2 = Number(y_axis_extent)
x_axis_extent_2 = Number(x_axis_extent)
cell_scale_2 = Number(cell_scale)
origin_point_2 = Point(origin_point)
division = Division(XAxisExtent=x_axis_extent_2, B=cell_scale_2)
division_2 = Division(YAxisExtent=y_axis_extent_2, B=cell_scale_2)
sqgrid = Square(Plane=origin_point_2, Size=cell_scale_2, ExtentX=division, ExtentY=division_2)  # -> Cells, Points
grid_cell_curves = Curve(sqgrid.Cells)
area = Area(Geometry=grid_cell_curves)  # -> Area, GridAreaCentroids
grid_area_centroids = ClusterOutput(area.GridAreaCentroids)
grid_cell_curves_2 = ClusterOutput(grid_cell_curves)
