# Grasshopper definition LIBRARY_2D_Vectorized-Curve-Attractor-Scaled.gh (Grasshopper 1.0.7)

number_slider = Slider(24, range=0..100)
pt = Point(Point(0, 0, 0))
hex_grid_generator = HexGridGenerator(origin_point=pt, cell_scale=Slider(0.6, range=0..10), x_axis_extent=number_slider, y_axis_extent=number_slider)  # -> grid_cell_curves_2, grid_area_centroids
crv = Curve(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)
vectorized_curve_attractor = VectorizedCurveAttractor(
    attractor_curve=crv,
    grid_cell_curves=hex_grid_generator.grid_cell_curves_2,
    scale_close_point=Slider(0, range=0..10),
    scale_far_point=Slider(7.05, range=0..10))  # -> pattern_curves_2, pattern_area_centroids_2
scale = Scale(
    Geometry=vectorized_curve_attractor.pattern_curves_2,
    Center=vectorized_curve_attractor.pattern_area_centroids_2,
    Factor=Slider(0.66, range=0..1))  # -> Geometry, Transform

# ==== cluster VectorizedCurveAttractor
grid_cell_curves = ClusterInput()
scale_far_point = ClusterInput()
attractor_curve = ClusterInput()
attractor_curve_2 = Curve(attractor_curve)
scale_close_point = ClusterInput()
grid_cell_curves_2 = Curve(grid_cell_curves)
scale_far_point_2 = Number(scale_far_point)
scale_close_point_2 = Number(scale_close_point)
disc = Discontinuity(Curve=grid_cell_curves_2, Level=1)  # -> Points, Parameters
crv_cp = CurveClosestPoint(Point=disc.Points, Curve=attractor_curve_2)  # -> Point, Parameter, Distance
vec2pt = Vector2Pt(PointA=disc.Points, PointB=crv_cp.Point, Unitize=False)  # -> Vector, Length
bnd = Bounds(Numbers=flatten(vec2pt.Length))
dom = ConstructDomain(DomainStart=scale_close_point_2, DomainEnd=scale_far_point_2)
remap = RemapNumbers(Value=vec2pt.Length, Source=bnd, Target=dom)  # -> Mapped, Clipped
amp = Amplitude(Vector=vec2pt.Vector, Amplitude=remap.Mapped)
move = Move(Geometry=disc.Points, Motion=amp)  # -> Geometry, Transform
pline = PolyLine(Vertices=move.Geometry, Closed=True)
pattern_curves = Curve(pline)
area = Area(Geometry=pattern_curves)  # -> Area, Centroid
pattern_area_centroids = Point(area.Centroid)
pattern_area_centroids_2 = ClusterOutput(pattern_area_centroids)
pattern_curves_2 = ClusterOutput(pattern_curves)

# ==== cluster HexGridGenerator: Grid Gen
y_axis_extent = ClusterInput()
x_axis_extent = ClusterInput()
in = ClusterInput()  # "---------------------"
origin_point = ClusterInput()
cell_scale = ClusterInput()
y_axis_extent_2 = Number(y_axis_extent)
x_axis_extent_2 = Number(x_axis_extent)
cell_scale_2 = Number(cell_scale)
origin_point_2 = Point(origin_point)
division = Division(XAxisExtent=x_axis_extent_2, B=cell_scale_2)
division_2 = Division(YAxisExtent=y_axis_extent_2, B=cell_scale_2)
hexgrid = Hexagonal(Plane=origin_point_2, Size=cell_scale_2, ExtentX=division, ExtentY=division_2)  # -> Cells, Points
grid_cell_curves = Curve(hexgrid.Cells)
area = Area(Geometry=grid_cell_curves)  # -> Area, GridAreaCentroids
grid_area_centroids = ClusterOutput(area.GridAreaCentroids)
grid_cell_curves_2 = ClusterOutput(grid_cell_curves)
