# Grasshopper definition LIBRARY_2D_Attractors.gh (Grasshopper 1.0.7)

number_slider = Slider(24, range=0..100)
number_slider_2 = Slider(24, range=0..100)
number_slider_3 = Slider(24, range=0..100)
pt = Point(Point(0, 0, 0))
pt_2 = Point(Point(0, 0, 0))
pt_3 = Point(Point(0, 0, 0))
hex_grid_generator = HexGridGenerator(origin_point=pt, cell_scale=Slider(2, range=0..10), x_axis_extent=number_slider, y_axis_extent=number_slider)  # -> flatten(grid_cell_curves_2), flatten(grid_area_centroids)
hex_grid_generator_2 = HexGridGenerator(origin_point=pt_2, cell_scale=Slider(2, range=0..10), x_axis_extent=number_slider_2, y_axis_extent=number_slider_2)  # -> flatten(grid_cell_curves_2), flatten(grid_area_centroids)
hex_grid_generator_3 = HexGridGenerator(origin_point=pt_3, cell_scale=Slider(2, range=0..10), x_axis_extent=number_slider_3, y_axis_extent=number_slider_3)  # -> flatten(grid_cell_curves_2), flatten(grid_area_centroids)
pt_4 = Point(Point(26.01133139, 29.7029237, 0))
pt_5 = Point(Point(26.01133139, 29.7029237, 0))
pt_6 = Point(Point(26.01133139, 29.7029237, 0))
point_attractor = PointAttractor(A_2=pt_4, B_2=hex_grid_generator.grid_area_centroids, A=Slider(0.8, range=0..1), B=Slider(0.2, range=0..1))
point_attractor_2 = PointAttractor(A_2=pt_5, B_2=hex_grid_generator_2.grid_area_centroids, A=Slider(0.8, range=0..1), B=Slider(0.2, range=0..1))
point_attractor_3 = PointAttractor(A_2=pt_6, B_2=hex_grid_generator_3.grid_area_centroids, A=Slider(0.8, range=0..1), B=Slider(0.2, range=0..1))
point_attractor_4 = PointAttractor(A_2=pt_5, B_2=hex_grid_generator_2.grid_area_centroids, A=Slider(21, range=0..100), B=Slider(0, range=0..100))
scale = Scale(Geometry=hex_grid_generator.grid_cell_curves_2, Center=hex_grid_generator.grid_area_centroids, Factor=point_attractor)  # -> Geometry, Transform
scale_2 = Scale(
    Geometry=hex_grid_generator_2.grid_cell_curves_2,
    Center=hex_grid_generator_2.grid_area_centroids,
    Factor=point_attractor_2)  # -> Geometry, Transform
scale_3 = Scale(
    Geometry=hex_grid_generator_3.grid_cell_curves_2,
    Center=hex_grid_generator_3.grid_area_centroids,
    Factor=point_attractor_3)  # -> Geometry, Transform
area = Area(Geometry=scale_2.Geometry)  # -> Area, Centroid
crv = Curve(scale_3.Geometry)
lng = ListLength(List=scale.Geometry)
division = Division(A=lng, B=Slider(4, range=0..10))
rotate = Rotate(Geometry=scale_2.Geometry, Angle=degrees(point_attractor_4), Plane=area.Centroid)  # -> Geometry, Transform
reduce = RandomReduce(List=scale.Geometry, Reduction=division, Seed=1)
crv_2 = Curve(rotate.Geometry)
crv_3 = Curve(reduce)
number_slider_4 = Slider(24, range=0..100)
number_slider_5 = Slider(24, range=0..100)
number_slider_6 = Slider(24, range=0..100)
pt_7 = Point(Point(0, 0, 0))
pt_8 = Point(Point(0, 0, 0))
pt_9 = Point(Point(0, 0, 0))
hex_grid_generator_4 = HexGridGenerator(origin_point=pt_7, cell_scale=Slider(2, range=0..10), x_axis_extent=number_slider_4, y_axis_extent=number_slider_4)  # -> flatten(grid_cell_curves_2), flatten(grid_area_centroids)
hex_grid_generator_5 = HexGridGenerator(origin_point=pt_8, cell_scale=Slider(2, range=0..10), x_axis_extent=number_slider_5, y_axis_extent=number_slider_5)  # -> flatten(grid_cell_curves_2), flatten(grid_area_centroids)
hex_grid_generator_6 = HexGridGenerator(origin_point=pt_9, cell_scale=Slider(2, range=0..10), x_axis_extent=number_slider_6, y_axis_extent=number_slider_6)  # -> flatten(grid_cell_curves_2), flatten(grid_area_centroids)
crv_4 = Curve(<curve referenced from the Rhino model>)
crv_5 = Curve(<curve referenced from the Rhino model>)
crv_6 = Curve(<curve referenced from the Rhino model>)
curve_attractor = CurveAttractor(C=crv_4, P=hex_grid_generator_5.grid_area_centroids, A=Slider(0.8, range=0..1), B=Slider(0.2, range=0..1))  # -> R, points_on_curve_2
curve_attractor_2 = CurveAttractor(C=crv_5, P=hex_grid_generator_4.grid_area_centroids, A=Slider(0.8, range=0..1), B=Slider(0.2, range=0..1))  # -> R, points_on_curve_2
curve_attractor_3 = CurveAttractor(C=crv_6, P=hex_grid_generator_6.grid_area_centroids, A=Slider(0.8, range=0..1), B=Slider(0.2, range=0..1))  # -> R, points_on_curve_2
scale_4 = Scale(
    Geometry=hex_grid_generator_4.grid_cell_curves_2,
    Center=hex_grid_generator_4.grid_area_centroids,
    Factor=curve_attractor_2.R)  # -> Geometry, Transform
scale_5 = Scale(
    Geometry=hex_grid_generator_5.grid_cell_curves_2,
    Center=hex_grid_generator_5.grid_area_centroids,
    Factor=curve_attractor.R)  # -> Geometry, Transform
scale_6 = Scale(
    Geometry=hex_grid_generator_6.grid_cell_curves_2,
    Center=hex_grid_generator_6.grid_area_centroids,
    Factor=curve_attractor_3.R)  # -> Geometry, Transform
curve_attractor_4 = CurveAttractor(C=crv_4, P=hex_grid_generator_5.grid_area_centroids, A=Slider(56, range=0..100), B=Slider(0, range=0..100))  # -> R, points_on_curve_2
area_2 = Area(Geometry=scale_5.Geometry)  # -> Area, Centroid
crv_7 = Curve(scale_6.Geometry)
lng_2 = ListLength(List=scale_4.Geometry)
division_2 = Division(A=lng_2, B=Slider(4, range=0..10))
rotate_2 = Rotate(Geometry=scale_5.Geometry, Angle=degrees(curve_attractor_4.R), Plane=area_2.Centroid)  # -> Geometry, Transform
reduce_2 = RandomReduce(List=scale_4.Geometry, Reduction=division_2, Seed=1)
crv_8 = Curve(rotate_2.Geometry)
crv_9 = Curve(reduce_2)
number_slider_7 = Slider(24, range=0..100)
pt_10 = Point(Point(0, 0, 0))
number_slider_8 = Slider(24, range=0..100)
pt_11 = Point(Point(0, 0, 0))
hex_grid_generator_7 = HexGridGenerator(origin_point=pt_10, cell_scale=Slider(2, range=0..10), x_axis_extent=number_slider_7, y_axis_extent=number_slider_7)  # -> flatten(grid_cell_curves_2), flatten(grid_area_centroids)
hex_grid_generator_8 = HexGridGenerator(origin_point=pt_11, cell_scale=Slider(2, range=0..10), x_axis_extent=number_slider_8, y_axis_extent=number_slider_8)  # -> flatten(grid_cell_curves_2), flatten(grid_area_centroids)
number_slider_9 = Slider(0.2, range=0..1)
number_slider_10 = Slider(0.8, range=0..1)
number_slider_11 = Slider(0.8, range=0..1)
number_slider_12 = Slider(0.2, range=0..1)
crv_10 = Curve(<curve referenced from the Rhino model>)
pt_12 = Point(Point(26.01133139, 29.7029237, 0))
point_attractor_5 = PointAttractor(A_2=pt_12, B_2=hex_grid_generator_8.grid_area_centroids, A=number_slider_11, B=number_slider_12)
point_attractor_6 = PointAttractor(A_2=pt_12, B_2=hex_grid_generator_8.grid_area_centroids, A=number_slider_12, B=number_slider_11)
curve_attractor_5 = CurveAttractor(C=crv_10, P=hex_grid_generator_7.grid_area_centroids, A=number_slider_9, B=number_slider_10)  # -> R, points_on_curve_2
curve_attractor_6 = CurveAttractor(C=crv_10, P=hex_grid_generator_7.grid_area_centroids, A=number_slider_10, B=number_slider_9)  # -> R, points_on_curve_2
scale_nu = ScaleNU(
    Geometry=hex_grid_generator_8.grid_cell_curves_2,
    Plane=hex_grid_generator_8.grid_area_centroids,
    ScaleX=point_attractor_5,
    ScaleY=point_attractor_6,
    ScaleZ=1)  # -> Geometry, Transform
scale_nu_2 = ScaleNU(
    Geometry=hex_grid_generator_7.grid_cell_curves_2,
    Plane=hex_grid_generator_7.grid_area_centroids,
    ScaleX=curve_attractor_6.R,
    ScaleY=curve_attractor_5.R,
    ScaleZ=1)  # -> Geometry, Transform
crv_11 = Curve(scale_nu.Geometry)
crv_12 = Curve(scale_nu_2.Geometry)
number_slider_13 = Slider(24, range=0..100)
pt_13 = Point(Point(0, 0, 0))
hex_grid_generator_9 = HexGridGenerator(origin_point=pt_13, cell_scale=Slider(1, range=0..10), x_axis_extent=number_slider_13, y_axis_extent=number_slider_13)  # -> flatten(grid_cell_curves_2), grid_area_centroids
crv_13 = Curve(<curve referenced from the Rhino model>)
vectorized_curve_attractor = VectorizedCurveAttractor(
    attractor_curve=crv_13,
    grid_cell_curves=hex_grid_generator_9.grid_cell_curves_2,
    scale_close_point=Slider(0, range=0..10),
    scale_far_point=Slider(7.36, range=0..10))  # -> flatten(pattern_curves_2), flatten(pattern_area_centroids_2)
crv_14 = Curve(<curve referenced from the Rhino model>)
crv_15 = Curve(vectorized_curve_attractor.pattern_curves_2)
curve_attractor_7 = CurveAttractor(C=crv_14, P=vectorized_curve_attractor.pattern_area_centroids_2, A=Slider(0.8, range=0..1), B=Slider(0.2, range=0..1))  # -> R, points_on_curve_2
scale_7 = Scale(Geometry=crv_15, Center=vectorized_curve_attractor.pattern_area_centroids_2, Factor=curve_attractor_7.R)  # -> Geometry, Transform
crv_16 = Curve(scale_7.Geometry)

# ==== cluster HexGridGenerator: Grid Gen
y_axis_extent = ClusterInput()
x_axis_extent = ClusterInput()
in = ClusterInput()  # "---------------------"
origin_point = ClusterInput()
cell_scale = ClusterInput()
y_axis_extent_2 = Number(y_axis_extent)
x_axis_extent_2 = Number(x_axis_extent)
cell_scale_2 = Number(cell_scale)
origin_point_2 = Point(origin_point)
division = Division(XAxisExtent=x_axis_extent_2, B=cell_scale_2)
division_2 = Division(YAxisExtent=y_axis_extent_2, B=cell_scale_2)
hexgrid = Hexagonal(Plane=origin_point_2, Size=cell_scale_2, ExtentX=division, ExtentY=division_2)  # -> Cells, Points
grid_cell_curves = Curve(hexgrid.Cells)
area = Area(Geometry=grid_cell_curves)  # -> Area, GridAreaCentroids
grid_area_centroids = ClusterOutput(area.GridAreaCentroids)
grid_cell_curves_2 = ClusterOutput(grid_cell_curves)

# ==== cluster PointAttractor: Utility
A = ClusterInput()
x = ClusterInput()
A_2 = ClusterInput()
B = ClusterInput()
B_2 = ClusterInput()
dist = Distance(PointA=A_2, PointB=B_2)
dom = ConstructDomain(DomainStart=A, DomainEnd=B)
bnd = Bounds(Numbers=dist)
remap = RemapNumbers(Value=dist, Source=bnd, Target=dom)  # -> Mapped, Clipped
R = ClusterOutput(remap.Mapped)

# ==== cluster CurveAttractor: Utility
C = ClusterInput()
P = ClusterInput()
x = ClusterInput()
A = ClusterInput()
B = ClusterInput()
crv_cp = CurveClosestPoint(Point=P, Curve=C)  # -> Point, Parameter, Distance
dom = ConstructDomain(DomainStart=A, DomainEnd=B)
bnd = Bounds(Numbers=crv_cp.Distance)
remap = RemapNumbers(Value=crv_cp.Distance, Source=bnd, Target=dom)  # -> Mapped, Clipped
R = ClusterOutput(remap.Mapped)
points_on_curve = Point(crv_cp.Point)
points_on_curve_2 = ClusterOutput(points_on_curve)

# ==== cluster VectorizedCurveAttractor
grid_cell_curves = ClusterInput()
scale_far_point = ClusterInput()
attractor_curve = ClusterInput()
attractor_curve_2 = Curve(attractor_curve)
scale_close_point = ClusterInput()
grid_cell_curves_2 = Curve(grid_cell_curves)
scale_far_point_2 = Number(scale_far_point)
scale_close_point_2 = Number(scale_close_point)
disc = Discontinuity(Curve=grid_cell_curves_2, Level=1)  # -> Points, Parameters
crv_cp = CurveClosestPoint(Point=disc.Points, Curve=attractor_curve_2)  # -> Point, Parameter, Distance
vec2pt = Vector2Pt(PointA=disc.Points, PointB=crv_cp.Point, Unitize=False)  # -> Vector, Length
bnd = Bounds(Numbers=flatten(vec2pt.Length))
dom = ConstructDomain(DomainStart=scale_close_point_2, DomainEnd=scale_far_point_2)
remap = RemapNumbers(Value=vec2pt.Length, Source=bnd, Target=dom)  # -> Mapped, Clipped
amp = Amplitude(Vector=vec2pt.Vector, Amplitude=remap.Mapped)
move = Move(Geometry=disc.Points, Motion=amp)  # -> Geometry, Transform
pline = PolyLine(Vertices=move.Geometry, Closed=True)
pattern_curves = Curve(pline)
area = Area(Geometry=pattern_curves)  # -> Area, Centroid
pattern_area_centroids = Point(area.Centroid)
pattern_area_centroids_2 = ClusterOutput(pattern_area_centroids)
pattern_curves_2 = ClusterOutput(pattern_curves)
