# Grasshopper definition LIBRARY_2D_Divided-Polygon.gh (Grasshopper 1.0.7)

number_slider = Slider(24, range=0..100)
number_slider_2 = Slider(24, range=0..100)
number_slider_3 = Slider(24, range=0..100)
number_slider_4 = Slider(24, range=0..100)
number_slider_5 = Slider(24, range=0..100)
number_slider_6 = Slider(24, range=0..100)
number_slider_7 = Slider(24, range=0..100)
number_slider_8 = Slider(24, range=0..100)
pt = Point(Point(0, 0, 0))
pt_2 = Point(Point(0, 0, 0))
pt_3 = Point(Point(0, 0, 0))
pt_4 = Point(Point(0, 0, 0))
pt_5 = Point(Point(0, 0, 0))
pt_6 = Point(Point(0, 0, 0))
pt_7 = Point(Point(0, 0, 0))
pt_8 = Point(Point(0, 0, 0))
hex_grid_generator = HexGridGenerator(origin_point=pt_8, cell_scale=Slider(2, range=0..10), x_axis_extent=number_slider_8, y_axis_extent=number_slider_8)  # -> grid_cell_curves_2, grid_area_centroids, points_at_grid_cell_centers_2
hex_grid_generator_2 = HexGridGenerator(origin_point=pt_3, cell_scale=Slider(1, range=0..1), x_axis_extent=number_slider_3, y_axis_extent=number_slider_3)  # -> grid_cell_curves_2, grid_area_centroids, points_at_grid_cell_centers_2
hex_grid_generator_3 = HexGridGenerator(origin_point=pt_7, cell_scale=Slider(2, range=0..10), x_axis_extent=number_slider_7, y_axis_extent=number_slider_7)  # -> grid_cell_curves_2, grid_area_centroids, points_at_grid_cell_centers_2
hex_grid_generator_4 = HexGridGenerator(origin_point=pt_2, cell_scale=Slider(2, range=0..10), x_axis_extent=number_slider_2, y_axis_extent=number_slider_2)  # -> grid_cell_curves_2, grid_area_centroids, points_at_grid_cell_centers_2
hex_grid_generator_5 = HexGridGenerator(origin_point=pt_6, cell_scale=Slider(2, range=0..10), x_axis_extent=number_slider_6, y_axis_extent=number_slider_6)  # -> grid_cell_curves_2, grid_area_centroids, points_at_grid_cell_centers_2
hex_grid_generator_6 = HexGridGenerator(origin_point=pt_5, cell_scale=Slider(1, range=0..1), x_axis_extent=number_slider_5, y_axis_extent=number_slider_5)  # -> grid_cell_curves_2, grid_area_centroids, points_at_grid_cell_centers_2
hex_grid_generator_7 = HexGridGenerator(origin_point=pt, cell_scale=Slider(1, range=0..1), x_axis_extent=number_slider, y_axis_extent=number_slider)  # -> grid_cell_curves_2, grid_area_centroids, points_at_grid_cell_centers_2
hex_grid_generator_8 = HexGridGenerator(origin_point=pt_4, cell_scale=Slider(1, range=0..1), x_axis_extent=number_slider_4, y_axis_extent=number_slider_4)  # -> grid_cell_curves_2, grid_area_centroids, points_at_grid_cell_centers_2
pt_9 = Point(hex_grid_generator_7.grid_area_centroids)
crv = Curve(hex_grid_generator_2.grid_cell_curves_2)
crv_2 = Curve(hex_grid_generator_8.grid_cell_curves_2)
pt_10 = Point(hex_grid_generator_4.grid_area_centroids)
crv_3 = Curve(hex_grid_generator_5.grid_cell_curves_2)
crv_4 = Curve(hex_grid_generator.grid_cell_curves_2)
crv_5 = Curve(hex_grid_generator_7.grid_cell_curves_2)
pt_11 = Point(hex_grid_generator_2.grid_area_centroids)
pt_12 = Point(hex_grid_generator_8.grid_area_centroids)
crv_6 = Curve(hex_grid_generator_6.grid_cell_curves_2)
pt_13 = Point(hex_grid_generator_6.grid_area_centroids)
crv_7 = Curve(hex_grid_generator_4.grid_cell_curves_2)
pt_14 = Point(hex_grid_generator_5.grid_area_centroids)
crv_8 = Curve(hex_grid_generator_3.grid_cell_curves_2)
pt_15 = Point(hex_grid_generator_3.grid_area_centroids)
pt_16 = Point(hex_grid_generator.grid_area_centroids)
pattern_a = PatternA(grid_cell_curves=crv_5, grid_area_centroids=pt_9)
pattern_b = PatternB(grid_cell_curves=crv, grid_area_centroids=pt_11)
pattern_c = PatternC(grid_cell_curves=crv_2, grid_area_centroids=pt_12)
pattern_d = PatternD(grid_cell_curves=crv_6, grid_area_centroids=pt_13)
pattern_e = PatternE(grid_cell_curves=crv_7, grid_area_centroids=pt_10)
pattern_f = PatternF(grid_cell_curves=crv_3, grid_area_centroids=pt_14)
pattern_g = PatternG(grid_cell_curves=crv_8, grid_area_centroids=pt_15)
pattern_h = PatternH(grid_cell_curves=crv_4, grid_area_centroids=pt_16)
crv_9 = Curve(flatten(pattern_c))
crv_10 = Curve(flatten(pattern_d))
crv_11 = Curve(flatten(pattern_g))
crv_12 = Curve(flatten(pattern_h))
crv_13 = Curve(flatten(pattern_a))
crv_14 = Curve(flatten(pattern_e))
crv_15 = Curve(flatten(pattern_b))
crv_16 = Curve(flatten(pattern_f))
crv_17 = Curve(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)
crv_18 = Curve(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)
crv_19 = Curve(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)
crv_20 = Curve(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)
crv_21 = Curve(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)
crv_22 = Curve(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)
crv_23 = Curve(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)
crv_24 = Curve(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)
area = Area(Geometry=crv_9)  # -> Area, Centroid
area_2 = Area(Geometry=crv_10)  # -> Area, Centroid
area_3 = Area(Geometry=crv_11)  # -> Area, Centroid
area_4 = Area(Geometry=crv_12)  # -> Area, Centroid
area_5 = Area(Geometry=crv_13)  # -> Area, Centroid
area_6 = Area(Geometry=crv_14)  # -> Area, Centroid
area_7 = Area(Geometry=crv_15)  # -> Area, Centroid
area_8 = Area(Geometry=crv_16)  # -> Area, Centroid
curve_attractor = CurveAttractor(C=crv_17, P=area.Centroid, A=Slider(0.8, range=0..1), B=Slider(0.2, range=0..1))  # -> R, points_on_curve_2
curve_attractor_2 = CurveAttractor(C=crv_18, P=area_2.Centroid, A=Slider(0.8, range=0..1), B=Slider(0.2, range=0..1))  # -> R, points_on_curve_2
curve_attractor_3 = CurveAttractor(C=crv_19, P=area_3.Centroid, A=Slider(0.8, range=0..1), B=Slider(0.2, range=0..1))  # -> R, points_on_curve_2
curve_attractor_4 = CurveAttractor(C=crv_20, P=area_4.Centroid, A=Slider(0.8, range=0..1), B=Slider(0.2, range=0..1))  # -> R, points_on_curve_2
curve_attractor_5 = CurveAttractor(C=crv_21, P=area_5.Centroid, A=Slider(0.8, range=0..1), B=Slider(0.2, range=0..1))  # -> R, points_on_curve_2
curve_attractor_6 = CurveAttractor(C=crv_22, P=area_6.Centroid, A=Slider(0.8, range=0..1), B=Slider(0.2, range=0..1))  # -> R, points_on_curve_2
curve_attractor_7 = CurveAttractor(C=crv_23, P=area_7.Centroid, A=Slider(0.8, range=0..1), B=Slider(0.2, range=0..1))  # -> R, points_on_curve_2
curve_attractor_8 = CurveAttractor(C=crv_24, P=area_8.Centroid, A=Slider(0.8, range=0..1), B=Slider(0.2, range=0..1))  # -> R, points_on_curve_2
scale = Scale(Geometry=crv_9, Center=area.Centroid, Factor=curve_attractor.R)  # -> Geometry, Transform
scale_2 = Scale(Geometry=crv_10, Center=area_2.Centroid, Factor=curve_attractor_2.R)  # -> Geometry, Transform
scale_3 = Scale(Geometry=crv_11, Center=area_3.Centroid, Factor=curve_attractor_3.R)  # -> Geometry, Transform
scale_4 = Scale(Geometry=crv_12, Center=area_4.Centroid, Factor=curve_attractor_4.R)  # -> Geometry, Transform
scale_5 = Scale(Geometry=crv_13, Center=area_5.Centroid, Factor=curve_attractor_5.R)  # -> Geometry, Transform
scale_6 = Scale(Geometry=crv_14, Center=area_6.Centroid, Factor=curve_attractor_6.R)  # -> Geometry, Transform
scale_7 = Scale(Geometry=crv_15, Center=area_7.Centroid, Factor=curve_attractor_7.R)  # -> Geometry, Transform
scale_8 = Scale(Geometry=crv_16, Center=area_8.Centroid, Factor=curve_attractor_8.R)  # -> Geometry, Transform
lng = ListLength(List=scale.Geometry)
lng_2 = ListLength(List=scale_2.Geometry)
lng_3 = ListLength(List=scale_3.Geometry)
lng_4 = ListLength(List=scale_4.Geometry)
lng_5 = ListLength(List=scale_5.Geometry)
lng_6 = ListLength(List=scale_6.Geometry)
lng_7 = ListLength(List=scale_7.Geometry)
lng_8 = ListLength(List=scale_8.Geometry)
division = Division(A=lng, B=Slider(2, range=0..10))
division_2 = Division(A=lng_2, B=Slider(2, range=0..10))
division_3 = Division(A=lng_3, B=Slider(2, range=0..10))
division_4 = Division(A=lng_4, B=Slider(2, range=0..10))
division_5 = Division(A=lng_5, B=Slider(2, range=0..10))
division_6 = Division(A=lng_6, B=Slider(2, range=0..10))
division_7 = Division(A=lng_7, B=Slider(2, range=0..10))
division_8 = Division(A=lng_8, B=Slider(2, range=0..10))
reduce = RandomReduce(List=scale.Geometry, Reduction=division, Seed=1)
reduce_2 = RandomReduce(List=scale_2.Geometry, Reduction=division_2, Seed=1)
reduce_3 = RandomReduce(List=scale_3.Geometry, Reduction=division_3, Seed=1)
reduce_4 = RandomReduce(List=scale_4.Geometry, Reduction=division_4, Seed=1)
reduce_5 = RandomReduce(List=scale_5.Geometry, Reduction=division_5, Seed=1)
reduce_6 = RandomReduce(List=scale_6.Geometry, Reduction=division_6, Seed=1)
reduce_7 = RandomReduce(List=scale_7.Geometry, Reduction=division_7, Seed=1)
reduce_8 = RandomReduce(List=scale_8.Geometry, Reduction=division_8, Seed=1)
number_slider_9 = Slider(24, range=0..100)
pt_17 = Point(Point(0, 0, 0))
hex_grid_generator_9 = HexGridGenerator(origin_point=pt_17, cell_scale=Slider(1, range=0..1), x_axis_extent=number_slider_9, y_axis_extent=number_slider_9)  # -> flatten(grid_cell_curves_2), flatten(grid_area_centroids), points_at_grid_cell_centers_2
crv_25 = Curve(hex_grid_generator_9.grid_cell_curves_2)
item = ListItem(List=crv_25, Index=0, Wrap=True)
explode = Explode(Curve=item, Recursive=True)  # -> Segments, Vertices
disc = Discontinuity(Curve=item, Level=1)  # -> Points, Parameters
area_9 = Area(Geometry=item)  # -> Area, Centroid
dispatch = Dispatch(List=disc.Points, DispatchPattern=[True, False])  # -> ListA, ListB
midpt = CurveMiddle(Curve=explode.Segments)
dispatch_2 = Dispatch(List=midpt, DispatchPattern=[True, False])  # -> ListA, ListB
area_centroid = Point(area_9.Centroid)
all_vertex = Point(disc.Points)
split_vertex = Point(dispatch.ListA)
all_midpoint = Point(midpt)
split_midpoint = Point(dispatch_2.ListA)
ln = Line(StartPoint=all_vertex, EndPoint=area_centroid)
ln_2 = Line(StartPoint=all_midpoint, EndPoint=area_centroid)
ln_3 = Line(StartPoint=split_vertex, EndPoint=area_centroid)
ln_4 = Line(StartPoint=split_midpoint, EndPoint=area_centroid)

split_midpoint_2 = Curve(ln_4)
all_vertex_2 = Curve(ln)
all_midpoint_2 = Curve(ln_2)
split_vertex_2 = Curve(ln_3)

vert_mp = Curve([all_vertex_2, all_midpoint_2])
vert_split_mp = Curve([all_vertex_2, split_midpoint_2])
split_vert_midpoint = Curve([all_midpoint_2, split_vertex_2])
split_vert_split_mp = Curve([split_vertex_2, split_midpoint_2])

ln_5 = Line(StartPoint=area_centroid, EndPoint=hex_grid_generator_9.grid_area_centroids)
srfsplit = SurfaceSplit(Surface=item, Curves=all_vertex_2)
move = Move(Geometry=srfsplit, Motion=graft(ln_5))  # -> flatten(Geometry), Transform
crv_26 = Curve(move.Geometry)
crv_27 = Curve(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)
area_10 = Area(Geometry=crv_26)  # -> Area, Centroid
curve_attractor_9 = CurveAttractor(C=crv_27, P=area_10.Centroid, A=Slider(0.8, range=0..1), B=Slider(0.2, range=0..1))  # -> R, points_on_curve_2
scale_9 = Scale(Geometry=crv_26, Center=area_10.Centroid, Factor=curve_attractor_9.R)  # -> Geometry, Transform

# ==== cluster HexGridGenerator: Grid Gen
y_axis_extent = ClusterInput()
x_axis_extent = ClusterInput()
in = ClusterInput()  # "---------------------"
origin_point = ClusterInput()
cell_scale = ClusterInput()
y_axis_extent_2 = Number(y_axis_extent)
x_axis_extent_2 = Number(x_axis_extent)
cell_scale_2 = Number(cell_scale)
origin_point_2 = Point(origin_point)
division = Division(XAxisExtent=x_axis_extent_2, B=cell_scale_2)
division_2 = Division(YAxisExtent=y_axis_extent_2, B=cell_scale_2)
hexgrid = Hexagonal(Plane=origin_point_2, Size=cell_scale_2, ExtentX=division, ExtentY=division_2)  # -> Cells, Points
points_at_grid_cell_centers = Point(hexgrid.Points)
grid_cell_curves = Curve(hexgrid.Cells)
area = Area(Geometry=grid_cell_curves)  # -> Area, GridAreaCentroids
grid_area_centroids = ClusterOutput(area.GridAreaCentroids)
points_at_grid_cell_centers_2 = ClusterOutput(points_at_grid_cell_centers)
grid_cell_curves_2 = ClusterOutput(grid_cell_curves)

# ==== cluster CurveAttractor: Utility
C = ClusterInput()
P = ClusterInput()
x = ClusterInput()
A = ClusterInput()
B = ClusterInput()
crv_cp = CurveClosestPoint(Point=P, Curve=C)  # -> Point, Parameter, Distance
dom = ConstructDomain(DomainStart=A, DomainEnd=B)
bnd = Bounds(Numbers=crv_cp.Distance)
remap = RemapNumbers(Value=crv_cp.Distance, Source=bnd, Target=dom)  # -> Mapped, Clipped
R = ClusterOutput(remap.Mapped)
points_on_curve = Point(crv_cp.Point)
points_on_curve_2 = ClusterOutput(points_on_curve)

# ==== cluster PatternH: Pattern Geometry
grid_area_centroids = ClusterInput()
grid_cell_curves = ClusterInput()
grid_area_centroids_2 = Point(flatten(grid_area_centroids))
grid_cell_curves_2 = Curve(flatten(grid_cell_curves))
item = ListItem(List=grid_cell_curves_2, Index=0, Wrap=True)
explode = Explode(Curve=item, Recursive=True)  # -> Segments, Vertices
disc = Discontinuity(Curve=item, Level=1)  # -> Points, Parameters
area = Area(Geometry=item)  # -> Area, Centroid
dispatch = Dispatch(List=disc.Points, DispatchPattern=[True, False])  # -> ListA, ListB
midpt = CurveMiddle(Curve=explode.Segments)
dispatch_2 = Dispatch(List=midpt, DispatchPattern=[True, False])  # -> ListA, ListB
area_centroid = Point(area.Centroid)
all_vertex = Point(disc.Points)
all_midpoint = Point(midpt)
split_vertex = Point(dispatch.ListA)
split_midpoint = Point(dispatch_2.ListA)
ln = Line(StartPoint=all_vertex, EndPoint=area_centroid)
ln_2 = Line(StartPoint=all_midpoint, EndPoint=area_centroid)
ln_3 = Line(StartPoint=split_vertex, EndPoint=area_centroid)
ln_4 = Line(StartPoint=split_midpoint, EndPoint=area_centroid)

split_midpoint_2 = Curve(ln_4)
all_vertex_2 = Curve(ln)
all_midpoint_2 = Curve(ln_2)
split_vertex_2 = Curve(ln_3)

vert_mp = Curve([all_vertex_2, all_midpoint_2])
vert_split_mp = Curve([all_vertex_2, split_midpoint_2])
split_vert_midpoint = Curve([all_midpoint_2, split_vertex_2])
split_vert_split_mp = Curve([split_vertex_2, split_midpoint_2])

ln_5 = Line(StartPoint=area_centroid, EndPoint=grid_area_centroids_2)
srfsplit = SurfaceSplit(Surface=item, Curves=split_vert_split_mp)
move = Move(Geometry=srfsplit, Motion=graft(ln_5))  # -> Geometry, Transform
pattern_curves = Curve(move.Geometry)
pattern_curves_2 = ClusterOutput(pattern_curves)

# ==== cluster PatternG: Pattern Geometry
grid_area_centroids = ClusterInput()
grid_cell_curves = ClusterInput()
grid_area_centroids_2 = Point(flatten(grid_area_centroids))
grid_cell_curves_2 = Curve(flatten(grid_cell_curves))
item = ListItem(List=grid_cell_curves_2, Index=0, Wrap=True)
explode = Explode(Curve=item, Recursive=True)  # -> Segments, Vertices
disc = Discontinuity(Curve=item, Level=1)  # -> Points, Parameters
area = Area(Geometry=item)  # -> Area, Centroid
dispatch = Dispatch(List=disc.Points, DispatchPattern=[True, False])  # -> ListA, ListB
midpt = CurveMiddle(Curve=explode.Segments)
dispatch_2 = Dispatch(List=midpt, DispatchPattern=[True, False])  # -> ListA, ListB
area_centroid = Point(area.Centroid)
all_vertex = Point(disc.Points)
all_midpoint = Point(midpt)
split_vertex = Point(dispatch.ListA)
split_midpoint = Point(dispatch_2.ListA)
ln = Line(StartPoint=all_vertex, EndPoint=area_centroid)
ln_2 = Line(StartPoint=all_midpoint, EndPoint=area_centroid)
ln_3 = Line(StartPoint=split_vertex, EndPoint=area_centroid)
ln_4 = Line(StartPoint=split_midpoint, EndPoint=area_centroid)

all_vertex_2 = Curve(ln)
all_midpoint_2 = Curve(ln_2)
split_vertex_2 = Curve(ln_3)
split_midpoint_2 = Curve(ln_4)

vert_mp = Curve([all_vertex_2, all_midpoint_2])
vert_split_mp = Curve([all_vertex_2, split_midpoint_2])
split_vert_midpoint = Curve([all_midpoint_2, split_vertex_2])
split_vert_split_mp = Curve([split_vertex_2, split_midpoint_2])

ln_5 = Line(StartPoint=area_centroid, EndPoint=grid_area_centroids_2)
srfsplit = SurfaceSplit(Surface=item, Curves=split_vert_midpoint)
move = Move(Geometry=srfsplit, Motion=graft(ln_5))  # -> Geometry, Transform
pattern_curves = Curve(move.Geometry)
pattern_curves_2 = ClusterOutput(pattern_curves)

# ==== cluster PatternF: Pattern Geometry
grid_area_centroids = ClusterInput()
grid_cell_curves = ClusterInput()
grid_area_centroids_2 = Point(flatten(grid_area_centroids))
grid_cell_curves_2 = Curve(flatten(grid_cell_curves))
item = ListItem(List=grid_cell_curves_2, Index=0, Wrap=True)
explode = Explode(Curve=item, Recursive=True)  # -> Segments, Vertices
disc = Discontinuity(Curve=item, Level=1)  # -> Points, Parameters
area = Area(Geometry=item)  # -> Area, Centroid
dispatch = Dispatch(List=disc.Points, DispatchPattern=[True, False])  # -> ListA, ListB
midpt = CurveMiddle(Curve=explode.Segments)
dispatch_2 = Dispatch(List=midpt, DispatchPattern=[True, False])  # -> ListA, ListB
area_centroid = Point(area.Centroid)
all_vertex = Point(disc.Points)
all_midpoint = Point(midpt)
split_vertex = Point(dispatch.ListA)
split_midpoint = Point(dispatch_2.ListA)
ln = Line(StartPoint=all_vertex, EndPoint=area_centroid)
ln_2 = Line(StartPoint=all_midpoint, EndPoint=area_centroid)
ln_3 = Line(StartPoint=split_vertex, EndPoint=area_centroid)
ln_4 = Line(StartPoint=split_midpoint, EndPoint=area_centroid)

all_vertex_2 = Curve(ln)
split_vertex_2 = Curve(ln_3)
split_midpoint_2 = Curve(ln_4)
all_midpoint_2 = Curve(ln_2)

vert_mp = Curve([all_vertex_2, all_midpoint_2])
vert_split_mp = Curve([all_vertex_2, split_midpoint_2])
split_vert_midpoint = Curve([all_midpoint_2, split_vertex_2])
split_vert_split_mp = Curve([split_vertex_2, split_midpoint_2])

ln_5 = Line(StartPoint=area_centroid, EndPoint=grid_area_centroids_2)
srfsplit = SurfaceSplit(Surface=item, Curves=vert_split_mp)
move = Move(Geometry=srfsplit, Motion=graft(ln_5))  # -> Geometry, Transform
pattern_curves = Curve(move.Geometry)
pattern_curves_2 = ClusterOutput(pattern_curves)

# ==== cluster PatternE: Pattern Geometry
grid_area_centroids = ClusterInput()
grid_cell_curves = ClusterInput()
grid_area_centroids_2 = Point(flatten(grid_area_centroids))
grid_cell_curves_2 = Curve(flatten(grid_cell_curves))
item = ListItem(List=grid_cell_curves_2, Index=0, Wrap=True)
explode = Explode(Curve=item, Recursive=True)  # -> Segments, Vertices
disc = Discontinuity(Curve=item, Level=1)  # -> Points, Parameters
area = Area(Geometry=item)  # -> Area, Centroid
dispatch = Dispatch(List=disc.Points, DispatchPattern=[True, False])  # -> ListA, ListB
midpt = CurveMiddle(Curve=explode.Segments)
dispatch_2 = Dispatch(List=midpt, DispatchPattern=[True, False])  # -> ListA, ListB
area_centroid = Point(area.Centroid)
all_vertex = Point(disc.Points)
split_vertex = Point(dispatch.ListA)
all_midpoint = Point(midpt)
split_midpoint = Point(dispatch_2.ListA)
ln = Line(StartPoint=all_vertex, EndPoint=area_centroid)
ln_2 = Line(StartPoint=all_midpoint, EndPoint=area_centroid)
ln_3 = Line(StartPoint=split_vertex, EndPoint=area_centroid)
ln_4 = Line(StartPoint=split_midpoint, EndPoint=area_centroid)

split_vertex_2 = Curve(ln_3)
split_midpoint_2 = Curve(ln_4)
all_vertex_2 = Curve(ln)
all_midpoint_2 = Curve(ln_2)

vert_mp = Curve([all_vertex_2, all_midpoint_2])
vert_split_mp = Curve([all_vertex_2, split_midpoint_2])
split_vert_midpoint = Curve([all_midpoint_2, split_vertex_2])
split_vert_split_mp = Curve([split_vertex_2, split_midpoint_2])

ln_5 = Line(StartPoint=area_centroid, EndPoint=grid_area_centroids_2)
srfsplit = SurfaceSplit(Surface=item, Curves=vert_mp)
move = Move(Geometry=srfsplit, Motion=graft(ln_5))  # -> Geometry, Transform
pattern_curves = Curve(move.Geometry)
pattern_curves_2 = ClusterOutput(pattern_curves)

# ==== cluster PatternD: Pattern Geometry
grid_area_centroids = ClusterInput()
grid_cell_curves = ClusterInput()
grid_area_centroids_2 = Point(flatten(grid_area_centroids))
grid_cell_curves_2 = Curve(flatten(grid_cell_curves))
item = ListItem(List=grid_cell_curves_2, Index=0, Wrap=True)
explode = Explode(Curve=item, Recursive=True)  # -> Segments, Vertices
disc = Discontinuity(Curve=item, Level=1)  # -> Points, Parameters
area = Area(Geometry=item)  # -> Area, Centroid
dispatch = Dispatch(List=disc.Points, DispatchPattern=[True, False])  # -> ListA, ListB
midpt = CurveMiddle(Curve=explode.Segments)
dispatch_2 = Dispatch(List=midpt, DispatchPattern=[True, False])  # -> ListA, ListB
area_centroid = Point(area.Centroid)
all_vertex = Point(disc.Points)
split_vertex = Point(dispatch.ListA)
all_midpoint = Point(midpt)
split_midpoint = Point(dispatch_2.ListA)
ln = Line(StartPoint=all_vertex, EndPoint=area_centroid)
ln_2 = Line(StartPoint=all_midpoint, EndPoint=area_centroid)
ln_3 = Line(StartPoint=split_vertex, EndPoint=area_centroid)
ln_4 = Line(StartPoint=split_midpoint, EndPoint=area_centroid)

split_midpoint_2 = Curve(ln_4)
split_vertex_2 = Curve(ln_3)
all_vertex_2 = Curve(ln)
all_midpoint_2 = Curve(ln_2)

vert_mp = Curve([all_vertex_2, all_midpoint_2])
vert_split_mp = Curve([all_vertex_2, split_midpoint_2])
split_vert_midpoint = Curve([all_midpoint_2, split_vertex_2])
split_vert_split_mp = Curve([split_vertex_2, split_midpoint_2])

ln_5 = Line(StartPoint=area_centroid, EndPoint=grid_area_centroids_2)
srfsplit = SurfaceSplit(Surface=item, Curves=split_midpoint_2)
move = Move(Geometry=srfsplit, Motion=graft(ln_5))  # -> Geometry, Transform
pattern_curves = Curve(move.Geometry)
pattern_curves_2 = ClusterOutput(pattern_curves)

# ==== cluster PatternC: Pattern Geometry
grid_area_centroids = ClusterInput()
grid_cell_curves = ClusterInput()
grid_area_centroids_2 = Point(flatten(grid_area_centroids))
grid_cell_curves_2 = Curve(flatten(grid_cell_curves))
item = ListItem(List=grid_cell_curves_2, Index=0, Wrap=True)
explode = Explode(Curve=item, Recursive=True)  # -> Segments, Vertices
disc = Discontinuity(Curve=item, Level=1)  # -> Points, Parameters
area = Area(Geometry=item)  # -> Area, Centroid
dispatch = Dispatch(List=disc.Points, DispatchPattern=[True, False])  # -> ListA, ListB
midpt = CurveMiddle(Curve=explode.Segments)
dispatch_2 = Dispatch(List=midpt, DispatchPattern=[True, False])  # -> ListA, ListB
area_centroid = Point(area.Centroid)
all_vertex = Point(disc.Points)
split_vertex = Point(dispatch.ListA)
all_midpoint = Point(midpt)
split_midpoint = Point(dispatch_2.ListA)
ln = Line(StartPoint=all_vertex, EndPoint=area_centroid)
ln_2 = Line(StartPoint=all_midpoint, EndPoint=area_centroid)
ln_3 = Line(StartPoint=split_vertex, EndPoint=area_centroid)
ln_4 = Line(StartPoint=split_midpoint, EndPoint=area_centroid)

split_vertex_2 = Curve(ln_3)
split_midpoint_2 = Curve(ln_4)
all_vertex_2 = Curve(ln)
all_midpoint_2 = Curve(ln_2)

vert_mp = Curve([all_vertex_2, all_midpoint_2])
vert_split_mp = Curve([all_vertex_2, split_midpoint_2])
split_vert_midpoint = Curve([all_midpoint_2, split_vertex_2])
split_vert_split_mp = Curve([split_vertex_2, split_midpoint_2])

ln_5 = Line(StartPoint=area_centroid, EndPoint=grid_area_centroids_2)
srfsplit = SurfaceSplit(Surface=item, Curves=split_vertex_2)
move = Move(Geometry=srfsplit, Motion=graft(ln_5))  # -> Geometry, Transform
pattern_curves = Curve(move.Geometry)
pattern_curves_2 = ClusterOutput(pattern_curves)

# ==== cluster PatternB: Pattern Geometry
grid_area_centroids = ClusterInput()
grid_cell_curves = ClusterInput()
grid_area_centroids_2 = Point(flatten(grid_area_centroids))
grid_cell_curves_2 = Curve(flatten(grid_cell_curves))
item = ListItem(List=grid_cell_curves_2, Index=0, Wrap=True)
explode = Explode(Curve=item, Recursive=True)  # -> Segments, Vertices
disc = Discontinuity(Curve=item, Level=1)  # -> Points, Parameters
area = Area(Geometry=item)  # -> Area, Centroid
dispatch = Dispatch(List=disc.Points, DispatchPattern=[True, False])  # -> ListA, ListB
midpt = CurveMiddle(Curve=explode.Segments)
dispatch_2 = Dispatch(List=midpt, DispatchPattern=[True, False])  # -> ListA, ListB
area_centroid = Point(area.Centroid)
all_vertex = Point(disc.Points)
split_vertex = Point(dispatch.ListA)
all_midpoint = Point(midpt)
split_midpoint = Point(dispatch_2.ListA)
ln = Line(StartPoint=all_vertex, EndPoint=area_centroid)
ln_2 = Line(StartPoint=all_midpoint, EndPoint=area_centroid)
ln_3 = Line(StartPoint=split_vertex, EndPoint=area_centroid)
ln_4 = Line(StartPoint=split_midpoint, EndPoint=area_centroid)

split_vertex_2 = Curve(ln_3)
split_midpoint_2 = Curve(ln_4)
all_vertex_2 = Curve(ln)
all_midpoint_2 = Curve(ln_2)

vert_mp = Curve([all_vertex_2, all_midpoint_2])
vert_split_mp = Curve([all_vertex_2, split_midpoint_2])
split_vert_midpoint = Curve([all_midpoint_2, split_vertex_2])
split_vert_split_mp = Curve([split_vertex_2, split_midpoint_2])

ln_5 = Line(StartPoint=area_centroid, EndPoint=grid_area_centroids_2)
srfsplit = SurfaceSplit(Surface=item, Curves=all_midpoint_2)
move = Move(Geometry=srfsplit, Motion=graft(ln_5))  # -> Geometry, Transform
pattern_curves = Curve(move.Geometry)
pattern_curves_2 = ClusterOutput(pattern_curves)

# ==== cluster PatternA: Pattern Geometry
grid_area_centroids = ClusterInput()
grid_cell_curves = ClusterInput()
grid_area_centroids_2 = Point(flatten(grid_area_centroids))
grid_cell_curves_2 = Curve(flatten(grid_cell_curves))
item = ListItem(List=grid_cell_curves_2, Index=0, Wrap=True)
explode = Explode(Curve=item, Recursive=True)  # -> Segments, Vertices
disc = Discontinuity(Curve=item, Level=1)  # -> Points, Parameters
area = Area(Geometry=item)  # -> Area, Centroid
dispatch = Dispatch(List=disc.Points, DispatchPattern=[True, False])  # -> ListA, ListB
midpt = CurveMiddle(Curve=explode.Segments)
dispatch_2 = Dispatch(List=midpt, DispatchPattern=[True, False])  # -> ListA, ListB
area_centroid = Point(area.Centroid)
all_vertex = Point(disc.Points)
all_midpoint = Point(midpt)
split_vertex = Point(dispatch.ListA)
split_midpoint = Point(dispatch_2.ListA)
ln = Line(StartPoint=all_vertex, EndPoint=area_centroid)
ln_2 = Line(StartPoint=all_midpoint, EndPoint=area_centroid)
ln_3 = Line(StartPoint=split_vertex, EndPoint=area_centroid)
ln_4 = Line(StartPoint=split_midpoint, EndPoint=area_centroid)

all_vertex_2 = Curve(ln)
all_midpoint_2 = Curve(ln_2)
split_vertex_2 = Curve(ln_3)
split_midpoint_2 = Curve(ln_4)

vert_mp = Curve([all_vertex_2, all_midpoint_2])
vert_split_mp = Curve([all_vertex_2, split_midpoint_2])
split_vert_midpoint = Curve([all_midpoint_2, split_vertex_2])
split_vert_split_mp = Curve([split_vertex_2, split_midpoint_2])

ln_5 = Line(StartPoint=area_centroid, EndPoint=grid_area_centroids_2)
srfsplit = SurfaceSplit(Surface=item, Curves=all_vertex_2)
move = Move(Geometry=srfsplit, Motion=graft(ln_5))  # -> Geometry, Transform
pattern_curves = Curve(move.Geometry)
pattern_curves_2 = ClusterOutput(pattern_curves)
