# Grasshopper definition LIBRARY_2D_General-Pattern-Arrays.gh (Grasshopper 1.0.7)

number_slider = Slider(24, range=0..100)
pt = Point(Point(0, 0, 0))
number_slider_2 = Slider(24, range=0..100)
number_slider_3 = Slider(1, range=0..10)
pt_2 = Point(Point(0, 0, 0))
number_slider_4 = Slider(2, range=0..10)
number_slider_5 = Slider(24, range=0..100)
pt_3 = Point(Point(0, 0, 0))
hex_grid_generator = HexGridGenerator(origin_point=pt, cell_scale=Slider(1, range=0..10), x_axis_extent=number_slider, y_axis_extent=number_slider)  # -> flatten(grid_cell_curves_2), flatten(grid_area_centroids), points_at_grid_cell_centers_2
tri_grid_generator = TriGridGenerator(origin_point=pt_2, cell_scale=number_slider_3, x_axis_extent=number_slider_2, y_axis_extent=number_slider_2)  # -> flatten(grid_cell_curves_2), grid_cell_area_centroids
dispatch = Dispatch(List=tri_grid_generator.grid_cell_area_centroids, DispatchPattern=[True, False])  # -> ListA, ListB
pt_4 = Point(dispatch.ListB)
pt_5 = Point(dispatch.ListA)
hex_grid_generator_2 = HexGridGenerator(origin_point=pt_3, cell_scale=number_slider_4, x_axis_extent=number_slider_5, y_axis_extent=number_slider_5)  # -> flatten(grid_cell_curves_2), flatten(grid_area_centroids), points_at_grid_cell_centers_2
flip = FlipMatrix(Data=pt_5)  # -> flatten(Data)
number_slider_6 = Slider(0.61, range=0..1)
flip_2 = FlipMatrix(Data=pt_4)  # -> flatten(Data)
dispatch_2 = Dispatch(List=flip_2, DispatchPattern=[True, False])  # -> ListA, ListB
dispatch_3 = Dispatch(List=flip, DispatchPattern=[True, False])  # -> ListA, ListB
item = ListItem(List=hex_grid_generator.grid_cell_curves_2, Index=0, Wrap=True)
area = Area(Geometry=item)  # -> Area, Centroid
pt_6 = Point(dispatch_2.ListB)
pt_7 = Point(dispatch_2.ListA)
pt_8 = Point(dispatch_3.ListB)
pt_9 = Point(dispatch_3.ListA)
division = Division(A=number_slider_6, B=Slider(2, range=0..10))
crv = Curve(tri_grid_generator.grid_cell_curves_2)
area_2 = Area(Geometry=item)  # -> Area, Centroid
hexagonal_pattern_01 = Curve([<curve referenced from the Rhino model> x13])
item_2 = ListItem(List=hex_grid_generator_2.grid_cell_curves_2, Index=0, Wrap=True)
disc = Discontinuity(Curve=item, Level=1)  # -> Points, Parameters
explode = Explode(Curve=item, Recursive=True)  # -> Segments, Vertices
item_3 = ListItem(List=tri_grid_generator.grid_cell_curves_2, Index=0, Wrap=True)  # -> Item, Item1
pt_10 = Point([pt_6, pt_9])
pt_11 = Point([pt_8, pt_7])
area_3 = Area(Geometry=item_2)  # -> Area, Centroid
ln = Line(StartPoint=disc.Points, EndPoint=area_2.Centroid)
crv_2 = Curve(item_3.Item)
midpt = CurveMiddle(Curve=explode.Segments)
scale = Scale(Geometry=hexagonal_pattern_01, Center=area_3.Centroid, Factor=number_slider_4)  # -> Geometry, Transform
srfsplit = SurfaceSplit(Surface=item_2, Curves=scale.Geometry)
crv_3 = Curve(item_3.Item1)
area_4 = Area(Geometry=crv_2)  # -> Area, Centroid
eval = EvaluateCurve(Curve=reparameterize(ln), Parameter=number_slider_6)  # -> Point, Tangent, Angle
shift = ShiftList(List=eval.Point, Shift=Slider(1, range=0..10), Wrap=True)
area_5 = Area(Geometry=crv_3)  # -> Area, Centroid
crv_4 = Curve(srfsplit)
number_slider_7 = Slider(0.66, range=0..1)
ln_2 = Line(StartPoint=midpt, EndPoint=eval.Point)
ln_3 = Line(StartPoint=area_3.Centroid, EndPoint=hex_grid_generator_2.grid_area_centroids)
explode_2 = Explode(Curve=crv_2, Recursive=True)  # -> Segments, Vertices
ln_4 = Line(StartPoint=midpt, EndPoint=shift)
number_slider_8 = Slider(0.66, range=0..1)
explode_3 = Explode(Curve=crv_3, Recursive=True)  # -> Segments, Vertices
weave = Weave(Pattern=[0, 1], Stream0=ln_4, Stream1=ln_2, NullGaps=False)
move = Move(Geometry=crv_4, Motion=graft(ln_3))  # -> flatten(Geometry), Transform
subtraction = Subtraction(A=Slider(1, range=0..1), B=number_slider_7)
join = JoinCurves(Curves=weave, Preserve=False)
pline = PolyLine(Vertices=eval.Point, Closed=True)
area_6 = Area(Geometry=move.Geometry)  # -> Area, Centroid
division_2 = Division(A=number_slider_3, B=Slider(4, range=0..10))
ln_5 = Line(StartPoint=area_4.Centroid, EndPoint=pt_10)
subtraction_2 = Subtraction(A=Slider(1, range=0..1), B=number_slider_8)
division_3 = Division(A=number_slider_3, B=Slider(4, range=0..10))
number_slider_9 = Slider(0.2, range=0..1)
number_slider_10 = Slider(0.8, range=0..1)
circle = CircleCNR(Center=area.Centroid, Normal=Vector(0, 0, 1), Radius=division)
ln_6 = Line(StartPoint=area_5.Centroid, EndPoint=pt_11)
eval_2 = EvaluateCurve(Curve=reparameterize(explode_2.Segments), Parameter=subtraction)  # -> Point, Tangent, Angle
cset = CreateSet(List=area_6.Area)  # -> Set, Map
eval_3 = EvaluateCurve(Curve=reparameterize(explode_2.Segments), Parameter=number_slider_7)  # -> Point, Tangent, Angle
srfsplit_2 = SurfaceSplit(Surface=item, Curves=join)
crv_5 = Curve(<curve referenced from the Rhino model>)
eval_4 = EvaluateCurve(Curve=reparameterize(explode_3.Segments), Parameter=subtraction_2)  # -> Point, Tangent, Angle
eval_5 = EvaluateCurve(Curve=reparameterize(explode_3.Segments), Parameter=number_slider_8)  # -> Point, Tangent, Angle
shift_2 = ShiftList(List=eval_3.Point, Shift=Slider(2, range=0..10), Wrap=True)
srfsplit_3 = SurfaceSplit(Surface=srfsplit_2, Curves=pline)  # -> flatten(Fragments)
sift = SiftPattern(List=move.Geometry, SiftPattern=cset.Map)  # -> Output0, Output1, Output2, Output3
shift_3 = ShiftList(List=eval_5.Point, Shift=Slider(2, range=0..10), Wrap=True)
crv_6 = Curve(srfsplit_3)
crv_7 = Curve(sift.Output0)
crv_8 = Curve(sift.Output3)
crv_9 = Curve(sift.Output2)
crv_10 = Curve(sift.Output1)
ln_7 = Line(StartPoint=shift_2, EndPoint=eval_2.Point)
area_7 = Area(Geometry=crv_6)  # -> Area, Centroid
ln_8 = Line(StartPoint=shift_3, EndPoint=eval_4.Point)
srfsplit_4 = SurfaceSplit(Surface=crv_2, Curves=ln_7)
cset_2 = CreateSet(List=area_7.Area)  # -> Set, Map
srfsplit_5 = SurfaceSplit(Surface=crv_3, Curves=ln_8)
sift_2 = SiftPattern(List=crv_6, SiftPattern=cset_2.Map)  # -> Output0, Output1, Output2
area_8 = Area(Geometry=crv_7)  # -> Area, Centroid
area_9 = Area(Geometry=crv_10)  # -> Area, Centroid
circle_2 = CircleCNR(Center=area_4.Centroid, Normal=Vector(0, 0, 1), Radius=division_2)
cull_i = CullIndex(List=srfsplit_4, Indices=Slider(0, range=0..100), Wrap=True)
area_10 = Area(Geometry=crv_9)  # -> Area, Centroid
curve_attractor = CurveAttractor(C=crv_5, P=area_8.Centroid, A=number_slider_9, B=number_slider_10)  # -> R, points_on_curve_2
area_11 = Area(Geometry=crv_8)  # -> Area, Centroid
curve_attractor_2 = CurveAttractor(C=crv_5, P=area_9.Centroid, A=number_slider_10, B=number_slider_9)  # -> R, points_on_curve_2
crv_11 = Curve(sift_2.Output0)
crv_12 = Curve(sift_2.Output1)
crv_13 = Curve(sift_2.Output2)
crv_14 = Curve(circle)
curve_attractor_3 = CurveAttractor(C=crv_5, P=area_10.Centroid, A=number_slider_9, B=number_slider_10)  # -> R, points_on_curve_2
curve_attractor_4 = CurveAttractor(C=crv_5, P=area_11.Centroid, A=number_slider_10, B=number_slider_9)  # -> R, points_on_curve_2
circle_3 = CircleCNR(Center=area_5.Centroid, Normal=Vector(0, 0, 1), Radius=division_3)
cull_i_2 = CullIndex(List=srfsplit_5, Indices=Slider(0, range=0..100), Wrap=True)
crv_15 = Curve(cull_i)
move_2 = Move(Geometry=crv_15, Motion=graft(ln_5))  # -> flatten(Geometry), Transform
crv_16 = Curve(circle_2)
move_3 = Move(Geometry=crv_16, Motion=graft(ln_5))  # -> flatten(Geometry), Transform
crv_17 = Curve(cull_i_2)
move_4 = Move(Geometry=crv_17, Motion=graft(ln_6))  # -> flatten(Geometry), Transform
crv_18 = Curve(circle_3)
move_5 = Move(Geometry=crv_18, Motion=graft(ln_6))  # -> flatten(Geometry), Transform
area_12 = Area(Geometry=crv_14)  # -> Area, Centroid
scale_2 = Scale(Geometry=crv_7, Center=area_8.Centroid, Factor=curve_attractor.R)  # -> Geometry, Transform
scale_3 = Scale(Geometry=crv_10, Center=area_9.Centroid, Factor=curve_attractor_2.R)  # -> Geometry, Transform
area_13 = Area(Geometry=crv_13)  # -> Area, Centroid
scale_4 = Scale(Geometry=crv_9, Center=area_10.Centroid, Factor=curve_attractor_3.R)  # -> Geometry, Transform
scale_5 = Scale(Geometry=crv_8, Center=area_11.Centroid, Factor=curve_attractor_4.R)  # -> Geometry, Transform
scale_6 = Scale(Geometry=crv_14, Center=area_12.Centroid, Factor=Slider(0.95, range=0..1))  # -> Geometry, Transform
crv_19 = Curve(scale_2.Geometry)
crv_20 = Curve(scale_3.Geometry)
crv_21 = Curve(scale_4.Geometry)
crv_22 = Curve(scale_5.Geometry)
scale_7 = Scale(Geometry=crv_13, Center=area_13.Centroid, Factor=Slider(0.66, range=0..1))  # -> Geometry, Transform
ln_9 = Line(StartPoint=area_2.Centroid, EndPoint=hex_grid_generator.grid_area_centroids)
crv_23 = Curve([move_3.Geometry, move_5.Geometry])
crv_24 = Curve([move_4.Geometry, move_2.Geometry])
crv_25 = Curve([scale_6.Geometry, scale_7.Geometry])
move_6 = Move(Geometry=crv_25, Motion=graft(ln_9))  # -> Geometry, Transform
area_14 = Area(Geometry=crv_24)  # -> Area, Centroid
area_15 = Area(Geometry=crv_23)  # -> Area, Centroid
scale_8 = Scale(Geometry=crv_24, Center=area_14.Centroid, Factor=Slider(0.5, range=0..1))  # -> Geometry, Transform
scale_9 = Scale(Geometry=crv_23, Center=area_15.Centroid, Factor=Slider(0.93, range=0..1))  # -> Geometry, Transform

# ==== cluster HexGridGenerator: Grid Gen
y_axis_extent = ClusterInput()
x_axis_extent = ClusterInput()
in = ClusterInput()  # "---------------------"
origin_point = ClusterInput()
cell_scale = ClusterInput()
y_axis_extent_2 = Number(y_axis_extent)
x_axis_extent_2 = Number(x_axis_extent)
cell_scale_2 = Number(cell_scale)
origin_point_2 = Point(origin_point)
division = Division(XAxisExtent=x_axis_extent_2, B=cell_scale_2)
division_2 = Division(YAxisExtent=y_axis_extent_2, B=cell_scale_2)
hexgrid = Hexagonal(Plane=origin_point_2, Size=cell_scale_2, ExtentX=division, ExtentY=division_2)  # -> Cells, Points
points_at_grid_cell_centers = Point(hexgrid.Points)
grid_cell_curves = Curve(hexgrid.Cells)
area = Area(Geometry=grid_cell_curves)  # -> Area, GridAreaCentroids
grid_area_centroids = ClusterOutput(area.GridAreaCentroids)
points_at_grid_cell_centers_2 = ClusterOutput(points_at_grid_cell_centers)
grid_cell_curves_2 = ClusterOutput(grid_cell_curves)

# ==== cluster CurveAttractor: Utility
C = ClusterInput()
P = ClusterInput()
x = ClusterInput()
A = ClusterInput()
B = ClusterInput()
crv_cp = CurveClosestPoint(Point=P, Curve=C)  # -> Point, Parameter, Distance
dom = ConstructDomain(DomainStart=A, DomainEnd=B)
bnd = Bounds(Numbers=crv_cp.Distance)
remap = RemapNumbers(Value=crv_cp.Distance, Source=bnd, Target=dom)  # -> Mapped, Clipped
R = ClusterOutput(remap.Mapped)
points_on_curve = Point(crv_cp.Point)
points_on_curve_2 = ClusterOutput(points_on_curve)

# ==== cluster TriGridGenerator: Grid Gen
y_axis_extent = ClusterInput()
x_axis_extent = ClusterInput()
in = ClusterInput()  # "---------------------"
origin_point = ClusterInput()
cell_scale = ClusterInput()
y_axis_extent_2 = Number(y_axis_extent)
x_axis_extent_2 = Number(x_axis_extent)
cell_scale_2 = Number(cell_scale)
origin_point_2 = Point(origin_point)
division = Division(XAxisExtent=x_axis_extent_2, B=cell_scale_2)
division_2 = Division(YAxisExtent=y_axis_extent_2, B=cell_scale_2)
trigrid = Triangular(Plane=origin_point_2, Size=cell_scale_2, ExtentX=division, ExtentY=division_2)  # -> Cells, Points
grid_cell_curves = Curve(trigrid.Cells)
area = Area(Geometry=grid_cell_curves)  # -> Area, GridCellAreaCentroids
grid_cell_area_centroids = ClusterOutput(area.GridCellAreaCentroids)
grid_cell_curves_2 = ClusterOutput(grid_cell_curves)
