# Grasshopper definition LIBRARY_2D_Islamic-Patterns.gh (Grasshopper 1.0.7)

pt = Point(Point(0, 0, 0))
number_slider = Slider(24, range=0..100)
pt_2 = Point(Point(0, 0, 0))
number_slider_2 = Slider(24, range=0..100)
pt_3 = Point(Point(0, 0, 0))
number_slider_3 = Slider(24, range=0..100)
pt_4 = Point(Point(0, 0, 0))
number_slider_4 = Slider(24, range=0..100)
pt_5 = Point(Point(0, 0, 0))
number_slider_5 = Slider(24, range=0..100)

pt_6 = Point(Point(0, 0, 0))
number_slider_6 = Slider(24, range=0..100)
square_grid_generator = SquareGridGenerator(origin_point=pt_6, cell_scale=Slider(4, range=0..10), x_axis_extent=number_slider_6, y_axis_extent=number_slider_6)  # -> grid_cell_curves_2, grid_area_centroids
pt_7 = Point(flatten(square_grid_generator.grid_area_centroids))
crv = Curve(flatten(square_grid_generator.grid_cell_curves_2))
explode = Explode(Curve=crv, Recursive=True)  # -> Segments, Vertices
number_slider_7 = Slider(0.2, range=0..1)
number_slider_8 = Slider(0.2, range=0..1)
item = ListItem(List=explode.Vertices, Index=0, Wrap=True)  # -> Item, Item1, Item2, Item3
item_2 = ListItem(List=explode.Segments, Index=0, Wrap=True)  # -> Item, Item1, Item2, Item3
number_slider_9 = Slider(1, range=0..1)
pt_8 = Point(item.Item)
pt_9 = Point(item.Item1)
pt_10 = Point(item.Item2)
pt_11 = Point(item.Item3)
subtraction = Subtraction(A=number_slider_9, B=number_slider_8)
ln = Line(StartPoint=pt_9, EndPoint=pt_11)
subtraction_2 = Subtraction(A=number_slider_9, B=number_slider_7)
eval = EvaluateCurve(Curve=reparameterize(item_2.Item), Parameter=number_slider_7)  # -> Point, Tangent, Angle
eval_2 = EvaluateCurve(Curve=reparameterize(item_2.Item2), Parameter=number_slider_8)  # -> Point, Tangent, Angle
eval_3 = EvaluateCurve(Curve=reparameterize(item_2.Item1), Parameter=subtraction_2)  # -> Point, Tangent, Angle
eval_4 = EvaluateCurve(Curve=reparameterize(item_2.Item3), Parameter=subtraction)  # -> Point, Tangent, Angle
eval_5 = EvaluateCurve(Curve=reparameterize(ln), Parameter=number_slider_8)  # -> Point, Tangent, Angle
ln_2 = Line(StartPoint=eval.Point, EndPoint=eval_2.Point)
ln_3 = Line(StartPoint=eval_3.Point, EndPoint=eval_4.Point)
ln_4 = Line(StartPoint=pt_8, EndPoint=eval_5.Point)
ln_5 = Line(StartPoint=pt_10, EndPoint=eval_5.Point)
number_slider_10 = Slider(4, range=0..10)
arrpolar = PolarArray(Geometry=[ln_2, ln_3], Plane=graft(pt_7), Count=number_slider_10, Angle=6.283185307)  # -> Geometry, Transform
arrpolar_2 = PolarArray(Geometry=[ln_4, ln_5], Plane=graft(pt_7), Count=number_slider_10, Angle=6.283185307)  # -> Geometry, Transform
crv_2 = Curve(arrpolar.Geometry)
crv_3 = Curve(arrpolar_2.Geometry)
crv_4 = Curve(flatten([crv_2, crv_3]))
bbox = BoundingBox(Content=crv_4, Plane=PlaneXY(0, 0, 0), UnionBox=True)  # -> Box, Box_2
srfsplit = SurfaceSplit(Surface=bbox.Box, Curves=crv_4)
crv_5 = Curve(srfsplit)
area = Area(Geometry=crv_5)  # -> Area, Centroid
scale = Scale(Geometry=crv_5, Center=area.Centroid, Factor=Slider(0.85, range=0..1))  # -> Geometry, Transform
crv_6 = Curve(scale.Geometry)

square_grid_generator_2 = SquareGridGenerator(origin_point=pt, cell_scale=Slider(4, range=0..10), x_axis_extent=number_slider, y_axis_extent=number_slider)  # -> grid_cell_curves_2, grid_area_centroids
square_grid_generator_3 = SquareGridGenerator(origin_point=pt_2, cell_scale=Slider(4, range=0..10), x_axis_extent=number_slider_2, y_axis_extent=number_slider_2)  # -> grid_cell_curves_2, grid_area_centroids
square_grid_generator_4 = SquareGridGenerator(origin_point=pt_3, cell_scale=Slider(4, range=0..10), x_axis_extent=number_slider_3, y_axis_extent=number_slider_3)  # -> grid_cell_curves_2, grid_area_centroids
square_grid_generator_5 = SquareGridGenerator(origin_point=pt_4, cell_scale=Slider(4, range=0..10), x_axis_extent=number_slider_4, y_axis_extent=number_slider_4)  # -> grid_cell_curves_2, grid_area_centroids
square_grid_generator_6 = SquareGridGenerator(origin_point=pt_5, cell_scale=Slider(4, range=0..10), x_axis_extent=number_slider_5, y_axis_extent=number_slider_5)  # -> grid_cell_curves_2, grid_area_centroids
pt_12 = Point(flatten(square_grid_generator_2.grid_area_centroids))
crv_7 = Curve(flatten(square_grid_generator_2.grid_cell_curves_2))
pt_13 = Point(flatten(square_grid_generator_3.grid_area_centroids))
pt_14 = Point(flatten(square_grid_generator_4.grid_area_centroids))
pt_15 = Point(flatten(square_grid_generator_5.grid_area_centroids))
pt_16 = Point(flatten(square_grid_generator_6.grid_area_centroids))
crv_8 = Curve(flatten(square_grid_generator_3.grid_cell_curves_2))
crv_9 = Curve(flatten(square_grid_generator_4.grid_cell_curves_2))
crv_10 = Curve(flatten(square_grid_generator_5.grid_cell_curves_2))
crv_11 = Curve(flatten(square_grid_generator_6.grid_cell_curves_2))
explode_2 = Explode(Curve=crv_7, Recursive=True)  # -> Segments, Vertices
explode_3 = Explode(Curve=crv_8, Recursive=True)  # -> Segments, Vertices
explode_4 = Explode(Curve=crv_9, Recursive=True)  # -> Segments, Vertices
explode_5 = Explode(Curve=crv_10, Recursive=True)  # -> Segments, Vertices
explode_6 = Explode(Curve=crv_11, Recursive=True)  # -> Segments, Vertices
number_slider_11 = Slider(0.7, range=0..1)
number_slider_12 = Slider(0.2, range=0..1)
number_slider_13 = Slider(0.4, range=0..1)
item_3 = ListItem(List=explode_2.Vertices, Index=0, Wrap=True)  # -> Item, Item1, Item2, Item3
number_slider_14 = Slider(0.2, range=0..1)
number_slider_15 = Slider(0.2, range=0..1)
number_slider_16 = Slider(0.6, range=0..1)
item_4 = ListItem(List=explode_2.Segments, Index=0, Wrap=True)  # -> Item, Item1, Item2, Item3
number_slider_17 = Slider(0.5, range=0..1)
number_slider_18 = Slider(0.2, range=0..1)
number_slider_19 = Slider(0.2, range=0..1)
number_slider_20 = Slider(0.3, range=0..1)
item_5 = ListItem(List=explode_3.Vertices, Index=0, Wrap=True)  # -> Item, Item1, Item2, Item3
item_6 = ListItem(List=explode_4.Vertices, Index=0, Wrap=True)  # -> Item, Item1, Item2, Item3
item_7 = ListItem(List=explode_3.Segments, Index=0, Wrap=True)  # -> Item, Item1, Item2, Item3
item_8 = ListItem(List=explode_4.Segments, Index=0, Wrap=True)  # -> Item, Item1, Item2, Item3
item_9 = ListItem(List=explode_5.Vertices, Index=0, Wrap=True)  # -> Item, Item1, Item2, Item3
item_10 = ListItem(List=explode_5.Segments, Index=0, Wrap=True)  # -> Item, Item1, Item2, Item3
item_11 = ListItem(List=explode_6.Vertices, Index=0, Wrap=True)  # -> Item, Item1, Item2, Item3
item_12 = ListItem(List=explode_6.Segments, Index=0, Wrap=True)  # -> Item, Item1, Item2, Item3
number_slider_21 = Slider(1, range=0..1)
pt_17 = Point(item_3.Item)
pt_18 = Point(item_3.Item1)
pt_19 = Point(item_3.Item2)
pt_20 = Point(item_3.Item3)
number_slider_22 = Slider(1, range=0..1)
number_slider_23 = Slider(1, range=0..1)
number_slider_24 = Slider(1, range=0..1)
number_slider_25 = Slider(1, range=0..1)
pt_21 = Point(item_5.Item)
pt_22 = Point(item_5.Item1)
pt_23 = Point(item_5.Item3)
pt_24 = Point(item_5.Item2)
pt_25 = Point(item_6.Item)
pt_26 = Point(item_6.Item1)
pt_27 = Point(item_6.Item2)
pt_28 = Point(item_6.Item3)
pt_29 = Point(item_9.Item)
pt_30 = Point(item_9.Item1)
pt_31 = Point(item_9.Item2)
pt_32 = Point(item_9.Item3)
pt_33 = Point(item_11.Item)
pt_34 = Point(item_11.Item1)
pt_35 = Point(item_11.Item2)
pt_36 = Point(item_11.Item3)
subtraction_3 = Subtraction(A=number_slider_21, B=number_slider_11)
ln_6 = Line(StartPoint=pt_18, EndPoint=pt_20)
subtraction_4 = Subtraction(A=number_slider_21, B=number_slider_12)
subtraction_5 = Subtraction(A=number_slider_22, B=number_slider_13)
ln_7 = Line(StartPoint=pt_22, EndPoint=pt_23)
subtraction_6 = Subtraction(A=number_slider_23, B=number_slider_16)
ln_8 = Line(StartPoint=pt_26, EndPoint=pt_28)
subtraction_7 = Subtraction(A=number_slider_24, B=number_slider_17)
subtraction_8 = Subtraction(A=number_slider_22, B=number_slider_14)
ln_9 = Line(StartPoint=pt_30, EndPoint=pt_32)
subtraction_9 = Subtraction(A=number_slider_23, B=number_slider_15)
subtraction_10 = Subtraction(A=number_slider_25, B=number_slider_20)
ln_10 = Line(StartPoint=pt_34, EndPoint=pt_36)
subtraction_11 = Subtraction(A=number_slider_24, B=number_slider_18)
subtraction_12 = Subtraction(A=number_slider_25, B=number_slider_19)
eval_6 = EvaluateCurve(Curve=reparameterize(item_4.Item), Parameter=number_slider_12)  # -> Point, Tangent, Angle
eval_7 = EvaluateCurve(Curve=reparameterize(item_4.Item2), Parameter=number_slider_11)  # -> Point, Tangent, Angle
eval_8 = EvaluateCurve(Curve=reparameterize(item_4.Item1), Parameter=subtraction_4)  # -> Point, Tangent, Angle
eval_9 = EvaluateCurve(Curve=reparameterize(item_4.Item3), Parameter=subtraction_3)  # -> Point, Tangent, Angle
eval_10 = EvaluateCurve(Curve=reparameterize(ln_6), Parameter=number_slider_11)  # -> Point, Tangent, Angle
eval_11 = EvaluateCurve(Curve=reparameterize(item_7.Item), Parameter=number_slider_14)  # -> Point, Tangent, Angle
eval_12 = EvaluateCurve(Curve=reparameterize(item_8.Item), Parameter=number_slider_15)  # -> Point, Tangent, Angle
eval_13 = EvaluateCurve(Curve=reparameterize(item_7.Item2), Parameter=number_slider_13)  # -> Point, Tangent, Angle
eval_14 = EvaluateCurve(Curve=reparameterize(item_10.Item), Parameter=number_slider_18)  # -> Point, Tangent, Angle
eval_15 = EvaluateCurve(Curve=reparameterize(item_7.Item1), Parameter=subtraction_8)  # -> Point, Tangent, Angle
eval_16 = EvaluateCurve(Curve=reparameterize(item_7.Item3), Parameter=subtraction_5)  # -> Point, Tangent, Angle
eval_17 = EvaluateCurve(Curve=reparameterize(item_8.Item2), Parameter=number_slider_16)  # -> Point, Tangent, Angle
eval_18 = EvaluateCurve(Curve=reparameterize(item_8.Item1), Parameter=subtraction_9)  # -> Point, Tangent, Angle
eval_19 = EvaluateCurve(Curve=reparameterize(ln_7), Parameter=number_slider_13)  # -> Point, Tangent, Angle
eval_20 = EvaluateCurve(Curve=reparameterize(item_8.Item3), Parameter=subtraction_6)  # -> Point, Tangent, Angle
eval_21 = EvaluateCurve(Curve=reparameterize(item_10.Item2), Parameter=number_slider_17)  # -> Point, Tangent, Angle
eval_22 = EvaluateCurve(Curve=reparameterize(item_12.Item), Parameter=number_slider_19)  # -> Point, Tangent, Angle
eval_23 = EvaluateCurve(Curve=reparameterize(ln_8), Parameter=number_slider_16)  # -> Point, Tangent, Angle
eval_24 = EvaluateCurve(Curve=reparameterize(item_10.Item1), Parameter=subtraction_11)  # -> Point, Tangent, Angle
eval_25 = EvaluateCurve(Curve=reparameterize(item_10.Item3), Parameter=subtraction_7)  # -> Point, Tangent, Angle
eval_26 = EvaluateCurve(Curve=reparameterize(ln_9), Parameter=number_slider_17)  # -> Point, Tangent, Angle
eval_27 = EvaluateCurve(Curve=reparameterize(item_12.Item2), Parameter=number_slider_20)  # -> Point, Tangent, Angle
eval_28 = EvaluateCurve(Curve=reparameterize(item_12.Item1), Parameter=subtraction_12)  # -> Point, Tangent, Angle
eval_29 = EvaluateCurve(Curve=reparameterize(item_12.Item3), Parameter=subtraction_10)  # -> Point, Tangent, Angle
eval_30 = EvaluateCurve(Curve=reparameterize(ln_10), Parameter=number_slider_20)  # -> Point, Tangent, Angle
ln_11 = Line(StartPoint=eval_6.Point, EndPoint=eval_7.Point)
ln_12 = Line(StartPoint=eval_8.Point, EndPoint=eval_9.Point)
ln_13 = Line(StartPoint=pt_17, EndPoint=eval_10.Point)
ln_14 = Line(StartPoint=pt_19, EndPoint=eval_10.Point)
ln_15 = Line(StartPoint=eval_11.Point, EndPoint=eval_13.Point)
ln_16 = Line(StartPoint=eval_15.Point, EndPoint=eval_16.Point)
ln_17 = Line(StartPoint=eval_12.Point, EndPoint=eval_17.Point)
ln_18 = Line(StartPoint=eval_18.Point, EndPoint=eval_20.Point)
ln_19 = Line(StartPoint=pt_21, EndPoint=eval_19.Point)
ln_20 = Line(StartPoint=eval_14.Point, EndPoint=eval_21.Point)
ln_21 = Line(StartPoint=pt_24, EndPoint=eval_19.Point)
ln_22 = Line(StartPoint=pt_25, EndPoint=eval_23.Point)
ln_23 = Line(StartPoint=eval_24.Point, EndPoint=eval_25.Point)
ln_24 = Line(StartPoint=pt_27, EndPoint=eval_23.Point)
ln_25 = Line(StartPoint=eval_22.Point, EndPoint=eval_27.Point)
ln_26 = Line(StartPoint=pt_29, EndPoint=eval_26.Point)
ln_27 = Line(StartPoint=pt_31, EndPoint=eval_26.Point)
ln_28 = Line(StartPoint=eval_28.Point, EndPoint=eval_29.Point)
ln_29 = Line(StartPoint=pt_33, EndPoint=eval_30.Point)
ln_30 = Line(StartPoint=pt_35, EndPoint=eval_30.Point)
number_slider_26 = Slider(4, range=0..10)
number_slider_27 = Slider(4, range=0..10)
number_slider_28 = Slider(4, range=0..10)
number_slider_29 = Slider(4, range=0..10)
number_slider_30 = Slider(4, range=0..10)
arrpolar_3 = PolarArray(Geometry=[ln_11, ln_12], Plane=graft(pt_12), Count=number_slider_26, Angle=6.283185307)  # -> Geometry, Transform
arrpolar_4 = PolarArray(Geometry=[ln_13, ln_14], Plane=graft(pt_12), Count=number_slider_26, Angle=6.283185307)  # -> Geometry, Transform
arrpolar_5 = PolarArray(Geometry=[ln_15, ln_16], Plane=graft(pt_13), Count=number_slider_27, Angle=6.283185307)  # -> Geometry, Transform
arrpolar_6 = PolarArray(Geometry=[ln_17, ln_18], Plane=graft(pt_14), Count=number_slider_28, Angle=6.283185307)  # -> Geometry, Transform
arrpolar_7 = PolarArray(Geometry=[ln_20, ln_23], Plane=graft(pt_15), Count=number_slider_29, Angle=6.283185307)  # -> Geometry, Transform
arrpolar_8 = PolarArray(Geometry=[ln_19, ln_21], Plane=graft(pt_13), Count=number_slider_27, Angle=6.283185307)  # -> Geometry, Transform
arrpolar_9 = PolarArray(Geometry=[ln_22, ln_24], Plane=graft(pt_14), Count=number_slider_28, Angle=6.283185307)  # -> Geometry, Transform
arrpolar_10 = PolarArray(Geometry=[ln_25, ln_28], Plane=graft(pt_16), Count=number_slider_30, Angle=6.283185307)  # -> Geometry, Transform
arrpolar_11 = PolarArray(Geometry=[ln_26, ln_27], Plane=graft(pt_15), Count=number_slider_29, Angle=6.283185307)  # -> Geometry, Transform
arrpolar_12 = PolarArray(Geometry=[ln_29, ln_30], Plane=graft(pt_16), Count=number_slider_30, Angle=6.283185307)  # -> Geometry, Transform
crv_12 = Curve(arrpolar_3.Geometry)
crv_13 = Curve(arrpolar_4.Geometry)
crv_14 = Curve(arrpolar_5.Geometry)
crv_15 = Curve(arrpolar_6.Geometry)
crv_16 = Curve(arrpolar_8.Geometry)
crv_17 = Curve(arrpolar_7.Geometry)
crv_18 = Curve(arrpolar_9.Geometry)
crv_19 = Curve(arrpolar_11.Geometry)
crv_20 = Curve(arrpolar_10.Geometry)
crv_21 = Curve(arrpolar_12.Geometry)
crv_22 = Curve(flatten([crv_12, crv_13]))
crv_23 = Curve(flatten([crv_14, crv_16]))
crv_24 = Curve(flatten([crv_15, crv_18]))
crv_25 = Curve(flatten([crv_17, crv_19]))
crv_26 = Curve(flatten([crv_20, crv_21]))
bbox_2 = BoundingBox(Content=crv_22, Plane=PlaneXY(0, 0, 0), UnionBox=True)  # -> Box, Box_2
bbox_3 = BoundingBox(Content=crv_23, Plane=PlaneXY(0, 0, 0), UnionBox=True)  # -> Box, Box_2
bbox_4 = BoundingBox(Content=crv_24, Plane=PlaneXY(0, 0, 0), UnionBox=True)  # -> Box, Box_2
bbox_5 = BoundingBox(Content=crv_25, Plane=PlaneXY(0, 0, 0), UnionBox=True)  # -> Box, Box_2
bbox_6 = BoundingBox(Content=crv_26, Plane=PlaneXY(0, 0, 0), UnionBox=True)  # -> Box, Box_2
srfsplit_2 = SurfaceSplit(Surface=bbox_2.Box, Curves=crv_22)
srfsplit_3 = SurfaceSplit(Surface=bbox_3.Box, Curves=crv_23)
srfsplit_4 = SurfaceSplit(Surface=bbox_4.Box, Curves=crv_24)
srfsplit_5 = SurfaceSplit(Surface=bbox_5.Box, Curves=crv_25)
srfsplit_6 = SurfaceSplit(Surface=bbox_6.Box, Curves=crv_26)
crv_27 = Curve(srfsplit_2)
crv_28 = Curve(srfsplit_3)
crv_29 = Curve(srfsplit_4)
crv_30 = Curve(srfsplit_6)
crv_31 = Curve(srfsplit_5)
area_2 = Area(Geometry=crv_27)  # -> Area, Centroid
area_3 = Area(Geometry=crv_28)  # -> Area, Centroid
area_4 = Area(Geometry=crv_29)  # -> Area, Centroid
area_5 = Area(Geometry=crv_30)  # -> Area, Centroid
area_6 = Area(Geometry=crv_31)  # -> Area, Centroid
scale_2 = Scale(Geometry=crv_27, Center=area_2.Centroid, Factor=Slider(0.85, range=0..1))  # -> Geometry, Transform
scale_3 = Scale(Geometry=crv_28, Center=area_3.Centroid, Factor=Slider(0.85, range=0..1))  # -> Geometry, Transform
scale_4 = Scale(Geometry=crv_29, Center=area_4.Centroid, Factor=Slider(0.85, range=0..1))  # -> Geometry, Transform
scale_5 = Scale(Geometry=crv_30, Center=area_5.Centroid, Factor=Slider(0.85, range=0..1))  # -> Geometry, Transform
scale_6 = Scale(Geometry=crv_31, Center=area_6.Centroid, Factor=Slider(0.85, range=0..1))  # -> Geometry, Transform
crv_32 = Curve(scale_2.Geometry)
crv_33 = Curve(scale_4.Geometry)
crv_34 = Curve(scale_6.Geometry)
crv_35 = Curve(scale_3.Geometry)
crv_36 = Curve(scale_5.Geometry)
area_7 = Area(Geometry=crv_32)  # -> Area, Centroid
area_8 = Area(Geometry=crv_33)  # -> Area, Centroid
area_9 = Area(Geometry=crv_34)  # -> Area, Centroid
cset = CreateSet(List=area_7.Area)  # -> Set, Map
cset_2 = CreateSet(List=area_8.Area)  # -> Set, Map
cset_3 = CreateSet(List=area_9.Area)  # -> Set, Map
sift = SiftPattern(List=crv_32, SiftPattern=cset.Map)  # -> Output0, Output1, Output2, Output3, Output4, Output5, Output6, Output7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
sift_2 = SiftPattern(List=crv_33, SiftPattern=cset_2.Map)  # -> Output0, Output1, Output2, Output3, Output4, Output5, Output6, Output7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
sift_3 = SiftPattern(List=crv_34, SiftPattern=cset_3.Map)  # -> Output0, Output1, Output2, Output3, Output4, Output5, Output6, Output7
crv_37 = Curve(sift.Output0)
crv_38 = Curve(sift.Output1)
crv_39 = Curve(sift.Output2)
crv_40 = Curve(sift.Output3)
crv_41 = Curve(sift.Output4)
crv_42 = Curve(sift.Output5)
crv_43 = Curve(sift.Output6)
crv_44 = Curve(sift.Output7)
crv_45 = Curve(sift.Output8)
crv_46 = Curve(sift.Output9)
crv_47 = Curve(sift.Output10)
crv_48 = Curve(sift.Output11)
crv_49 = Curve(sift.Output12)
crv_50 = Curve(sift.Output13)
crv_51 = Curve(sift.Output14)
crv_52 = Curve(sift_2.Output0)
crv_53 = Curve(sift_2.Output1)
crv_54 = Curve(sift_2.Output2)
crv_55 = Curve(sift_2.Output3)
crv_56 = Curve(sift_2.Output4)
crv_57 = Curve(sift_2.Output6)
crv_58 = Curve(sift_2.Output7)
crv_59 = Curve(sift_2.Output8)
crv_60 = Curve(sift_2.Output11)
crv_61 = Curve(sift_2.Output13)
crv_62 = Curve(sift_2.Output5)
crv_63 = Curve(sift_2.Output9)
crv_64 = Curve(sift_2.Output10)
crv_65 = Curve(sift_2.Output12)
crv_66 = Curve(sift_3.Output6)
crv_67 = Curve(sift_3.Output7)
crv_68 = Curve(sift_3.Output0)
crv_69 = Curve(sift_3.Output1)
crv_70 = Curve(sift_3.Output2)
crv_71 = Curve(sift_3.Output3)
crv_72 = Curve(sift_3.Output4)
crv_73 = Curve(sift_3.Output5)
pt_37 = Point(Point(0, 0, 0))
number_slider_31 = Slider(24, range=0..100)
pt_38 = Point(Point(0, 0, 0))
number_slider_32 = Slider(24, range=0..100)
pt_39 = Point(Point(0, 0, 0))
number_slider_33 = Slider(24, range=0..100)
pt_40 = Point(Point(0, 0, 0))
number_slider_34 = Slider(24, range=0..100)
pt_41 = Point(Point(0, 0, 0))
number_slider_35 = Slider(24, range=0..100)
pt_42 = Point(Point(0, 0, 0))
number_slider_36 = Slider(24, range=0..100)
pt_43 = Point(Point(0, 0, 0))
number_slider_37 = Slider(24, range=0..100)
square_grid_generator_7 = SquareGridGenerator(origin_point=pt_37, cell_scale=Slider(4, range=0..10), x_axis_extent=number_slider_31, y_axis_extent=number_slider_31)  # -> grid_cell_curves_2, grid_area_centroids
square_grid_generator_8 = SquareGridGenerator(origin_point=pt_38, cell_scale=Slider(4, range=0..10), x_axis_extent=number_slider_32, y_axis_extent=number_slider_32)  # -> grid_cell_curves_2, grid_area_centroids
square_grid_generator_9 = SquareGridGenerator(origin_point=pt_39, cell_scale=Slider(4, range=0..10), x_axis_extent=number_slider_33, y_axis_extent=number_slider_33)  # -> grid_cell_curves_2, grid_area_centroids
square_grid_generator_10 = SquareGridGenerator(origin_point=pt_40, cell_scale=Slider(4, range=0..10), x_axis_extent=number_slider_34, y_axis_extent=number_slider_34)  # -> grid_cell_curves_2, grid_area_centroids
square_grid_generator_11 = SquareGridGenerator(origin_point=pt_41, cell_scale=Slider(4, range=0..10), x_axis_extent=number_slider_35, y_axis_extent=number_slider_35)  # -> grid_cell_curves_2, grid_area_centroids
square_grid_generator_12 = SquareGridGenerator(origin_point=pt_42, cell_scale=Slider(4, range=0..10), x_axis_extent=number_slider_36, y_axis_extent=number_slider_36)  # -> grid_cell_curves_2, grid_area_centroids
square_grid_generator_13 = SquareGridGenerator(origin_point=pt_43, cell_scale=Slider(4, range=0..10), x_axis_extent=number_slider_37, y_axis_extent=number_slider_37)  # -> grid_cell_curves_2, grid_area_centroids
pt_44 = Point(flatten(square_grid_generator_7.grid_area_centroids))
pt_45 = Point(flatten(square_grid_generator_8.grid_area_centroids))
pt_46 = Point(flatten(square_grid_generator_9.grid_area_centroids))
pt_47 = Point(flatten(square_grid_generator_10.grid_area_centroids))
pt_48 = Point(flatten(square_grid_generator_11.grid_area_centroids))
crv_74 = Curve(flatten(square_grid_generator_7.grid_cell_curves_2))
pt_49 = Point(flatten(square_grid_generator_12.grid_area_centroids))
crv_75 = Curve(flatten(square_grid_generator_8.grid_cell_curves_2))
crv_76 = Curve(flatten(square_grid_generator_9.grid_cell_curves_2))
crv_77 = Curve(flatten(square_grid_generator_10.grid_cell_curves_2))
crv_78 = Curve(flatten(square_grid_generator_11.grid_cell_curves_2))
crv_79 = Curve(flatten(square_grid_generator_12.grid_cell_curves_2))
pt_50 = Point(flatten(square_grid_generator_13.grid_area_centroids))
explode_7 = Explode(Curve=crv_74, Recursive=True)  # -> Segments, Vertices
explode_8 = Explode(Curve=crv_75, Recursive=True)  # -> Segments, Vertices
explode_9 = Explode(Curve=crv_76, Recursive=True)  # -> Segments, Vertices
explode_10 = Explode(Curve=crv_77, Recursive=True)  # -> Segments, Vertices
explode_11 = Explode(Curve=crv_78, Recursive=True)  # -> Segments, Vertices
crv_80 = Curve(flatten(square_grid_generator_13.grid_cell_curves_2))
explode_12 = Explode(Curve=crv_79, Recursive=True)  # -> Segments, Vertices
number_slider_38 = Slider(0.2, range=0..1)
number_slider_39 = Slider(0.5, range=0..1)
number_slider_40 = Slider(0.2, range=0..1)
number_slider_41 = Slider(0.4, range=0..1)
number_slider_42 = Slider(0.2, range=0..1)
number_slider_43 = Slider(0.3, range=0..1)
explode_13 = Explode(Curve=crv_80, Recursive=True)  # -> Segments, Vertices
number_slider_44 = Slider(0.2, range=0..1)
number_slider_45 = Slider(0.7, range=0..1)
number_slider_46 = Slider(0.2, range=0..1)
number_slider_47 = Slider(0.2, range=0..1)
number_slider_48 = Slider(0.2, range=0..1)
number_slider_49 = Slider(0.6, range=0..1)
item_13 = ListItem(List=explode_7.Vertices, Index=0, Wrap=True)  # -> Item, Item1, Item2, Item3
item_14 = ListItem(List=explode_7.Segments, Index=0, Wrap=True)  # -> Item, Item1, Item2, Item3
item_15 = ListItem(List=explode_8.Vertices, Index=0, Wrap=True)  # -> Item, Item1, Item2, Item3
item_16 = ListItem(List=explode_8.Segments, Index=0, Wrap=True)  # -> Item, Item1, Item2, Item3
item_17 = ListItem(List=explode_9.Vertices, Index=0, Wrap=True)  # -> Item, Item1, Item2, Item3
item_18 = ListItem(List=explode_9.Segments, Index=0, Wrap=True)  # -> Item, Item1, Item2, Item3
item_19 = ListItem(List=explode_10.Vertices, Index=0, Wrap=True)  # -> Item, Item1, Item2, Item3
item_20 = ListItem(List=explode_11.Vertices, Index=0, Wrap=True)  # -> Item, Item1, Item2, Item3
item_21 = ListItem(List=explode_10.Segments, Index=0, Wrap=True)  # -> Item, Item1, Item2, Item3
item_22 = ListItem(List=explode_11.Segments, Index=0, Wrap=True)  # -> Item, Item1, Item2, Item3
item_23 = ListItem(List=explode_12.Vertices, Index=0, Wrap=True)  # -> Item, Item1, Item2, Item3
item_24 = ListItem(List=explode_12.Segments, Index=0, Wrap=True)  # -> Item, Item1, Item2, Item3
number_slider_50 = Slider(1, range=0..1)
number_slider_51 = Slider(1, range=0..1)
number_slider_52 = Slider(1, range=0..1)
pt_51 = Point(item_13.Item)
pt_52 = Point(item_13.Item1)
pt_53 = Point(item_13.Item3)
pt_54 = Point(item_13.Item2)
number_slider_53 = Slider(1, range=0..1)
number_slider_54 = Slider(1, range=0..1)
pt_55 = Point(item_15.Item)
pt_56 = Point(item_15.Item1)
pt_57 = Point(item_15.Item3)
pt_58 = Point(item_15.Item2)
number_slider_55 = Slider(1, range=0..1)
pt_59 = Point(item_17.Item)
pt_60 = Point(item_17.Item1)
pt_61 = Point(item_17.Item3)
pt_62 = Point(item_17.Item2)
pt_63 = Point(item_19.Item)
pt_64 = Point(item_19.Item1)
pt_65 = Point(item_19.Item3)
pt_66 = Point(item_19.Item2)
pt_67 = Point(item_20.Item)
pt_68 = Point(item_20.Item1)
pt_69 = Point(item_20.Item3)
pt_70 = Point(item_20.Item2)
pt_71 = Point(item_23.Item)
pt_72 = Point(item_23.Item1)
pt_73 = Point(item_23.Item3)
pt_74 = Point(item_23.Item2)
number_slider_56 = Slider(0.5, range=0..1)
number_slider_57 = Slider(0.2, range=0..1)
item_25 = ListItem(List=explode_13.Vertices, Index=0, Wrap=True)  # -> Item, Item1, Item2, Item3
item_26 = ListItem(List=explode_13.Segments, Index=0, Wrap=True)  # -> Item, Item1, Item2, Item3
subtraction_13 = Subtraction(A=number_slider_50, B=number_slider_38)
ln_31 = Line(StartPoint=pt_52, EndPoint=pt_53)
subtraction_14 = Subtraction(A=number_slider_51, B=number_slider_40)
subtraction_15 = Subtraction(A=number_slider_50, B=number_slider_39)
ln_32 = Line(StartPoint=pt_56, EndPoint=pt_57)
number_slider_58 = Slider(1, range=0..1)
subtraction_16 = Subtraction(A=number_slider_52, B=number_slider_42)
subtraction_17 = Subtraction(A=number_slider_51, B=number_slider_41)
ln_33 = Line(StartPoint=pt_60, EndPoint=pt_61)
subtraction_18 = Subtraction(A=number_slider_53, B=number_slider_44)
subtraction_19 = Subtraction(A=number_slider_54, B=number_slider_46)
ln_34 = Line(StartPoint=pt_64, EndPoint=pt_65)
subtraction_20 = Subtraction(A=number_slider_52, B=number_slider_43)
ln_35 = Line(StartPoint=pt_68, EndPoint=pt_69)
pt_75 = Point(item_25.Item)
pt_76 = Point(item_25.Item1)
pt_77 = Point(item_25.Item2)
pt_78 = Point(item_25.Item3)
subtraction_21 = Subtraction(A=number_slider_55, B=number_slider_48)
subtraction_22 = Subtraction(A=number_slider_53, B=number_slider_45)
ln_36 = Line(StartPoint=pt_72, EndPoint=pt_73)
subtraction_23 = Subtraction(A=number_slider_54, B=number_slider_47)
subtraction_24 = Subtraction(A=number_slider_55, B=number_slider_49)
eval_31 = EvaluateCurve(Curve=reparameterize(item_14.Item), Parameter=number_slider_39)  # -> Point, Tangent, Angle
eval_32 = EvaluateCurve(Curve=reparameterize(item_14.Item2), Parameter=number_slider_38)  # -> Point, Tangent, Angle
eval_33 = EvaluateCurve(Curve=reparameterize(item_16.Item), Parameter=number_slider_41)  # -> Point, Tangent, Angle
eval_34 = EvaluateCurve(Curve=reparameterize(item_14.Item1), Parameter=subtraction_15)  # -> Point, Tangent, Angle
eval_35 = EvaluateCurve(Curve=reparameterize(item_14.Item3), Parameter=subtraction_13)  # -> Point, Tangent, Angle
eval_36 = EvaluateCurve(Curve=reparameterize(ln_31), Parameter=number_slider_38)  # -> Point, Tangent, Angle
eval_37 = EvaluateCurve(Curve=reparameterize(item_16.Item2), Parameter=number_slider_40)  # -> Point, Tangent, Angle
eval_38 = EvaluateCurve(Curve=reparameterize(item_18.Item), Parameter=number_slider_43)  # -> Point, Tangent, Angle
eval_39 = EvaluateCurve(Curve=reparameterize(item_16.Item1), Parameter=subtraction_17)  # -> Point, Tangent, Angle
eval_40 = EvaluateCurve(Curve=reparameterize(item_16.Item3), Parameter=subtraction_14)  # -> Point, Tangent, Angle
eval_41 = EvaluateCurve(Curve=reparameterize(ln_32), Parameter=number_slider_40)  # -> Point, Tangent, Angle
eval_42 = EvaluateCurve(Curve=reparameterize(item_21.Item), Parameter=number_slider_45)  # -> Point, Tangent, Angle
eval_43 = EvaluateCurve(Curve=reparameterize(item_18.Item2), Parameter=number_slider_42)  # -> Point, Tangent, Angle
eval_44 = EvaluateCurve(Curve=reparameterize(item_22.Item), Parameter=number_slider_47)  # -> Point, Tangent, Angle
eval_45 = EvaluateCurve(Curve=reparameterize(item_18.Item1), Parameter=subtraction_20)  # -> Point, Tangent, Angle
eval_46 = EvaluateCurve(Curve=reparameterize(item_18.Item3), Parameter=subtraction_16)  # -> Point, Tangent, Angle
eval_47 = EvaluateCurve(Curve=reparameterize(ln_33), Parameter=number_slider_42)  # -> Point, Tangent, Angle
eval_48 = EvaluateCurve(Curve=reparameterize(item_21.Item2), Parameter=number_slider_44)  # -> Point, Tangent, Angle
eval_49 = EvaluateCurve(Curve=reparameterize(item_24.Item), Parameter=number_slider_49)  # -> Point, Tangent, Angle
eval_50 = EvaluateCurve(Curve=reparameterize(item_22.Item2), Parameter=number_slider_46)  # -> Point, Tangent, Angle
eval_51 = EvaluateCurve(Curve=reparameterize(item_21.Item1), Parameter=subtraction_22)  # -> Point, Tangent, Angle
eval_52 = EvaluateCurve(Curve=reparameterize(item_21.Item3), Parameter=subtraction_18)  # -> Point, Tangent, Angle
eval_53 = EvaluateCurve(Curve=reparameterize(item_22.Item1), Parameter=subtraction_23)  # -> Point, Tangent, Angle
eval_54 = EvaluateCurve(Curve=reparameterize(item_22.Item3), Parameter=subtraction_19)  # -> Point, Tangent, Angle
eval_55 = EvaluateCurve(Curve=reparameterize(ln_34), Parameter=number_slider_44)  # -> Point, Tangent, Angle
eval_56 = EvaluateCurve(Curve=reparameterize(ln_35), Parameter=number_slider_46)  # -> Point, Tangent, Angle
eval_57 = EvaluateCurve(Curve=reparameterize(item_24.Item2), Parameter=number_slider_48)  # -> Point, Tangent, Angle
eval_58 = EvaluateCurve(Curve=reparameterize(item_24.Item1), Parameter=subtraction_24)  # -> Point, Tangent, Angle
eval_59 = EvaluateCurve(Curve=reparameterize(item_24.Item3), Parameter=subtraction_21)  # -> Point, Tangent, Angle
eval_60 = EvaluateCurve(Curve=reparameterize(ln_36), Parameter=number_slider_48)  # -> Point, Tangent, Angle
subtraction_25 = Subtraction(A=number_slider_58, B=number_slider_57)
ln_37 = Line(StartPoint=pt_76, EndPoint=pt_78)
subtraction_26 = Subtraction(A=number_slider_58, B=number_slider_56)
ln_38 = Line(StartPoint=eval_31.Point, EndPoint=eval_32.Point)
ln_39 = Line(StartPoint=eval_34.Point, EndPoint=eval_35.Point)
ln_40 = Line(StartPoint=pt_51, EndPoint=eval_36.Point)
ln_41 = Line(StartPoint=eval_33.Point, EndPoint=eval_37.Point)
ln_42 = Line(StartPoint=pt_54, EndPoint=eval_36.Point)
ln_43 = Line(StartPoint=eval_39.Point, EndPoint=eval_40.Point)
ln_44 = Line(StartPoint=pt_55, EndPoint=eval_41.Point)
ln_45 = Line(StartPoint=eval_38.Point, EndPoint=eval_43.Point)
ln_46 = Line(StartPoint=pt_58, EndPoint=eval_41.Point)
ln_47 = Line(StartPoint=eval_45.Point, EndPoint=eval_46.Point)
ln_48 = Line(StartPoint=eval_42.Point, EndPoint=eval_48.Point)
ln_49 = Line(StartPoint=pt_59, EndPoint=eval_47.Point)
ln_50 = Line(StartPoint=eval_44.Point, EndPoint=eval_50.Point)
ln_51 = Line(StartPoint=eval_51.Point, EndPoint=eval_52.Point)
ln_52 = Line(StartPoint=pt_62, EndPoint=eval_47.Point)
ln_53 = Line(StartPoint=eval_53.Point, EndPoint=eval_54.Point)
ln_54 = Line(StartPoint=pt_63, EndPoint=eval_55.Point)
ln_55 = Line(StartPoint=eval_49.Point, EndPoint=eval_57.Point)
ln_56 = Line(StartPoint=pt_67, EndPoint=eval_56.Point)
ln_57 = Line(StartPoint=pt_66, EndPoint=eval_55.Point)
ln_58 = Line(StartPoint=eval_58.Point, EndPoint=eval_59.Point)
ln_59 = Line(StartPoint=pt_70, EndPoint=eval_56.Point)
ln_60 = Line(StartPoint=pt_71, EndPoint=eval_60.Point)
eval_61 = EvaluateCurve(Curve=reparameterize(item_26.Item), Parameter=number_slider_56)  # -> Point, Tangent, Angle
ln_61 = Line(StartPoint=pt_74, EndPoint=eval_60.Point)
eval_62 = EvaluateCurve(Curve=reparameterize(item_26.Item2), Parameter=number_slider_57)  # -> Point, Tangent, Angle
eval_63 = EvaluateCurve(Curve=reparameterize(item_26.Item1), Parameter=subtraction_26)  # -> Point, Tangent, Angle
eval_64 = EvaluateCurve(Curve=reparameterize(item_26.Item3), Parameter=subtraction_25)  # -> Point, Tangent, Angle
eval_65 = EvaluateCurve(Curve=reparameterize(ln_37), Parameter=number_slider_57)  # -> Point, Tangent, Angle
number_slider_59 = Slider(4, range=0..10)
number_slider_60 = Slider(4, range=0..10)
number_slider_61 = Slider(4, range=0..10)
number_slider_62 = Slider(4, range=0..10)
number_slider_63 = Slider(4, range=0..10)
number_slider_64 = Slider(4, range=0..10)
ln_62 = Line(StartPoint=eval_61.Point, EndPoint=eval_62.Point)
ln_63 = Line(StartPoint=eval_63.Point, EndPoint=eval_64.Point)
ln_64 = Line(StartPoint=pt_75, EndPoint=eval_65.Point)
ln_65 = Line(StartPoint=pt_77, EndPoint=eval_65.Point)
number_slider_65 = Slider(4, range=0..10)
arrpolar_13 = PolarArray(Geometry=[ln_38, ln_39], Plane=graft(pt_44), Count=number_slider_59, Angle=6.283185307)  # -> Geometry, Transform
arrpolar_14 = PolarArray(Geometry=[ln_41, ln_43], Plane=graft(pt_45), Count=number_slider_60, Angle=6.283185307)  # -> Geometry, Transform
arrpolar_15 = PolarArray(Geometry=[ln_40, ln_42], Plane=graft(pt_44), Count=number_slider_59, Angle=6.283185307)  # -> Geometry, Transform
arrpolar_16 = PolarArray(Geometry=[ln_45, ln_47], Plane=graft(pt_46), Count=number_slider_61, Angle=6.283185307)  # -> Geometry, Transform
arrpolar_17 = PolarArray(Geometry=[ln_44, ln_46], Plane=graft(pt_45), Count=number_slider_60, Angle=6.283185307)  # -> Geometry, Transform
arrpolar_18 = PolarArray(Geometry=[ln_48, ln_51], Plane=graft(pt_47), Count=number_slider_62, Angle=6.283185307)  # -> Geometry, Transform
arrpolar_19 = PolarArray(Geometry=[ln_50, ln_53], Plane=graft(pt_48), Count=number_slider_63, Angle=6.283185307)  # -> Geometry, Transform
arrpolar_20 = PolarArray(Geometry=[ln_49, ln_52], Plane=graft(pt_46), Count=number_slider_61, Angle=6.283185307)  # -> Geometry, Transform
arrpolar_21 = PolarArray(Geometry=[ln_55, ln_58], Plane=graft(pt_49), Count=number_slider_64, Angle=6.283185307)  # -> Geometry, Transform
arrpolar_22 = PolarArray(Geometry=[ln_54, ln_57], Plane=graft(pt_47), Count=number_slider_62, Angle=6.283185307)  # -> Geometry, Transform
arrpolar_23 = PolarArray(Geometry=[ln_56, ln_59], Plane=graft(pt_48), Count=number_slider_63, Angle=6.283185307)  # -> Geometry, Transform
arrpolar_24 = PolarArray(Geometry=[ln_60, ln_61], Plane=graft(pt_49), Count=number_slider_64, Angle=6.283185307)  # -> Geometry, Transform
crv_81 = Curve(arrpolar_13.Geometry)
crv_82 = Curve(arrpolar_15.Geometry)
crv_83 = Curve(arrpolar_14.Geometry)
crv_84 = Curve(arrpolar_17.Geometry)
crv_85 = Curve(arrpolar_16.Geometry)
crv_86 = Curve(arrpolar_18.Geometry)
crv_87 = Curve(arrpolar_20.Geometry)
crv_88 = Curve(arrpolar_19.Geometry)
crv_89 = Curve(arrpolar_22.Geometry)
crv_90 = Curve(arrpolar_21.Geometry)
crv_91 = Curve(arrpolar_23.Geometry)
crv_92 = Curve(arrpolar_24.Geometry)
arrpolar_25 = PolarArray(Geometry=[ln_62, ln_63], Plane=graft(pt_50), Count=number_slider_65, Angle=6.283185307)  # -> Geometry, Transform
arrpolar_26 = PolarArray(Geometry=[ln_64, ln_65], Plane=graft(pt_50), Count=number_slider_65, Angle=6.283185307)  # -> Geometry, Transform
crv_93 = Curve(flatten([crv_81, crv_82]))
crv_94 = Curve(flatten([crv_83, crv_84]))
crv_95 = Curve(flatten([crv_85, crv_87]))
crv_96 = Curve(flatten([crv_86, crv_89]))
crv_97 = Curve(flatten([crv_88, crv_91]))
crv_98 = Curve(flatten([crv_90, crv_92]))
crv_99 = Curve(arrpolar_25.Geometry)
crv_100 = Curve(arrpolar_26.Geometry)
crv_101 = Curve(flatten([crv_99, crv_100]))
bbox_7 = BoundingBox(Content=crv_93, Plane=PlaneXY(0, 0, 0), UnionBox=True)  # -> Box, Box_2
bbox_8 = BoundingBox(Content=crv_94, Plane=PlaneXY(0, 0, 0), UnionBox=True)  # -> Box, Box_2
bbox_9 = BoundingBox(Content=crv_95, Plane=PlaneXY(0, 0, 0), UnionBox=True)  # -> Box, Box_2
bbox_10 = BoundingBox(Content=crv_96, Plane=PlaneXY(0, 0, 0), UnionBox=True)  # -> Box, Box_2
bbox_11 = BoundingBox(Content=crv_97, Plane=PlaneXY(0, 0, 0), UnionBox=True)  # -> Box, Box_2
bbox_12 = BoundingBox(Content=crv_98, Plane=PlaneXY(0, 0, 0), UnionBox=True)  # -> Box, Box_2
srfsplit_7 = SurfaceSplit(Surface=bbox_7.Box, Curves=crv_93)
srfsplit_8 = SurfaceSplit(Surface=bbox_8.Box, Curves=crv_94)
srfsplit_9 = SurfaceSplit(Surface=bbox_9.Box, Curves=crv_95)
srfsplit_10 = SurfaceSplit(Surface=bbox_10.Box, Curves=crv_96)
srfsplit_11 = SurfaceSplit(Surface=bbox_11.Box, Curves=crv_97)
srfsplit_12 = SurfaceSplit(Surface=bbox_12.Box, Curves=crv_98)
bbox_13 = BoundingBox(Content=crv_101, Plane=PlaneXY(0, 0, 0), UnionBox=True)  # -> Box, Box_2
crv_102 = Curve(srfsplit_7)
crv_103 = Curve(srfsplit_8)
crv_104 = Curve(srfsplit_9)
crv_105 = Curve(srfsplit_10)
crv_106 = Curve(srfsplit_11)
crv_107 = Curve(srfsplit_12)
srfsplit_13 = SurfaceSplit(Surface=bbox_13.Box, Curves=crv_101)
area_10 = Area(Geometry=crv_102)  # -> Area, Centroid
area_11 = Area(Geometry=crv_103)  # -> Area, Centroid
crv_108 = Curve(srfsplit_13)
area_12 = Area(Geometry=crv_104)  # -> Area, Centroid
area_13 = Area(Geometry=crv_105)  # -> Area, Centroid
area_14 = Area(Geometry=crv_106)  # -> Area, Centroid
area_15 = Area(Geometry=crv_107)  # -> Area, Centroid
scale_7 = Scale(Geometry=crv_102, Center=area_10.Centroid, Factor=Slider(0.85, range=0..1))  # -> Geometry, Transform
scale_8 = Scale(Geometry=crv_103, Center=area_11.Centroid, Factor=Slider(0.85, range=0..1))  # -> Geometry, Transform
scale_9 = Scale(Geometry=crv_104, Center=area_12.Centroid, Factor=Slider(0.85, range=0..1))  # -> Geometry, Transform
scale_10 = Scale(Geometry=crv_105, Center=area_13.Centroid, Factor=Slider(0.85, range=0..1))  # -> Geometry, Transform
scale_11 = Scale(Geometry=crv_106, Center=area_14.Centroid, Factor=Slider(0.85, range=0..1))  # -> Geometry, Transform
scale_12 = Scale(Geometry=crv_107, Center=area_15.Centroid, Factor=Slider(0.85, range=0..1))  # -> Geometry, Transform
area_16 = Area(Geometry=crv_108)  # -> Area, Centroid
scale_13 = Scale(Geometry=crv_108, Center=area_16.Centroid, Factor=Slider(0.85, range=0..1))  # -> Geometry, Transform
area_17 = Area(Geometry=crv_108)  # -> Area, Centroid
crv_109 = Curve(scale_7.Geometry)
crv_110 = Curve(scale_8.Geometry)
crv_111 = Curve(scale_9.Geometry)
cset_4 = CreateSet(List=area_17.Area)  # -> Set, Map
crv_112 = Curve(scale_10.Geometry)
crv_113 = Curve(scale_11.Geometry)
crv_114 = Curve(scale_12.Geometry)
sift_4 = SiftPattern(List=crv_108, SiftPattern=cset_4.Map)  # -> Output0, Output1, Output2, Output3, Output4, Output5, Output6, Output7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
crv_115 = Curve(scale_13.Geometry)
crv_116 = Curve(sift_4.Output6)
crv_117 = Curve(sift_4.Output7)
crv_118 = Curve(sift_4.Output8)
crv_119 = Curve(sift_4.Output11)
crv_120 = Curve(sift_4.Output0)
crv_121 = Curve(sift_4.Output1)
crv_122 = Curve(sift_4.Output2)
crv_123 = Curve(sift_4.Output3)
crv_124 = Curve(sift_4.Output4)
crv_125 = Curve(sift_4.Output5)
crv_126 = Curve(sift_4.Output9)
crv_127 = Curve(sift_4.Output10)
crv_128 = Curve(sift_4.Output12)
crv_129 = Curve(sift_4.Output13)
crv_130 = Curve([crv_120, crv_116, crv_118])
crv_131 = Curve([crv_117, crv_120, crv_118, crv_116])
crv_132 = Curve([crv_119, crv_126])
crv_133 = Curve([crv_129, crv_128])
runion = RegionUnion(Curves=crv_132)
runion_2 = RegionUnion(Curves=crv_133)
runion_3 = RegionUnion(Curves=crv_131)
runion_4 = RegionUnion(Curves=crv_130)
pt_79 = Point(Point(0, 0, 0))
number_slider_66 = Slider(24, range=0..100)
area_18 = Area(Geometry=crv_131)  # -> Area, Centroid
area_19 = Area(Geometry=crv_132)  # -> Area, Centroid
pt_80 = Point(Point(0, 0, 0))
number_slider_67 = Slider(24, range=0..100)
area_20 = Area(Geometry=crv_130)  # -> Area, Centroid
pt_81 = Point(Point(0, 0, 0))
number_slider_68 = Slider(24, range=0..100)
pt_82 = Point(Point(0, 0, 0))
number_slider_69 = Slider(24, range=0..100)
crv_134 = Curve(<curve referenced from the Rhino model>)
crv_135 = Curve(<curve referenced from the Rhino model>)
crv_136 = Curve(<curve referenced from the Rhino model>)
crv_137 = Curve(runion_4)
crv_138 = Curve(runion_3)
crv_139 = Curve(runion)
crv_140 = Curve(runion_2)
square_grid_generator_14 = SquareGridGenerator(origin_point=pt_79, cell_scale=Slider(4, range=0..10), x_axis_extent=number_slider_66, y_axis_extent=number_slider_66)  # -> grid_cell_curves_2, grid_area_centroids
square_grid_generator_15 = SquareGridGenerator(origin_point=pt_80, cell_scale=Slider(4, range=0..10), x_axis_extent=number_slider_67, y_axis_extent=number_slider_67)  # -> grid_cell_curves_2, grid_area_centroids
square_grid_generator_16 = SquareGridGenerator(origin_point=pt_81, cell_scale=Slider(4, range=0..10), x_axis_extent=number_slider_68, y_axis_extent=number_slider_68)  # -> grid_cell_curves_2, grid_area_centroids
square_grid_generator_17 = SquareGridGenerator(origin_point=pt_82, cell_scale=Slider(4, range=0..10), x_axis_extent=number_slider_69, y_axis_extent=number_slider_69)  # -> grid_cell_curves_2, grid_area_centroids
area_21 = Area()  # -> Area, Centroid
curve_attractor = CurveAttractor(C=crv_134, P=area_18.Centroid, A=Slider(0.8, range=0..1), B=Slider(0.2, range=0..1))  # -> R, points_on_curve_2
curve_attractor_2 = CurveAttractor(C=crv_135, P=area_19.Centroid, A=Slider(0.8, range=0..1), B=Slider(0.2, range=0..1))  # -> R, points_on_curve_2
curve_attractor_3 = CurveAttractor(C=crv_136, P=area_20.Centroid, A=Slider(0.8, range=0..1), B=Slider(0.2, range=0..1))  # -> R, points_on_curve_2
crv_141 = Curve(<curve referenced from the Rhino model>)
pt_83 = Point(flatten(square_grid_generator_14.grid_area_centroids))
pt_84 = Point(flatten(square_grid_generator_15.grid_area_centroids))
pt_85 = Point(flatten(square_grid_generator_16.grid_area_centroids))
pt_86 = Point(flatten(square_grid_generator_17.grid_area_centroids))
crv_142 = Curve(flatten(square_grid_generator_14.grid_cell_curves_2))
crv_143 = Curve(flatten(square_grid_generator_15.grid_cell_curves_2))
crv_144 = Curve(flatten(square_grid_generator_16.grid_cell_curves_2))
crv_145 = Curve(flatten(square_grid_generator_17.grid_cell_curves_2))
curve_attractor_4 = CurveAttractor(C=crv_141, P=area_21.Centroid, A=Slider(0.8, range=0..1), B=Slider(0.2, range=0..1))  # -> R, points_on_curve_2
explode_14 = Explode(Curve=crv_142, Recursive=True)  # -> Segments, Vertices
explode_15 = Explode(Curve=crv_143, Recursive=True)  # -> Segments, Vertices
explode_16 = Explode(Curve=crv_144, Recursive=True)  # -> Segments, Vertices
explode_17 = Explode(Curve=crv_145, Recursive=True)  # -> Segments, Vertices
scale_14 = Scale(Geometry=crv_131, Center=area_18.Centroid, Factor=curve_attractor.R)  # -> Geometry, Transform
scale_15 = Scale(Geometry=crv_132, Center=area_19.Centroid, Factor=curve_attractor_2.R)  # -> Geometry, Transform
scale_16 = Scale(Geometry=crv_130, Center=area_20.Centroid, Factor=curve_attractor_3.R)  # -> Geometry, Transform
number_slider_70 = Slider(0.8, range=0..1)
number_slider_71 = Slider(0.2, range=0..1)
number_slider_72 = Slider(0.7, range=0..1)
number_slider_73 = Slider(0.3, range=0..1)
number_slider_74 = Slider(0.6, range=0..1)
number_slider_75 = Slider(0.4, range=0..1)
number_slider_76 = Slider(0.5, range=0..1)
number_slider_77 = Slider(0.5, range=0..1)
item_27 = ListItem(List=explode_14.Vertices, Index=0, Wrap=True)  # -> Item, Item1, Item2, Item3
item_28 = ListItem(List=explode_14.Segments, Index=0, Wrap=True)  # -> Item, Item1, Item2, Item3
item_29 = ListItem(List=explode_15.Vertices, Index=0, Wrap=True)  # -> Item, Item1, Item2, Item3
item_30 = ListItem(List=explode_15.Segments, Index=0, Wrap=True)  # -> Item, Item1, Item2, Item3
item_31 = ListItem(List=explode_16.Vertices, Index=0, Wrap=True)  # -> Item, Item1, Item2, Item3
item_32 = ListItem(List=explode_16.Segments, Index=0, Wrap=True)  # -> Item, Item1, Item2, Item3
item_33 = ListItem(List=explode_17.Vertices, Index=0, Wrap=True)  # -> Item, Item1, Item2, Item3
item_34 = ListItem(List=explode_17.Segments, Index=0, Wrap=True)  # -> Item, Item1, Item2, Item3
number_slider_78 = Slider(1, range=0..1)
number_slider_79 = Slider(1, range=0..1)
number_slider_80 = Slider(1, range=0..1)
pt_87 = Point(item_27.Item)
pt_88 = Point(item_27.Item1)
pt_89 = Point(item_27.Item2)
pt_90 = Point(item_27.Item3)
number_slider_81 = Slider(1, range=0..1)
pt_91 = Point(item_29.Item)
pt_92 = Point(item_29.Item1)
pt_93 = Point(item_29.Item2)
pt_94 = Point(item_29.Item3)
pt_95 = Point(item_31.Item)
pt_96 = Point(item_31.Item1)
pt_97 = Point(item_31.Item2)
pt_98 = Point(item_31.Item3)
pt_99 = Point(item_33.Item)
pt_100 = Point(item_33.Item1)
pt_101 = Point(item_33.Item2)
pt_102 = Point(item_33.Item3)
scale_17 = Scale(Center=area_21.Centroid, Factor=curve_attractor_4.R)  # -> Geometry, Transform
subtraction_27 = Subtraction(A=number_slider_78, B=number_slider_70)
ln_66 = Line(StartPoint=pt_88, EndPoint=pt_90)
subtraction_28 = Subtraction(A=number_slider_79, B=number_slider_72)
subtraction_29 = Subtraction(A=number_slider_78, B=number_slider_71)
ln_67 = Line(StartPoint=pt_92, EndPoint=pt_94)
subtraction_30 = Subtraction(A=number_slider_80, B=number_slider_74)
subtraction_31 = Subtraction(A=number_slider_79, B=number_slider_73)
ln_68 = Line(StartPoint=pt_96, EndPoint=pt_98)
subtraction_32 = Subtraction(A=number_slider_81, B=number_slider_76)
subtraction_33 = Subtraction(A=number_slider_80, B=number_slider_75)
ln_69 = Line(StartPoint=pt_100, EndPoint=pt_102)
subtraction_34 = Subtraction(A=number_slider_81, B=number_slider_77)
eval_66 = EvaluateCurve(Curve=reparameterize(item_28.Item), Parameter=number_slider_71)  # -> Point, Tangent, Angle
eval_67 = EvaluateCurve(Curve=reparameterize(item_28.Item2), Parameter=number_slider_70)  # -> Point, Tangent, Angle
eval_68 = EvaluateCurve(Curve=reparameterize(item_30.Item), Parameter=number_slider_73)  # -> Point, Tangent, Angle
eval_69 = EvaluateCurve(Curve=reparameterize(item_28.Item1), Parameter=subtraction_29)  # -> Point, Tangent, Angle
eval_70 = EvaluateCurve(Curve=reparameterize(item_28.Item3), Parameter=subtraction_27)  # -> Point, Tangent, Angle
eval_71 = EvaluateCurve(Curve=reparameterize(ln_66), Parameter=number_slider_70)  # -> Point, Tangent, Angle
eval_72 = EvaluateCurve(Curve=reparameterize(item_30.Item2), Parameter=number_slider_72)  # -> Point, Tangent, Angle
eval_73 = EvaluateCurve(Curve=reparameterize(item_32.Item), Parameter=number_slider_75)  # -> Point, Tangent, Angle
eval_74 = EvaluateCurve(Curve=reparameterize(item_30.Item1), Parameter=subtraction_31)  # -> Point, Tangent, Angle
eval_75 = EvaluateCurve(Curve=reparameterize(item_30.Item3), Parameter=subtraction_28)  # -> Point, Tangent, Angle
eval_76 = EvaluateCurve(Curve=reparameterize(ln_67), Parameter=number_slider_72)  # -> Point, Tangent, Angle
eval_77 = EvaluateCurve(Curve=reparameterize(item_32.Item2), Parameter=number_slider_74)  # -> Point, Tangent, Angle
eval_78 = EvaluateCurve(Curve=reparameterize(item_34.Item), Parameter=number_slider_77)  # -> Point, Tangent, Angle
eval_79 = EvaluateCurve(Curve=reparameterize(item_32.Item1), Parameter=subtraction_33)  # -> Point, Tangent, Angle
eval_80 = EvaluateCurve(Curve=reparameterize(item_32.Item3), Parameter=subtraction_30)  # -> Point, Tangent, Angle
eval_81 = EvaluateCurve(Curve=reparameterize(ln_68), Parameter=number_slider_74)  # -> Point, Tangent, Angle
eval_82 = EvaluateCurve(Curve=reparameterize(item_34.Item2), Parameter=number_slider_76)  # -> Point, Tangent, Angle
eval_83 = EvaluateCurve(Curve=reparameterize(item_34.Item1), Parameter=subtraction_34)  # -> Point, Tangent, Angle
eval_84 = EvaluateCurve(Curve=reparameterize(item_34.Item3), Parameter=subtraction_32)  # -> Point, Tangent, Angle
eval_85 = EvaluateCurve(Curve=reparameterize(ln_69), Parameter=number_slider_76)  # -> Point, Tangent, Angle
ln_70 = Line(StartPoint=eval_66.Point, EndPoint=eval_67.Point)
ln_71 = Line(StartPoint=eval_69.Point, EndPoint=eval_70.Point)
ln_72 = Line(StartPoint=pt_87, EndPoint=eval_71.Point)
ln_73 = Line(StartPoint=eval_68.Point, EndPoint=eval_72.Point)
ln_74 = Line(StartPoint=pt_89, EndPoint=eval_71.Point)
ln_75 = Line(StartPoint=eval_74.Point, EndPoint=eval_75.Point)
ln_76 = Line(StartPoint=pt_91, EndPoint=eval_76.Point)
ln_77 = Line(StartPoint=eval_73.Point, EndPoint=eval_77.Point)
ln_78 = Line(StartPoint=pt_93, EndPoint=eval_76.Point)
ln_79 = Line(StartPoint=eval_79.Point, EndPoint=eval_80.Point)
ln_80 = Line(StartPoint=pt_95, EndPoint=eval_81.Point)
ln_81 = Line(StartPoint=eval_78.Point, EndPoint=eval_82.Point)
ln_82 = Line(StartPoint=pt_97, EndPoint=eval_81.Point)
ln_83 = Line(StartPoint=eval_83.Point, EndPoint=eval_84.Point)
ln_84 = Line(StartPoint=pt_99, EndPoint=eval_85.Point)
ln_85 = Line(StartPoint=pt_101, EndPoint=eval_85.Point)
number_slider_82 = Slider(4, range=0..10)
number_slider_83 = Slider(4, range=0..10)
number_slider_84 = Slider(4, range=0..10)
number_slider_85 = Slider(4, range=0..10)
arrpolar_27 = PolarArray(Geometry=[ln_70, ln_71], Plane=graft(pt_83), Count=number_slider_82, Angle=6.283185307)  # -> Geometry, Transform
arrpolar_28 = PolarArray(Geometry=[ln_73, ln_75], Plane=graft(pt_84), Count=number_slider_83, Angle=6.283185307)  # -> Geometry, Transform
arrpolar_29 = PolarArray(Geometry=[ln_72, ln_74], Plane=graft(pt_83), Count=number_slider_82, Angle=6.283185307)  # -> Geometry, Transform
arrpolar_30 = PolarArray(Geometry=[ln_77, ln_79], Plane=graft(pt_85), Count=number_slider_84, Angle=6.283185307)  # -> Geometry, Transform
arrpolar_31 = PolarArray(Geometry=[ln_76, ln_78], Plane=graft(pt_84), Count=number_slider_83, Angle=6.283185307)  # -> Geometry, Transform
arrpolar_32 = PolarArray(Geometry=[ln_81, ln_83], Plane=graft(pt_86), Count=number_slider_85, Angle=6.283185307)  # -> Geometry, Transform
arrpolar_33 = PolarArray(Geometry=[ln_80, ln_82], Plane=graft(pt_85), Count=number_slider_84, Angle=6.283185307)  # -> Geometry, Transform
arrpolar_34 = PolarArray(Geometry=[ln_84, ln_85], Plane=graft(pt_86), Count=number_slider_85, Angle=6.283185307)  # -> Geometry, Transform
crv_146 = Curve(arrpolar_27.Geometry)
crv_147 = Curve(arrpolar_29.Geometry)
crv_148 = Curve(arrpolar_28.Geometry)
crv_149 = Curve(arrpolar_31.Geometry)
crv_150 = Curve(arrpolar_30.Geometry)
crv_151 = Curve(arrpolar_33.Geometry)
crv_152 = Curve(arrpolar_32.Geometry)
crv_153 = Curve(arrpolar_34.Geometry)
crv_154 = Curve(flatten([crv_146, crv_147]))
crv_155 = Curve(flatten([crv_148, crv_149]))
crv_156 = Curve(flatten([crv_150, crv_151]))
crv_157 = Curve(flatten([crv_152, crv_153]))
bbox_14 = BoundingBox(Content=crv_154, Plane=PlaneXY(0, 0, 0), UnionBox=True)  # -> Box, Box_2
bbox_15 = BoundingBox(Content=crv_155, Plane=PlaneXY(0, 0, 0), UnionBox=True)  # -> Box, Box_2
bbox_16 = BoundingBox(Content=crv_156, Plane=PlaneXY(0, 0, 0), UnionBox=True)  # -> Box, Box_2
bbox_17 = BoundingBox(Content=crv_157, Plane=PlaneXY(0, 0, 0), UnionBox=True)  # -> Box, Box_2
srfsplit_14 = SurfaceSplit(Surface=bbox_14.Box, Curves=crv_154)
srfsplit_15 = SurfaceSplit(Surface=bbox_15.Box, Curves=crv_155)
srfsplit_16 = SurfaceSplit(Surface=bbox_16.Box, Curves=crv_156)
srfsplit_17 = SurfaceSplit(Surface=bbox_17.Box, Curves=crv_157)
crv_158 = Curve(srfsplit_14)
crv_159 = Curve(srfsplit_15)
crv_160 = Curve(srfsplit_16)
crv_161 = Curve(srfsplit_17)
area_22 = Area(Geometry=crv_158)  # -> Area, Centroid
area_23 = Area(Geometry=crv_159)  # -> Area, Centroid
area_24 = Area(Geometry=crv_160)  # -> Area, Centroid
area_25 = Area(Geometry=crv_161)  # -> Area, Centroid
scale_18 = Scale(Geometry=crv_158, Center=area_22.Centroid, Factor=Slider(0.85, range=0..1))  # -> Geometry, Transform
scale_19 = Scale(Geometry=crv_159, Center=area_23.Centroid, Factor=Slider(0.85, range=0..1))  # -> Geometry, Transform
scale_20 = Scale(Geometry=crv_160, Center=area_24.Centroid, Factor=Slider(0.85, range=0..1))  # -> Geometry, Transform
scale_21 = Scale(Geometry=crv_161, Center=area_25.Centroid, Factor=Slider(0.85, range=0..1))  # -> Geometry, Transform
crv_162 = Curve(scale_18.Geometry)
crv_163 = Curve(scale_19.Geometry)
crv_164 = Curve(scale_20.Geometry)
crv_165 = Curve(scale_21.Geometry)
pt_103 = Point(Point(0, 0, 0))
number_slider_86 = Slider(24, range=0..100)
pt_104 = Point(Point(0, 0, 0))
number_slider_87 = Slider(24, range=0..100)
pt_105 = Point(Point(0, 0, 0))
number_slider_88 = Slider(24, range=0..100)
pt_106 = Point(Point(0, 0, 0))
number_slider_89 = Slider(24, range=0..100)
square_grid_generator_18 = SquareGridGenerator(origin_point=pt_103, cell_scale=Slider(4, range=0..10), x_axis_extent=number_slider_86, y_axis_extent=number_slider_86)  # -> grid_cell_curves_2, grid_area_centroids
square_grid_generator_19 = SquareGridGenerator(origin_point=pt_104, cell_scale=Slider(4, range=0..10), x_axis_extent=number_slider_87, y_axis_extent=number_slider_87)  # -> grid_cell_curves_2, grid_area_centroids
square_grid_generator_20 = SquareGridGenerator(origin_point=pt_105, cell_scale=Slider(4, range=0..10), x_axis_extent=number_slider_88, y_axis_extent=number_slider_88)  # -> grid_cell_curves_2, grid_area_centroids
square_grid_generator_21 = SquareGridGenerator(origin_point=pt_106, cell_scale=Slider(4, range=0..10), x_axis_extent=number_slider_89, y_axis_extent=number_slider_89)  # -> grid_cell_curves_2, grid_area_centroids
pt_107 = Point(flatten(square_grid_generator_18.grid_area_centroids))
pt_108 = Point(flatten(square_grid_generator_19.grid_area_centroids))
pt_109 = Point(flatten(square_grid_generator_20.grid_area_centroids))
pt_110 = Point(flatten(square_grid_generator_21.grid_area_centroids))
crv_166 = Curve(flatten(square_grid_generator_18.grid_cell_curves_2))
crv_167 = Curve(flatten(square_grid_generator_19.grid_cell_curves_2))
crv_168 = Curve(flatten(square_grid_generator_20.grid_cell_curves_2))
crv_169 = Curve(flatten(square_grid_generator_21.grid_cell_curves_2))
explode_18 = Explode(Curve=crv_166, Recursive=True)  # -> Segments, Vertices
explode_19 = Explode(Curve=crv_167, Recursive=True)  # -> Segments, Vertices
explode_20 = Explode(Curve=crv_168, Recursive=True)  # -> Segments, Vertices
explode_21 = Explode(Curve=crv_169, Recursive=True)  # -> Segments, Vertices
number_slider_90 = Slider(0.9, range=0..1)
number_slider_91 = Slider(0.25, range=0..1)
number_slider_92 = Slider(0.35, range=0..1)
number_slider_93 = Slider(0.8, range=0..1)
number_slider_94 = Slider(0.45, range=0..1)
number_slider_95 = Slider(0.7, range=0..1)
number_slider_96 = Slider(0.55, range=0..1)
number_slider_97 = Slider(0.6, range=0..1)
item_35 = ListItem(List=explode_18.Vertices, Index=0, Wrap=True)  # -> Item, Item1, Item2, Item3
item_36 = ListItem(List=explode_19.Vertices, Index=0, Wrap=True)  # -> Item, Item1, Item2, Item3
item_37 = ListItem(List=explode_18.Segments, Index=0, Wrap=True)  # -> Item, Item1, Item2, Item3
item_38 = ListItem(List=explode_19.Segments, Index=0, Wrap=True)  # -> Item, Item1, Item2, Item3
item_39 = ListItem(List=explode_20.Vertices, Index=0, Wrap=True)  # -> Item, Item1, Item2, Item3
item_40 = ListItem(List=explode_20.Segments, Index=0, Wrap=True)  # -> Item, Item1, Item2, Item3
item_41 = ListItem(List=explode_21.Vertices, Index=0, Wrap=True)  # -> Item, Item1, Item2, Item3
item_42 = ListItem(List=explode_21.Segments, Index=0, Wrap=True)  # -> Item, Item1, Item2, Item3
number_slider_98 = Slider(1, range=0..1)
number_slider_99 = Slider(1, range=0..1)
number_slider_100 = Slider(1, range=0..1)
pt_111 = Point(item_35.Item)
pt_112 = Point(item_35.Item1)
pt_113 = Point(item_35.Item2)
pt_114 = Point(item_35.Item3)
number_slider_101 = Slider(1, range=0..1)
pt_115 = Point(item_36.Item)
pt_116 = Point(item_36.Item1)
pt_117 = Point(item_36.Item2)
pt_118 = Point(item_36.Item3)
pt_119 = Point(item_39.Item)
pt_120 = Point(item_39.Item1)
pt_121 = Point(item_39.Item2)
pt_122 = Point(item_39.Item3)
pt_123 = Point(item_41.Item)
pt_124 = Point(item_41.Item1)
pt_125 = Point(item_41.Item2)
pt_126 = Point(item_41.Item3)
subtraction_35 = Subtraction(A=number_slider_98, B=number_slider_90)
subtraction_36 = Subtraction(A=number_slider_99, B=number_slider_93)
ln_86 = Line(StartPoint=pt_112, EndPoint=pt_114)
ln_87 = Line(StartPoint=pt_116, EndPoint=pt_118)
subtraction_37 = Subtraction(A=number_slider_100, B=number_slider_95)
subtraction_38 = Subtraction(A=number_slider_98, B=number_slider_91)
subtraction_39 = Subtraction(A=number_slider_99, B=number_slider_92)
ln_88 = Line(StartPoint=pt_120, EndPoint=pt_122)
subtraction_40 = Subtraction(A=number_slider_101, B=number_slider_97)
subtraction_41 = Subtraction(A=number_slider_100, B=number_slider_94)
ln_89 = Line(StartPoint=pt_124, EndPoint=pt_126)
subtraction_42 = Subtraction(A=number_slider_101, B=number_slider_96)
eval_86 = EvaluateCurve(Curve=reparameterize(item_37.Item), Parameter=number_slider_91)  # -> Point, Tangent, Angle
eval_87 = EvaluateCurve(Curve=reparameterize(item_38.Item), Parameter=number_slider_92)  # -> Point, Tangent, Angle
eval_88 = EvaluateCurve(Curve=reparameterize(item_37.Item2), Parameter=number_slider_90)  # -> Point, Tangent, Angle
eval_89 = EvaluateCurve(Curve=reparameterize(item_38.Item2), Parameter=number_slider_93)  # -> Point, Tangent, Angle
eval_90 = EvaluateCurve(Curve=reparameterize(item_37.Item1), Parameter=subtraction_38)  # -> Point, Tangent, Angle
eval_91 = EvaluateCurve(Curve=reparameterize(item_40.Item), Parameter=number_slider_94)  # -> Point, Tangent, Angle
eval_92 = EvaluateCurve(Curve=reparameterize(item_37.Item3), Parameter=subtraction_35)  # -> Point, Tangent, Angle
eval_93 = EvaluateCurve(Curve=reparameterize(item_38.Item1), Parameter=subtraction_39)  # -> Point, Tangent, Angle
eval_94 = EvaluateCurve(Curve=reparameterize(item_38.Item3), Parameter=subtraction_36)  # -> Point, Tangent, Angle
eval_95 = EvaluateCurve(Curve=reparameterize(ln_86), Parameter=number_slider_90)  # -> Point, Tangent, Angle
eval_96 = EvaluateCurve(Curve=reparameterize(ln_87), Parameter=number_slider_93)  # -> Point, Tangent, Angle
eval_97 = EvaluateCurve(Curve=reparameterize(item_40.Item2), Parameter=number_slider_95)  # -> Point, Tangent, Angle
eval_98 = EvaluateCurve(Curve=reparameterize(item_42.Item), Parameter=number_slider_96)  # -> Point, Tangent, Angle
eval_99 = EvaluateCurve(Curve=reparameterize(item_40.Item1), Parameter=subtraction_41)  # -> Point, Tangent, Angle
eval_100 = EvaluateCurve(Curve=reparameterize(item_40.Item3), Parameter=subtraction_37)  # -> Point, Tangent, Angle
eval_101 = EvaluateCurve(Curve=reparameterize(ln_88), Parameter=number_slider_95)  # -> Point, Tangent, Angle
eval_102 = EvaluateCurve(Curve=reparameterize(item_42.Item2), Parameter=number_slider_97)  # -> Point, Tangent, Angle
eval_103 = EvaluateCurve(Curve=reparameterize(item_42.Item1), Parameter=subtraction_42)  # -> Point, Tangent, Angle
eval_104 = EvaluateCurve(Curve=reparameterize(item_42.Item3), Parameter=subtraction_40)  # -> Point, Tangent, Angle
eval_105 = EvaluateCurve(Curve=reparameterize(ln_89), Parameter=number_slider_97)  # -> Point, Tangent, Angle
ln_90 = Line(StartPoint=eval_86.Point, EndPoint=eval_88.Point)
ln_91 = Line(StartPoint=eval_87.Point, EndPoint=eval_89.Point)
ln_92 = Line(StartPoint=eval_90.Point, EndPoint=eval_92.Point)
ln_93 = Line(StartPoint=eval_93.Point, EndPoint=eval_94.Point)
ln_94 = Line(StartPoint=pt_111, EndPoint=eval_95.Point)
ln_95 = Line(StartPoint=pt_115, EndPoint=eval_96.Point)
ln_96 = Line(StartPoint=eval_91.Point, EndPoint=eval_97.Point)
ln_97 = Line(StartPoint=pt_113, EndPoint=eval_95.Point)
ln_98 = Line(StartPoint=pt_117, EndPoint=eval_96.Point)
ln_99 = Line(StartPoint=eval_99.Point, EndPoint=eval_100.Point)
ln_100 = Line(StartPoint=pt_119, EndPoint=eval_101.Point)
ln_101 = Line(StartPoint=eval_98.Point, EndPoint=eval_102.Point)
ln_102 = Line(StartPoint=pt_121, EndPoint=eval_101.Point)
ln_103 = Line(StartPoint=eval_103.Point, EndPoint=eval_104.Point)
ln_104 = Line(StartPoint=pt_123, EndPoint=eval_105.Point)
ln_105 = Line(StartPoint=pt_125, EndPoint=eval_105.Point)
number_slider_102 = Slider(4, range=0..10)
number_slider_103 = Slider(4, range=0..10)
number_slider_104 = Slider(4, range=0..10)
number_slider_105 = Slider(4, range=0..10)
arrpolar_35 = PolarArray(Geometry=[ln_90, ln_92], Plane=graft(pt_107), Count=number_slider_102, Angle=6.283185307)  # -> Geometry, Transform
arrpolar_36 = PolarArray(Geometry=[ln_91, ln_93], Plane=graft(pt_108), Count=number_slider_103, Angle=6.283185307)  # -> Geometry, Transform
arrpolar_37 = PolarArray(Geometry=[ln_94, ln_97], Plane=graft(pt_107), Count=number_slider_102, Angle=6.283185307)  # -> Geometry, Transform
arrpolar_38 = PolarArray(Geometry=[ln_96, ln_99], Plane=graft(pt_109), Count=number_slider_104, Angle=6.283185307)  # -> Geometry, Transform
arrpolar_39 = PolarArray(Geometry=[ln_95, ln_98], Plane=graft(pt_108), Count=number_slider_103, Angle=6.283185307)  # -> Geometry, Transform
arrpolar_40 = PolarArray(Geometry=[ln_101, ln_103], Plane=graft(pt_110), Count=number_slider_105, Angle=6.283185307)  # -> Geometry, Transform
arrpolar_41 = PolarArray(Geometry=[ln_100, ln_102], Plane=graft(pt_109), Count=number_slider_104, Angle=6.283185307)  # -> Geometry, Transform
arrpolar_42 = PolarArray(Geometry=[ln_104, ln_105], Plane=graft(pt_110), Count=number_slider_105, Angle=6.283185307)  # -> Geometry, Transform
crv_170 = Curve(arrpolar_35.Geometry)
crv_171 = Curve(arrpolar_36.Geometry)
crv_172 = Curve(arrpolar_37.Geometry)
crv_173 = Curve(arrpolar_39.Geometry)
crv_174 = Curve(arrpolar_38.Geometry)
crv_175 = Curve(arrpolar_41.Geometry)
crv_176 = Curve(arrpolar_40.Geometry)
crv_177 = Curve(arrpolar_42.Geometry)
crv_178 = Curve(flatten([crv_170, crv_172]))
crv_179 = Curve(flatten([crv_171, crv_173]))
crv_180 = Curve(flatten([crv_174, crv_175]))
crv_181 = Curve(flatten([crv_176, crv_177]))
bbox_18 = BoundingBox(Content=crv_178, Plane=PlaneXY(0, 0, 0), UnionBox=True)  # -> Box, Box_2
bbox_19 = BoundingBox(Content=crv_179, Plane=PlaneXY(0, 0, 0), UnionBox=True)  # -> Box, Box_2
bbox_20 = BoundingBox(Content=crv_180, Plane=PlaneXY(0, 0, 0), UnionBox=True)  # -> Box, Box_2
bbox_21 = BoundingBox(Content=crv_181, Plane=PlaneXY(0, 0, 0), UnionBox=True)  # -> Box, Box_2
srfsplit_18 = SurfaceSplit(Surface=bbox_18.Box, Curves=crv_178)
srfsplit_19 = SurfaceSplit(Surface=bbox_19.Box, Curves=crv_179)
srfsplit_20 = SurfaceSplit(Surface=bbox_20.Box, Curves=crv_180)
srfsplit_21 = SurfaceSplit(Surface=bbox_21.Box, Curves=crv_181)
crv_182 = Curve(srfsplit_18)
crv_183 = Curve(srfsplit_19)
crv_184 = Curve(srfsplit_20)
crv_185 = Curve(srfsplit_21)
area_26 = Area(Geometry=crv_182)  # -> Area, Centroid
area_27 = Area(Geometry=crv_183)  # -> Area, Centroid
area_28 = Area(Geometry=crv_184)  # -> Area, Centroid
area_29 = Area(Geometry=crv_185)  # -> Area, Centroid
scale_22 = Scale(Geometry=crv_182, Center=area_26.Centroid, Factor=Slider(0.85, range=0..1))  # -> Geometry, Transform
scale_23 = Scale(Geometry=crv_183, Center=area_27.Centroid, Factor=Slider(0.85, range=0..1))  # -> Geometry, Transform
scale_24 = Scale(Geometry=crv_184, Center=area_28.Centroid, Factor=Slider(0.85, range=0..1))  # -> Geometry, Transform
scale_25 = Scale(Geometry=crv_185, Center=area_29.Centroid, Factor=Slider(0.85, range=0..1))  # -> Geometry, Transform
crv_186 = Curve(scale_22.Geometry)
crv_187 = Curve(scale_23.Geometry)
crv_188 = Curve(scale_24.Geometry)
crv_189 = Curve(scale_25.Geometry)

# ==== cluster SquareGridGenerator: Grid Gen
y_axis_extent = ClusterInput()
x_axis_extent = ClusterInput()
in = ClusterInput()  # "---------------------"
origin_point = ClusterInput()
cell_scale = ClusterInput()
y_axis_extent_2 = Number(y_axis_extent)
x_axis_extent_2 = Number(x_axis_extent)
cell_scale_2 = Number(cell_scale)
origin_point_2 = Point(origin_point)
division = Division(XAxisExtent=x_axis_extent_2, B=cell_scale_2)
division_2 = Division(YAxisExtent=y_axis_extent_2, B=cell_scale_2)
sqgrid = Square(Plane=origin_point_2, Size=cell_scale_2, ExtentX=division, ExtentY=division_2)  # -> Cells, Points
grid_cell_curves = Curve(sqgrid.Cells)
area = Area(Geometry=grid_cell_curves)  # -> Area, GridAreaCentroids
grid_area_centroids = ClusterOutput(area.GridAreaCentroids)
grid_cell_curves_2 = ClusterOutput(grid_cell_curves)

# ==== cluster CurveAttractor: Utility
C = ClusterInput()
P = ClusterInput()
x = ClusterInput()
A = ClusterInput()
B = ClusterInput()
crv_cp = CurveClosestPoint(Point=P, Curve=C)  # -> Point, Parameter, Distance
dom = ConstructDomain(DomainStart=A, DomainEnd=B)
bnd = Bounds(Numbers=crv_cp.Distance)
remap = RemapNumbers(Value=crv_cp.Distance, Source=bnd, Target=dom)  # -> Mapped, Clipped
R = ClusterOutput(remap.Mapped)
points_on_curve = Point(crv_cp.Point)
points_on_curve_2 = ClusterOutput(points_on_curve)
