# Grasshopper definition LIBRARY_2D_Magnetic-Field-Lines.gh (Grasshopper 1.0.7)

number_slider = Slider(48, range=0..100)
neg = Negative(Value=number_slider)
pt = Point(Point(0, 0, 0))
dom = ConstructDomain(DomainStart=number_slider, DomainEnd=neg)
rectangle = Rectangle(Plane=pt, XSize=dom, YSize=dom, Radius=0)  # -> Rectangle, Length
area = Area(Geometry=rectangle.Rectangle)  # -> Area, Centroid
scale = Scale(Geometry=rectangle.Rectangle, Center=area.Centroid, Factor=Slider(0.8, range=0..1))  # -> Geometry, Transform
srf = Surface(rectangle.Rectangle)
srf_2 = Surface(scale.Geometry)
popgeo = PopulateGeometry(Geometry=srf_2, Count=Slider(5, range=0..10), Seed=Slider(2, range=0..10))

# ----
# Changes strength of spin force
number_slider_2 = Slider(2, range=0..10)
fspin = SpinForce(Plane=popgeo, Strength=number_slider_2, Radius=Slider(7, range=0..10), Decay=Slider(6, range=0..10), Bounds=srf)

pcharge = PointCharge(Point=popgeo, Charge=Slider(4.7, range=0..10), Decay=Slider(1.7, range=0..10), Bounds=srf)
lng = ListLength(List=popgeo)
dom_2 = ConstructDomain(DomainStart=Slider(1, range=0..10), DomainEnd=Slider(6, range=0..10))
mergef = MergeFields(Fields=[pcharge, fspin])
random = Random(Range=dom_2, Number=lng, Seed=2)

# ----
# Increase number of Lines
number_slider_3 = Slider(50, range=0..100)
cir = Circle(Plane=popgeo, Radius=random)
divide = DivideCurve(Curve=cir, Count=number_slider_3, Kinks=False)  # -> Points, Tangents, Parameters

fline = FieldLine(Field=mergef, Point=divide.Points, Steps=1000, Accuracy=0.1, Method=3)
crv = Curve(fline)

crv_2 = Curve()
# Superior Offset Node
area_2 = Area(Geometry=crv_2)  # -> Area, Centroid
python = GhPythonScript(crv=crv_2, dir=area_2.Centroid, dis=Slider(0.375, range=0..10))  # -> out, a
# ---------- python: Python ----------
__author__ = "arias"
__version__ = "2023.06.12"

import rhinoscriptsyntax as rs

a = rs.OffsetCurve(crv,dir,dis)
# ---------- end python ----------

panel = Panel(area_2.Area)
merge = Merge(Data1=python.a)  # -> flatten(Result)
