# Grasshopper definition LIBRARY_2D_Parakeet-Patterns.gh (Grasshopper 1.0.7)
# plug-ins: Parakeet

number_slider = Slider(1, range=0..10)
pt = Point(Point(0, 0, 0))
number_slider_2 = Slider(1, range=0..10)
number_slider_3 = Slider(2, range=0..10)
pt_2 = Point(Point(0, 0, 0))
pt_3 = Point(Point(0, 0, 0))
pt_4 = Point(Point(0, 0, 0))
number_slider_4 = Slider(69, range=0..100)
number_slider_5 = Slider(2, range=0..10)
number_slider_6 = Slider(2, range=0..10)
division = Division(A=Slider(8, range=0..100), B=number_slider)
division_2 = Division(A=Slider(29, range=0..100), B=number_slider)
pt_5 = Point(Point(0, 0, 0))
pt_6 = Point(Point(0, 0, 0))
division_3 = Division(A=Slider(10, range=0..100), B=number_slider_2)
division_4 = Division(A=Slider(32, range=0..100), B=number_slider_2)
division_5 = Division(A=Slider(24, range=0..100), B=number_slider_3)
number_slider_7 = Slider(0.545, range=0..1)
tiling_e_sr = TruncatedHexagonal(Plane=pt_4, Size=Slider(2, range=0..10), ExtendX=Slider(16, range=0..100), ExtendY=Slider(5, range=0..100))
tiling_f_sr = TruncatedTrihexagonal(Plane=pt, Size=number_slider, ExtendX=division_2, ExtendY=division)
trihexagonal = Trihexagonal(Plane=pt_5, Size=Slider(4, range=0..10), ExtendX=Slider(8, range=0..100), ExtendY=Slider(9, range=0..100))
division_6 = Division(A=Slider(71, range=0..100), B=number_slider_5)
division_7 = Division(A=Slider(44, range=0..100), B=number_slider_5)
division_8 = Division(A=Slider(14, range=0..100), B=number_slider_6)
division_9 = Division(A=Slider(29, range=0..100), B=number_slider_6)
tiling_e_sr_2 = TruncatedHexagonal(Plane=pt_2, Size=number_slider_2, ExtendX=division_4, ExtendY=division_3)
tiling_c_sr = Rhombitrihexagonal(Plane=pt_3, Size=number_slider_3, ExtendX=division_5, ExtendY=division_5)
area = Area(Geometry=tiling_e_sr)  # -> Area, Centroid
area_2 = Area(Geometry=tiling_e_sr_2)  # -> Area, Centroid
area_3 = Area(Geometry=tiling_f_sr)  # -> Area, Centroid
pdecon = Deconstruct(Point=area.Centroid)  # -> XComponent, YComponent, ZComponent
area_4 = Area(Geometry=tiling_c_sr)  # -> Area, Centroid
_2tilingd = _2UniformTilingD(Plane=pt_6, Size=number_slider_6, ExtendX=division_9, ExtendY=division_8)
dom = ConstructDomain(DomainStart=Slider(0.03, range=0..0.1), DomainEnd=Slider(1, range=0..1))
construct_rectangle = ConstructRectangle(x_axis_extent=number_slider_4, y_axis_extent=number_slider_4)
cset = CreateSet(List=area_2.Area)  # -> Set, Map
cset_2 = CreateSet(List=area_3.Area)  # -> Set, Map
bnd = Bounds(Numbers=flatten(pdecon.XComponent))
pattern_genotype_p = PatternGenotypeP(BasePolylines=trihexagonal, RotatioFactor=number_slider_7, BulgeFactor=number_slider_7, Degree=2)  # -> flatten(Pattern)
cset_3 = CreateSet(List=area_4.Area)  # -> Set, Map
area_5 = Area(Geometry=_2tilingd)  # -> Area, Centroid
sift = SiftPattern(List=tiling_e_sr_2, SiftPattern=cset.Map)  # -> Output0, Output1, Output2
remap = RemapNumbers(Value=pdecon.XComponent, Source=bnd, Target=dom)  # -> Mapped, Clipped
sift_2 = SiftPattern(List=tiling_f_sr, SiftPattern=cset_2.Map)  # -> Output0, Output1, Output2
sift_3 = SiftPattern(List=tiling_c_sr, SiftPattern=cset_3.Map)  # -> Output0, Output1, Output2
cset_4 = CreateSet(List=area_5.Area)  # -> Set, Map
crv = Curve(sift.Output0)
crv_2 = Curve(sift.Output1)
crv_3 = Curve(sift_2.Output0)
crv_4 = Curve(sift_2.Output1)
crv_5 = Curve(sift_2.Output2)
crv_6 = Curve(sift_3.Output0)
crv_7 = Curve(sift_3.Output1)
crv_8 = Curve(sift_3.Output2)
patterngena = PatternGenotypeA(BasePolylines=tiling_e_sr, Factor=remap.Mapped)
bbox = BoundingBox(Content=pattern_genotype_p, Plane=PlaneXY(0, 0, 0), UnionBox=True)  # -> Box, Box_2
sift_4 = SiftPattern(List=_2tilingd, SiftPattern=cset_4.Map)  # -> Output0, Output1, Output2
crv_9 = Curve(sift_4.Output1)
crv_10 = Curve(sift_4.Output0)
crv_11 = Curve(sift_4.Output2)
brick_a = BrickTypeA(BaseSurface=construct_rectangle, UCount=division_7, VCount=division_6, OffsetDistance=Slider(0.25, range=0..1))
srfsplit = SurfaceSplit(Surface=bbox.Box, Curves=pattern_genotype_p)
crv_12 = Curve(<curve referenced from the Rhino model>)
crv_13 = Curve(<curve referenced from the Rhino model>)
area_6 = Area(Geometry=crv_2)  # -> Area, Centroid
area_7 = Area(Geometry=crv)  # -> Area, Centroid
crv_14 = Curve(<curve referenced from the Rhino model>)
crv_15 = Curve(<curve referenced from the Rhino model>)
crv_16 = Curve(<curve referenced from the Rhino model>)
area_8 = Area(Geometry=crv_4)  # -> Area, Centroid
area_9 = Area(Geometry=crv_3)  # -> Area, Centroid
area_10 = Area(Geometry=crv_5)  # -> Area, Centroid
crv_17 = Curve(<curve referenced from the Rhino model>)
crv_18 = Curve(<curve referenced from the Rhino model>)
crv_19 = Curve(<curve referenced from the Rhino model>)
area_11 = Area(Geometry=crv_7)  # -> Area, Centroid
area_12 = Area(Geometry=crv_6)  # -> Area, Centroid
area_13 = Area(Geometry=crv_8)  # -> Area, Centroid
crv_20 = Curve(srfsplit)
crv_21 = Curve(brick_a)
curve_attractor = CurveAttractor(C=crv_12, P=area_6.Centroid, A=Slider(0.8, range=0..1), B=Slider(0.2, range=0..1))  # -> R, points_on_curve_2
curve_attractor_2 = CurveAttractor(C=crv_13, P=area_7.Centroid, A=Slider(0.2, range=0..1), B=Slider(0.8, range=0..1))  # -> R, points_on_curve_2
curve_attractor_3 = CurveAttractor(C=crv_14, P=area_8.Centroid, A=Slider(0.8, range=0..1), B=Slider(0.2, range=0..1))  # -> R, points_on_curve_2
crv_22 = Curve(<curve referenced from the Rhino model>)
crv_23 = Curve(<curve referenced from the Rhino model>)
curve_attractor_4 = CurveAttractor(C=crv_15, P=area_9.Centroid, A=Slider(0.2, range=0..1), B=Slider(0.8, range=0..1))  # -> R, points_on_curve_2
curve_attractor_5 = CurveAttractor(C=crv_16, P=area_10.Centroid, A=Slider(0.2, range=0..1), B=Slider(0.8, range=0..1))  # -> R, points_on_curve_2
area_14 = Area(Geometry=crv_9)  # -> Area, Centroid
area_15 = Area(Geometry=crv_10)  # -> Area, Centroid
curve_attractor_6 = CurveAttractor(C=crv_17, P=area_11.Centroid, A=Slider(0.8, range=0..1), B=Slider(0.2, range=0..1))  # -> R, points_on_curve_2
curve_attractor_7 = CurveAttractor(C=crv_18, P=area_12.Centroid, A=Slider(0.2, range=0..1), B=Slider(0.8, range=0..1))  # -> R, points_on_curve_2
curve_attractor_8 = CurveAttractor(C=crv_19, P=area_13.Centroid, A=Slider(0.2, range=0..1), B=Slider(0.8, range=0..1))  # -> R, points_on_curve_2
crv_24 = Curve(<curve referenced from the Rhino model>)
area_16 = Area(Geometry=crv_20)  # -> Area, Centroid
lng = ListLength(List=crv_21)
curve_attractor_9 = CurveAttractor(C=crv_22, P=area_14.Centroid, A=Slider(0.8, range=0..1), B=Slider(0.2, range=0..1))  # -> R, points_on_curve_2
curve_attractor_10 = CurveAttractor(C=crv_23, P=area_15.Centroid, A=Slider(0.2, range=0..1), B=Slider(0.8, range=0..1))  # -> R, points_on_curve_2
curve_attractor_11 = CurveAttractor(C=crv_24, P=area_16.Centroid, A=Slider(0.2, range=0..1), B=Slider(0.8, range=0..1))  # -> R, points_on_curve_2
scale = Scale(Geometry=crv_2, Center=area_6.Centroid, Factor=curve_attractor.R)  # -> Geometry, Transform
scale_2 = Scale(Geometry=crv, Center=area_7.Centroid, Factor=curve_attractor_2.R)  # -> Geometry, Transform
scale_3 = Scale(Geometry=crv_4, Center=area_8.Centroid, Factor=curve_attractor_3.R)  # -> Geometry, Transform
division_10 = Division(A=lng, B=Slider(2, range=0..10))
scale_4 = Scale(Geometry=crv_3, Center=area_9.Centroid, Factor=curve_attractor_4.R)  # -> Geometry, Transform
scale_5 = Scale(Geometry=crv_5, Center=area_10.Centroid, Factor=curve_attractor_5.R)  # -> Geometry, Transform
scale_6 = Scale(Geometry=crv_7, Center=area_11.Centroid, Factor=curve_attractor_6.R)  # -> Geometry, Transform
scale_7 = Scale(Geometry=crv_6, Center=area_12.Centroid, Factor=curve_attractor_7.R)  # -> Geometry, Transform
scale_8 = Scale(Geometry=crv_8, Center=area_13.Centroid, Factor=curve_attractor_8.R)  # -> Geometry, Transform
crv_25 = Curve([scale_2.Geometry, scale.Geometry])
scale_9 = Scale(Geometry=crv_9, Center=area_14.Centroid, Factor=curve_attractor_9.R)  # -> Geometry, Transform
scale_10 = Scale(Geometry=crv_10, Center=area_15.Centroid, Factor=curve_attractor_10.R)  # -> Geometry, Transform
reduce = RandomReduce(List=crv_21, Reduction=division_10, Seed=1)
crv_26 = Curve([scale_7.Geometry, scale_6.Geometry, scale_8.Geometry])
lng_2 = ListLength(List=crv_26)
crv_27 = Curve([scale_4.Geometry, scale_3.Geometry, scale_5.Geometry])
scale_11 = Scale(Geometry=crv_20, Center=area_16.Centroid, Factor=curve_attractor_11.R)  # -> Geometry, Transform
lng_3 = ListLength(List=scale.Geometry)
lng_4 = ListLength(List=scale_2.Geometry)
division_11 = Division(A=lng_2, B=Slider(4, range=0..10))
crv_28 = Curve(reduce)
division_12 = Division(A=lng_3, B=Slider(5, range=0..10))
division_13 = Division(A=lng_4, B=Slider(2, range=0..10))
crv_29 = Curve([scale_10.Geometry, scale_9.Geometry])
lng_5 = ListLength(List=crv_27)
reduce_2 = RandomReduce(List=crv_26, Reduction=division_11, Seed=1)
crv_30 = Curve(scale_11.Geometry)
number_slider_8 = Slider(69, range=0..100)
number_slider_9 = Slider(2, range=0..10)
reduce_3 = RandomReduce(List=scale.Geometry, Reduction=division_12, Seed=1)
division_14 = Division(A=lng_5, B=Slider(3, range=0..10))
reduce_4 = RandomReduce(List=scale_2.Geometry, Reduction=division_13, Seed=1)
lng_6 = ListLength(List=crv_29)
lng_7 = ListLength(List=crv_30)
division_15 = Division(A=lng_6, B=Slider(2, range=0..10))
division_16 = Division(A=Slider(33, range=0..100), B=number_slider_9)
division_17 = Division(A=Slider(92, range=0..100), B=number_slider_9)
crv_31 = Curve([reduce_4, reduce_3])
reduce_5 = RandomReduce(List=crv_27, Reduction=division_14, Seed=1)
division_18 = Division(A=lng_7, B=Slider(2, range=0..10))
reduce_6 = RandomReduce(List=crv_29, Reduction=division_15, Seed=1)
crv_32 = Curve(reduce_5)
construct_rectangle_2 = ConstructRectangle(x_axis_extent=number_slider_8, y_axis_extent=number_slider_8)
reduce_7 = RandomReduce(List=crv_30, Reduction=division_18, Seed=1)
crv_33 = Curve(reduce_6)
crv_34 = Curve(reduce_7)
brick_a_2 = BrickTypeA(BaseSurface=construct_rectangle_2, UCount=division_17, VCount=division_16, OffsetDistance=Slider(0.25, range=0..1))
crv_35 = Curve(brick_a_2)
lng_8 = ListLength(List=crv_35)
division_19 = Division(A=lng_8, B=Slider(4, range=0..10))
reduce_8 = RandomReduce(List=crv_35, Reduction=division_19, Seed=1)
crv_36 = Curve(reduce_8)

# ==== cluster CurveAttractor: Utility
C = ClusterInput()
P = ClusterInput()
x = ClusterInput()
A = ClusterInput()
B = ClusterInput()
crv_cp = CurveClosestPoint(Point=P, Curve=C)  # -> Point, Parameter, Distance
dom = ConstructDomain(DomainStart=A, DomainEnd=B)
bnd = Bounds(Numbers=crv_cp.Distance)
remap = RemapNumbers(Value=crv_cp.Distance, Source=bnd, Target=dom)  # -> Mapped, Clipped
R = ClusterOutput(remap.Mapped)
points_on_curve = Point(crv_cp.Point)
points_on_curve_2 = ClusterOutput(points_on_curve)

# ==== cluster ConstructRectangle: Constructed Base
origin_point = OriginPoint(Point(0, 0, 0))
y_axis_extent = ClusterInput()
x_axis_extent = ClusterInput()
rectangle = Rectangle(OriginPoint=origin_point, XAxisExtent=x_axis_extent, YAxisExtent=y_axis_extent, Radius=Slider(0, range=0..100))  # -> Rectangle, Length
R = ClusterOutput(rectangle.Rectangle)
