# Grasshopper definition LIBRARY_2D_Rotated-Rectangle.gh (Grasshopper 1.0.7)

pt = Point(Point(0, 0, 0))
number_slider = Slider(24, range=0..100)
square_grid_generator = SquareGridGenerator(origin_point=pt, cell_scale=Slider(1, range=0..10), x_axis_extent=number_slider, y_axis_extent=number_slider)  # -> flatten(grid_cell_curves_2), flatten(grid_area_centroids)
crv = Curve(<curve referenced from the Rhino model>)
curve_attractor = CurveAttractor(C=crv, P=square_grid_generator.grid_area_centroids, A=Slider(0.2, range=0..1), B=Slider(0.8, range=0..1))  # -> R, points_on_curve_2
scale_nu = ScaleNU(
    Geometry=square_grid_generator.grid_cell_curves_2,
    Plane=square_grid_generator.grid_area_centroids,
    ScaleX=curve_attractor.R,
    ScaleY=Slider(0.9, range=0..1),
    ScaleZ=1)  # -> Geometry, Transform
crv_2 = Curve(<curve referenced from the Rhino model>)
curve_attractor_2 = CurveAttractor(C=crv_2, P=square_grid_generator.grid_area_centroids, A=Slider(70, range=0..100), B=Slider(0, range=0..100))  # -> R, points_on_curve_2
rotate = Rotate(Geometry=scale_nu.Geometry, Angle=degrees(curve_attractor_2.R), Plane=square_grid_generator.grid_area_centroids)  # -> Geometry, Transform
crv_3 = Curve(rotate.Geometry)
crv_4 = Curve(crv_3)
lng = ListLength(List=crv_4)
division = Division(A=lng, B=Slider(2, range=0..10))
reduce = RandomReduce(List=crv_4, Reduction=division, Seed=1)
crv_5 = Curve(reduce)

# ==== cluster SquareGridGenerator: Grid Gen
y_axis_extent = ClusterInput()
x_axis_extent = ClusterInput()
in = ClusterInput()  # "---------------------"
origin_point = ClusterInput()
cell_scale = ClusterInput()
y_axis_extent_2 = Number(y_axis_extent)
x_axis_extent_2 = Number(x_axis_extent)
cell_scale_2 = Number(cell_scale)
origin_point_2 = Point(origin_point)
division = Division(XAxisExtent=x_axis_extent_2, B=cell_scale_2)
division_2 = Division(YAxisExtent=y_axis_extent_2, B=cell_scale_2)
sqgrid = Square(Plane=origin_point_2, Size=cell_scale_2, ExtentX=division, ExtentY=division_2)  # -> Cells, Points
grid_cell_curves = Curve(sqgrid.Cells)
area = Area(Geometry=grid_cell_curves)  # -> Area, GridAreaCentroids
grid_area_centroids = ClusterOutput(area.GridAreaCentroids)
grid_cell_curves_2 = ClusterOutput(grid_cell_curves)

# ==== cluster CurveAttractor: Utility
C = ClusterInput()
P = ClusterInput()
x = ClusterInput()
A = ClusterInput()
B = ClusterInput()
crv_cp = CurveClosestPoint(Point=P, Curve=C)  # -> Point, Parameter, Distance
dom = ConstructDomain(DomainStart=A, DomainEnd=B)
bnd = Bounds(Numbers=crv_cp.Distance)
remap = RemapNumbers(Value=crv_cp.Distance, Source=bnd, Target=dom)  # -> Mapped, Clipped
R = ClusterOutput(remap.Mapped)
points_on_curve = Point(crv_cp.Point)
points_on_curve_2 = ClusterOutput(points_on_curve)
