# Grasshopper definition LIBRARY_3D_Panel-Wave-Wall.gh (Grasshopper 1.0.7)

number_slider = Slider(24, range=0..100)
construct_rectangle = ConstructRectangle(x_axis_extent=number_slider, y_axis_extent=number_slider)
subdivide_rectangle = SubdivideRectangle(
    constructed_rectangle=construct_rectangle,
    x_axis_subdivisions=Slider(24, range=0..100),
    y_axis_subdivisions=Slider(24, range=0..100))  # -> points, constructed_rectangle_2
crv = Curve(<curve referenced from the Rhino model>)
intcrv = Interpolate(Vertices=subdivide_rectangle.points, Degree=3, Periodic=False, KnotStyle=1)  # -> Curve, Length, Domain
curve_attractor = CurveAttractor(C=crv, P=subdivide_rectangle.points, A=Slider(4.4, range=0..10), B=Slider(0.5, range=0..10))  # -> R, points_on_curve_2
Z = UnitZ(Factor=curve_attractor.R)
move = Move(Geometry=subdivide_rectangle.points, Motion=Z)  # -> Geometry, Transform
intcrv_2 = Interpolate(Vertices=move.Geometry, Degree=3, Periodic=False, KnotStyle=1)  # -> Curve, Length, Domain
X = UnitX(Factor=Slider(0.125, range=0..1))
loft = Loft(
    Curves=[intcrv_2.Curve, intcrv.Curve],
    Options={Adjust=False, Closed=False, LoftEnds=0, LoftSimp=0, LoftType=0, Rebuild=10, Refit=0.01})
extr = Extrude(Base=loft, Direction=X)

# ==== cluster ConstructRectangle: Constructed Base
origin_point = OriginPoint(Point(0, 0, 0))
y_axis_extent = ClusterInput()
x_axis_extent = ClusterInput()
rectangle = Rectangle(OriginPoint=origin_point, XAxisExtent=x_axis_extent, YAxisExtent=y_axis_extent, Radius=Slider(0, range=0..100))  # -> Rectangle, Length
R = ClusterOutput(rectangle.Rectangle)

# ==== cluster SubdivideRectangle: Constructed Base
x_axis_subdivisions = ClusterInput()
y_axis_subdivisions = ClusterInput()
constructed_rectangle = ClusterInput()
sdivide = DivideSurface(ConstructedRectangle=constructed_rectangle, XAxisSubdivisions=x_axis_subdivisions, YAxisSubdivisions=y_axis_subdivisions)  # -> Points, Normals, Parameters
points = ClusterOutput(sdivide.Points)
constructed_rectangle_2 = ClusterOutput(constructed_rectangle)

# ==== cluster CurveAttractor: Utility
C = ClusterInput()
P = ClusterInput()
x = ClusterInput()
A = ClusterInput()
B = ClusterInput()
crv_cp = CurveClosestPoint(Point=P, Curve=C)  # -> Point, Parameter, Distance
dom = ConstructDomain(DomainStart=A, DomainEnd=B)
bnd = Bounds(Numbers=crv_cp.Distance)
remap = RemapNumbers(Value=crv_cp.Distance, Source=bnd, Target=dom)  # -> Mapped, Clipped
R = ClusterOutput(remap.Mapped)
points_on_curve = Point(crv_cp.Point)
points_on_curve_2 = ClusterOutput(points_on_curve)
