# Grasshopper definition LIBRARY_Online-Examples.gh (Grasshopper 1.0.7)

number_slider = Slider(10, range=0..100)

number_slider_2 = Slider(10, range=0..100)
pt = Point(Point(0, 0, 0))
hex_grid_generator = HexGridGenerator(origin_point=pt, cell_scale=Slider(1, range=0..10), x_axis_extent=number_slider_2, y_axis_extent=number_slider_2)  # -> flatten(grid_cell_curves_2), flatten(grid_area_centroids)
item = ListItem(List=hex_grid_generator.grid_area_centroids, Index=0, Wrap=True)
item_2 = ListItem(List=hex_grid_generator.grid_cell_curves_2, Index=0, Wrap=True)
scale = Scale(Geometry=item_2, Center=item, Factor=Slider(0.41, range=0..1))  # -> Geometry, Transform
explode = Explode(Curve=item_2, Recursive=True)  # -> flatten(Segments), Vertices
explode_2 = Explode(Curve=scale.Geometry, Recursive=True)  # -> flatten(Segments), Vertices
item_3 = ListItem(List=explode.Segments, Index=0, Wrap=True)
item_4 = ListItem(List=explode_2.Segments, Index=0, Wrap=True)
lng = ListLength(List=explode.Segments)
end = EndPoints(Curve=item_4)  # -> Start, End
end_2 = EndPoints(Curve=item_3)  # -> Start, End
ln = Line(StartPoint=item, EndPoint=hex_grid_generator.grid_area_centroids)
intcrv = Interpolate(Vertices=[end_2.Start, end.Start, end_2.End], Degree=3, Periodic=False, KnotStyle=1)  # -> Curve, Length, Domain
ln_2 = Line(StartPoint=end_2.Start, EndPoint=end_2.End)
join = JoinCurves(Curves=[intcrv.Curve, ln_2], Preserve=False)
arrpolar = PolarArray(Geometry=intcrv.Curve, Plane=item, Count=lng, Angle=6.283185307)  # -> Geometry, Transform
arrpolar_2 = PolarArray(Geometry=join, Plane=item, Count=lng, Angle=6.283185307)  # -> Geometry, Transform
join_2 = JoinCurves(Curves=arrpolar.Geometry, Preserve=False)
join_3 = JoinCurves(Curves=arrpolar_2.Geometry, Preserve=False)
move = Move(Geometry=join_3, Motion=graft(ln))  # -> flatten(Geometry), Transform
area = Area(Geometry=move.Geometry)  # -> Area, Centroid
move_2 = Move(Geometry=join_2, Motion=graft(ln))  # -> flatten(Geometry), Transform
area_2 = Area(Geometry=move_2.Geometry)  # -> Area, Centroid

number_slider_3 = Slider(10, range=0..100)
pt_2 = Point(Point(0, 0, 0))
hex_grid_generator_2 = HexGridGenerator(origin_point=pt_2, cell_scale=Slider(1, range=0..10), x_axis_extent=number_slider_3, y_axis_extent=number_slider_3)  # -> flatten(grid_cell_curves_2), flatten(grid_area_centroids)
item_5 = ListItem(List=hex_grid_generator_2.grid_area_centroids, Index=0, Wrap=True)
item_6 = ListItem(List=hex_grid_generator_2.grid_cell_curves_2, Index=0, Wrap=True)
number_slider_4 = Slider(0.71, range=0..1)
scale_2 = Scale(Geometry=item_6, Center=item_5, Factor=Slider(0.38, range=0..1))  # -> Geometry, Transform
explode_3 = Explode(Curve=item_6, Recursive=True)  # -> flatten(Segments), Vertices
lng_2 = ListLength(List=explode_3.Segments)
explode_4 = Explode(Curve=scale_2.Geometry, Recursive=True)  # -> flatten(Segments), Vertices
explode_5 = Explode(Curve=scale_2.Geometry, Recursive=True)  # -> Segments, Vertices
subtraction = Subtraction(A=1, B=number_slider_4)
item_7 = ListItem(List=explode_3.Segments, Index=0, Wrap=True)
item_8 = ListItem(List=explode_4.Segments, Index=0, Wrap=True)
eval = EvaluateCurve(Curve=reparameterize(item_8), Parameter=Slider(1, range=0..1))  # -> Point, Tangent, Angle
ln_3 = Line(StartPoint=item_5, EndPoint=hex_grid_generator_2.grid_area_centroids)
eval_2 = EvaluateCurve(Curve=reparameterize(item_7), Parameter=subtraction)  # -> Point, Tangent, Angle
eval_3 = EvaluateCurve(Curve=reparameterize(item_7), Parameter=number_slider_4)  # -> Point, Tangent, Angle
merge = Merge(Data1=eval_3.Point, Data2=eval.Point, Data3=eval_2.Point)
number_slider_5 = Slider(6, range=0..10)
intcrv_2 = Interpolate(Vertices=merge, Degree=3, Periodic=False, KnotStyle=1)  # -> Curve, Length, Domain
arrpolar_3 = PolarArray(Geometry=intcrv_2.Curve, Plane=item_5, Count=lng_2, Angle=6.283185307)  # -> Geometry, Transform
move_3 = Move(Geometry=arrpolar_3.Geometry, Motion=graft(ln_3))  # -> flatten(Geometry), Transform
join_4 = JoinCurves(Curves=move_3.Geometry, Preserve=False)
cls = Closed(Curve=join_4)  # -> Closed, Periodic
cull = CullPattern(List=join_4, CullPattern=cls.Closed)
area_3 = Area(Geometry=cull)  # -> Area, Centroid

number_slider_6 = Slider(10, range=0..100)
pt_3 = Point(Point(0, 0, 0))
hex_grid_generator_3 = HexGridGenerator(origin_point=pt_3, cell_scale=Slider(0.5, range=0..10), x_axis_extent=number_slider_6, y_axis_extent=number_slider_6)  # -> flatten(grid_cell_curves_2), flatten(grid_area_centroids)
crv = Curve(<curve referenced from the Rhino model>)
curve_attractor = CurveAttractor(C=crv, P=hex_grid_generator_3.grid_area_centroids, A=Slider(0.02, range=0..1), B=Slider(1, range=0..1))  # -> R, points_on_curve_2
Z = UnitZ(Factor=curve_attractor.R)
neg = Negative(Value=Z)
move_4 = Move(Geometry=hex_grid_generator_3.grid_area_centroids, Motion=neg)  # -> Geometry, Transform
extr = ExtrudePoint(Base=hex_grid_generator_3.grid_cell_curves_2, Point=move_4.Geometry)
cap = CapHoles(Brep=extr)

construct_rectangle = ConstructRectangle(x_axis_extent=Slider(50, range=0..1000), y_axis_extent=Slider(50, range=0..1000))
number_slider_7 = Slider(5, range=0..10)
dom = ConstructDomain(DomainStart=Slider(0, range=0..1), DomainEnd=Slider(1, range=0..1))
crv_2 = Curve(construct_rectangle)
random = Random(Range=dom, Number=number_slider_7, Seed=Slider(1, range=0..100))
random_2 = Random(Range=dom, Number=number_slider_7, Seed=Slider(2, range=0..100))
random_3 = Random(Range=dom, Number=number_slider_7, Seed=Slider(3, range=0..100))
random_4 = Random(Range=dom, Number=number_slider_7, Seed=Slider(4, range=0..100))
explode_6 = Explode(Curve=crv_2, Recursive=True)  # -> Segments, Vertices
item_9 = ListItem(List=explode_6.Segments, Index=0, Wrap=True)  # -> Item, Item1, Item2, Item3
number_slider_8 = Slider(4, range=0..10)
eval_4 = EvaluateCurve(Curve=reparameterize(item_9.Item), Parameter=random)  # -> Point, Tangent, Angle
eval_5 = EvaluateCurve(Curve=reparameterize(item_9.Item1), Parameter=random_2)  # -> Point, Tangent, Angle
eval_6 = EvaluateCurve(Curve=reparameterize(item_9.Item2), Parameter=random_3)  # -> Point, Tangent, Angle
eval_7 = EvaluateCurve(Curve=reparameterize(item_9.Item3), Parameter=random_4)  # -> Point, Tangent, Angle
ln_4 = Line(StartPoint=eval_4.Point, EndPoint=eval_5.Point)
ln_5 = Line(StartPoint=eval_4.Point, EndPoint=eval_6.Point)
ln_6 = Line(StartPoint=eval_4.Point, EndPoint=eval_7.Point)
ln_7 = Line(StartPoint=eval_5.Point, EndPoint=eval_6.Point)
ln_8 = Line(StartPoint=eval_5.Point, EndPoint=eval_7.Point)
ln_9 = Line(StartPoint=eval_6.Point, EndPoint=eval_7.Point)
weave = Weave(
    Pattern=[0, 1, 2, 3, 4, 5],
    Stream0=ln_4,
    Stream1=ln_5,
    Stream2=ln_6,
    Stream3=ln_7,
    Stream4=ln_8,
    Stream5=ln_9,
    NullGaps=False)
crv_3 = Curve(crv_2)
srf = Surface(crv_2)
culln = CullNth(List=weave, CullFrequency=number_slider_8)
culln_2 = CullNth(List=culln, CullFrequency=number_slider_8)
culln_3 = CullNth(List=culln_2, CullFrequency=number_slider_8)
culln_4 = CullNth(List=culln_3, CullFrequency=number_slider_8)
srfsplit = SurfaceSplit(Surface=srf, Curves=weave)
srfsplit_2 = SurfaceSplit(Surface=srf, Curves=culln)
srfsplit_3 = SurfaceSplit(Surface=srf, Curves=culln_2)
srfsplit_4 = SurfaceSplit(Surface=srf, Curves=culln_3)
srfsplit_5 = SurfaceSplit(Surface=srf, Curves=culln_4)
crv_4 = Curve(srfsplit)
crv_5 = Curve(srfsplit_2)
crv_6 = Curve(srfsplit_3)
crv_7 = Curve(srfsplit_4)
crv_8 = Curve(srfsplit_5)
area_4 = Area(Geometry=crv_4)  # -> Area, Centroid
area_5 = Area(Geometry=crv_5)  # -> Area, Centroid
area_6 = Area(Geometry=crv_6)  # -> Area, Centroid
area_7 = Area(Geometry=crv_7)  # -> Area, Centroid
area_8 = Area(Geometry=crv_8)  # -> Area, Centroid
scale_3 = Scale(Geometry=crv_4, Center=area_4.Centroid, Factor=Slider(0.98, range=0..1))  # -> Geometry, Transform
scale_4 = Scale(Geometry=crv_5, Center=area_5.Centroid, Factor=Slider(0.92, range=0..1))  # -> Geometry, Transform
scale_5 = Scale(Geometry=crv_6, Center=area_6.Centroid, Factor=Slider(0.85, range=0..1))  # -> Geometry, Transform
scale_6 = Scale(Geometry=crv_7, Center=area_7.Centroid, Factor=Slider(0.8, range=0..1))  # -> Geometry, Transform
scale_7 = Scale(Geometry=crv_8, Center=area_8.Centroid, Factor=Slider(0.75, range=0..1))  # -> Geometry, Transform

pt_4 = Point(Point(0, 0, 0))
number_slider_9 = Slider(10, range=0..100)
pt_5 = Point(Point(0, 0, 0))
hex_grid_generator_4 = HexGridGenerator(origin_point=pt_4, cell_scale=Slider(1, range=0..10), x_axis_extent=number_slider, y_axis_extent=number_slider)  # -> flatten(grid_cell_curves_2), flatten(grid_area_centroids)
construct_point = ConstructPoint(x_axis_point=Slider(2.11, range=0..10), y_axis_point=Slider(5.21, range=0..10))
construct_point_2 = ConstructPoint(x_axis_point=Slider(0, range=0..10), y_axis_point=Slider(4.71, range=0..10))
hex_grid_generator_5 = HexGridGenerator(origin_point=pt_5, cell_scale=Slider(1, range=0..10), x_axis_extent=number_slider_9, y_axis_extent=number_slider_9)  # -> flatten(grid_cell_curves_2), flatten(grid_area_centroids)
explode_7 = Explode(Curve=hex_grid_generator_4.grid_cell_curves_2, Recursive=True)  # -> Segments, Vertices
pt_6 = Point(Point(0, 0, 0))
item_10 = ListItem(List=explode_7.Vertices, Index=0, Wrap=True)  # -> Item, Item1
vec2pt = Vector2Pt(PointA=pt_6, PointB=construct_point, Unitize=False)  # -> Vector, Length
vec2pt_2 = Vector2Pt(PointA=pt_6, PointB=construct_point_2, Unitize=False)  # -> Vector, Length
scale_8 = Scale(
    Geometry=hex_grid_generator_5.grid_cell_curves_2,
    Center=hex_grid_generator_5.grid_area_centroids,
    Factor=Slider(0.5, range=0..1))  # -> Geometry, Transform
cp = ControlPoints(Curve=hex_grid_generator_5.grid_cell_curves_2)  # -> Points, Weights, Knots
rdiff = RegionDifference()
cp_2 = ControlPoints(Curve=scale_8.Geometry)  # -> Points, Weights, Knots
pdeform = PointDeform(
    Geometry=hex_grid_generator_4.grid_cell_curves_2,
    Points=[item_10.Item, item_10.Item1],
    Motion=[vec2pt.Vector, vec2pt_2.Vector])  # -> flatten(Geometry)
ln_10 = Line(StartPoint=cp.Points, EndPoint=cp_2.Points)
area_9 = Area(Geometry=pdeform)  # -> Area, Centroid
pdeform_2 = PointDeform(Geometry=hex_grid_generator_5.grid_cell_curves_2, Points=cp.Points, Motion=ln_10)  # -> flatten(Geometry)
cset = CreateSet(List=area_9.Area)  # -> Set, Map
sift = SiftPattern(List=pdeform, SiftPattern=cset.Map)  # -> Output0, Output1, Output2, Output3, Output4
area_10 = Area(Geometry=pdeform_2)  # -> Area, Centroid
crv_9 = Curve(sift.Output0)
crv_10 = Curve(sift.Output1)
crv_11 = Curve(sift.Output2)
cset_2 = CreateSet(List=area_10.Area)  # -> Set, Map
crv_12 = Curve(sift.Output3)
crv_13 = Curve(sift.Output4)
area_11 = Area(Geometry=crv_9)  # -> Area, Centroid
area_12 = Area(Geometry=crv_10)  # -> Area, Centroid
sift_2 = SiftPattern(List=pdeform_2, SiftPattern=cset_2.Map)  # -> Output0, Output1, Output2
crv_14 = Curve(sift_2.Output1)
crv_15 = Curve(sift_2.Output0)
crv_16 = Curve(sift_2.Output2)
crv_17 = Curve(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)
crv_18 = Curve(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)
crv_19 = Curve([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])
trimap = TriangleMapping(Geometry=crv_17, Source=crv_18, Target=crv_19)  # -> Geometry, Transform

# ==== cluster HexGridGenerator: Grid Gen
y_axis_extent = ClusterInput()
x_axis_extent = ClusterInput()
in = ClusterInput()  # "---------------------"
origin_point = ClusterInput()
cell_scale = ClusterInput()
y_axis_extent_2 = Number(y_axis_extent)
x_axis_extent_2 = Number(x_axis_extent)
cell_scale_2 = Number(cell_scale)
origin_point_2 = Point(origin_point)
division = Division(XAxisExtent=x_axis_extent_2, B=cell_scale_2)
division_2 = Division(YAxisExtent=y_axis_extent_2, B=cell_scale_2)
hexgrid = Hexagonal(Plane=origin_point_2, Size=cell_scale_2, ExtentX=division, ExtentY=division_2)  # -> Cells, Points
grid_cell_curves = Curve(hexgrid.Cells)
area = Area(Geometry=grid_cell_curves)  # -> Area, GridAreaCentroids
grid_area_centroids = ClusterOutput(area.GridAreaCentroids)
grid_cell_curves_2 = ClusterOutput(grid_cell_curves)

# ==== cluster ConstructRectangle: Constructed Base
origin_point = OriginPoint(Point(0, 0, 0))
y_axis_extent = ClusterInput()
x_axis_extent = ClusterInput()
rectangle = Rectangle(OriginPoint=origin_point, XAxisExtent=x_axis_extent, YAxisExtent=y_axis_extent, Radius=Slider(0, range=0..100))  # -> Rectangle, Length
R = ClusterOutput(rectangle.Rectangle)

# ==== cluster CurveAttractor: Utility
C = ClusterInput()
P = ClusterInput()
x = ClusterInput()
A = ClusterInput()
B = ClusterInput()
crv_cp = CurveClosestPoint(Point=P, Curve=C)  # -> Point, Parameter, Distance
dom = ConstructDomain(DomainStart=A, DomainEnd=B)
bnd = Bounds(Numbers=crv_cp.Distance)
remap = RemapNumbers(Value=crv_cp.Distance, Source=bnd, Target=dom)  # -> Mapped, Clipped
R = ClusterOutput(remap.Mapped)
points_on_curve = Point(crv_cp.Point)
points_on_curve_2 = ClusterOutput(points_on_curve)

# ==== cluster ConstructPoint: Constructed Base
y_axis_point = ClusterInput()
x_axis_point = ClusterInput()
pt = ConstructPoint(XCoordinate=x_axis_point, YCoordinate=y_axis_point, ZCoordinate=Slider(0, range=0..100))
constructed_point = ClusterOutput(pt)
