# Grasshopper definition LIBRARY_Templates_Grids.gh (Grasshopper 1.0.7)

hex_grid_template = HexGridTemplate()  # -> grid_cell_curves, grid_area_centroids
square_grid_template = SquareGridTemplate()  # -> grid_cell_curves, grid_area_centroids
tri_grid_special_template = TriGridSpecialTemplate()  # -> grid_cell_curves_a, grid_cell_curves_b, grid_cell_area_centroids_a, grid_cell_area_centroids_b
crv = Curve(hex_grid_template.grid_cell_curves)
pt = Point(hex_grid_template.grid_area_centroids)
crv_2 = Curve(square_grid_template.grid_cell_curves)
pt_2 = Point(square_grid_template.grid_area_centroids)
crv_3 = Curve(tri_grid_special_template.grid_cell_curves_a)
crv_4 = Curve(tri_grid_special_template.grid_cell_curves_b)
pt_3 = Point(tri_grid_special_template.grid_cell_area_centroids_a)
pt_4 = Point(tri_grid_special_template.grid_cell_area_centroids_b)

# ==== cluster HexGridTemplate: Template
pt = Point(Point(0, 0, 0))
number_slider = Slider(24, range=0..100)
hex_grid_generator = HexGridGenerator(origin_point=pt, cell_scale=Slider(1, range=0..10), x_axis_extent=number_slider, y_axis_extent=number_slider)  # -> grid_cell_curves_2, grid_area_centroids
grid_cell_curves = ClusterOutput(hex_grid_generator.grid_cell_curves_2)
grid_area_centroids = ClusterOutput(hex_grid_generator.grid_area_centroids)

# ==== cluster TriGridSpecialTemplate: Template
pt = Point(Point(0, 0, 0))
number_slider = Slider(24, range=0..100)
tri_grid_generator_special = TriGridGeneratorSpecial(origin_point=pt, cell_scale=Slider(1, range=0..10), x_axis_extent=number_slider, y_axis_extent=number_slider)  # -> grid_cell_curves_a_2, grid_cell_curves_b_2, grid_cell_area_centroids_a_2, grid_cell_area_centroids_b_2
grid_cell_curves_b = ClusterOutput(tri_grid_generator_special.grid_cell_curves_b_2)
grid_cell_curves_a = ClusterOutput(tri_grid_generator_special.grid_cell_curves_a_2)
grid_cell_area_centroids_a = ClusterOutput(tri_grid_generator_special.grid_cell_area_centroids_a_2)
grid_cell_area_centroids_b = ClusterOutput(tri_grid_generator_special.grid_cell_area_centroids_b_2)

# ==== cluster SquareGridTemplate: Template
pt = Point(Point(0, 0, 0))
number_slider = Slider(24, range=0..100)
square_grid_generator = SquareGridGenerator(origin_point=pt, cell_scale=Slider(1, range=0..10), x_axis_extent=number_slider, y_axis_extent=number_slider)  # -> grid_cell_curves_2, grid_area_centroids
grid_cell_curves = ClusterOutput(square_grid_generator.grid_cell_curves_2)
grid_area_centroids = ClusterOutput(square_grid_generator.grid_area_centroids)

# ==== cluster HexGridGenerator: Grid Gen
y_axis_extent = ClusterInput()
x_axis_extent = ClusterInput()
in = ClusterInput()  # "---------------------"
origin_point = ClusterInput()
cell_scale = ClusterInput()
y_axis_extent_2 = Number(y_axis_extent)
x_axis_extent_2 = Number(x_axis_extent)
cell_scale_2 = Number(cell_scale)
origin_point_2 = Point(origin_point)
division = Division(XAxisExtent=x_axis_extent_2, B=cell_scale_2)
division_2 = Division(YAxisExtent=y_axis_extent_2, B=cell_scale_2)
hexgrid = Hexagonal(Plane=origin_point_2, Size=cell_scale_2, ExtentX=division, ExtentY=division_2)  # -> Cells, Points
grid_cell_curves = Curve(hexgrid.Cells)
area = Area(Geometry=grid_cell_curves)  # -> Area, GridAreaCentroids
grid_area_centroids = ClusterOutput(area.GridAreaCentroids)
grid_cell_curves_2 = ClusterOutput(grid_cell_curves)

# ==== cluster TriGridGeneratorSpecial: Grid Gen
cell_scale = ClusterInput()
origin_point = ClusterInput()
x_axis_extent = ClusterInput()
y_axis_extent = ClusterInput()
tri_grid_generator = TriGridGenerator(origin_point=origin_point, cell_scale=cell_scale, x_axis_extent=x_axis_extent, y_axis_extent=y_axis_extent)  # -> grid_cell_curves_2, grid_cell_area_centroids
dispatch = Dispatch(List=tri_grid_generator.grid_cell_area_centroids, DispatchPattern=[True, False])  # -> ListA, ListB
dispatch_2 = Dispatch(List=tri_grid_generator.grid_cell_curves_2, DispatchPattern=[True, False])  # -> ListA, ListB
flip = FlipMatrix(Data=dispatch.ListB)
flip_2 = FlipMatrix(Data=dispatch.ListA)
flip_3 = FlipMatrix(Data=dispatch_2.ListB)
flip_4 = FlipMatrix(Data=dispatch_2.ListA)
dispatch_3 = Dispatch(List=flatten(flip), DispatchPattern=[True, False])  # -> ListA, ListB
dispatch_4 = Dispatch(List=flatten(flip_2), DispatchPattern=[True, False])  # -> ListA, ListB
dispatch_5 = Dispatch(List=flatten(flip_3), DispatchPattern=[True, False])  # -> ListA, ListB
dispatch_6 = Dispatch(List=flatten(flip_4), DispatchPattern=[True, False])  # -> ListA, ListB
weave = Weave(Pattern=[0, 1], Stream0=dispatch_4.ListB, Stream1=dispatch_3.ListA, NullGaps=False)
weave_2 = Weave(Pattern=[0, 1], Stream0=dispatch_4.ListA, Stream1=dispatch_3.ListB, NullGaps=False)
weave_3 = Weave(Pattern=[0, 1], Stream0=dispatch_6.ListB, Stream1=dispatch_5.ListA, NullGaps=False)
weave_4 = Weave(Pattern=[0, 1], Stream0=dispatch_6.ListA, Stream1=dispatch_5.ListB, NullGaps=False)
grid_cell_area_centroids_b = Point(weave)
grid_cell_area_centroids_a = Point(weave_2)
grid_cell_curves_a = Curve(weave_4)
grid_cell_curves_b = Curve(weave_3)
grid_cell_curves_b_2 = ClusterOutput(grid_cell_curves_b)
grid_cell_area_centroids_b_2 = ClusterOutput(grid_cell_area_centroids_b)
grid_cell_area_centroids_a_2 = ClusterOutput(grid_cell_area_centroids_a)
grid_cell_curves_a_2 = ClusterOutput(grid_cell_curves_a)

# ==== cluster SquareGridGenerator: Grid Gen
y_axis_extent = ClusterInput()
x_axis_extent = ClusterInput()
in = ClusterInput()  # "---------------------"
origin_point = ClusterInput()
cell_scale = ClusterInput()
y_axis_extent_2 = Number(y_axis_extent)
x_axis_extent_2 = Number(x_axis_extent)
cell_scale_2 = Number(cell_scale)
origin_point_2 = Point(origin_point)
division = Division(XAxisExtent=x_axis_extent_2, B=cell_scale_2)
division_2 = Division(YAxisExtent=y_axis_extent_2, B=cell_scale_2)
sqgrid = Square(Plane=origin_point_2, Size=cell_scale_2, ExtentX=division, ExtentY=division_2)  # -> Cells, Points
grid_cell_curves = Curve(sqgrid.Cells)
area = Area(Geometry=grid_cell_curves)  # -> Area, GridAreaCentroids
grid_area_centroids = ClusterOutput(area.GridAreaCentroids)
grid_cell_curves_2 = ClusterOutput(grid_cell_curves)

# ==== cluster TriGridGenerator: Grid Gen
y_axis_extent = ClusterInput()
x_axis_extent = ClusterInput()
in = ClusterInput()  # "---------------------"
origin_point = ClusterInput()
cell_scale = ClusterInput()
y_axis_extent_2 = Number(y_axis_extent)
x_axis_extent_2 = Number(x_axis_extent)
cell_scale_2 = Number(cell_scale)
origin_point_2 = Point(origin_point)
division = Division(XAxisExtent=x_axis_extent_2, B=cell_scale_2)
division_2 = Division(YAxisExtent=y_axis_extent_2, B=cell_scale_2)
trigrid = Triangular(Plane=origin_point_2, Size=cell_scale_2, ExtentX=division, ExtentY=division_2)  # -> Cells, Points
grid_cell_curves = Curve(trigrid.Cells)
area = Area(Geometry=grid_cell_curves)  # -> Area, GridCellAreaCentroids
grid_cell_area_centroids = ClusterOutput(area.GridCellAreaCentroids)
grid_cell_curves_2 = ClusterOutput(grid_cell_curves)
